# Dynamo graph script.dyn "Dyn123STR" (Dynamo 2.6.1.8786)

# group: WIP - RIP
code_block = CodeBlock { Category.ByName("Fenêtres"); "Hauteur de l'appui"; "Ht de l'appui"; }
all_elements_of_category = ElementsOfCategory(Category=code_block.out0)
getParameterValueByName = Element.GetParameterValueByName(element=all_elements_of_category, parameterName=code_block.out1)
code_block_2 = CodeBlock(e=getParameterValueByName) { ""+e; }
length = String.Length(str=code_block_2)
code_block_3 = CodeBlock(x=length) { x-1; }
code_block_4 = CodeBlock { -4; }
remove = String.Remove(str=code_block_2, startIndex=code_block_3, count=code_block_4)
setParameterByName = Element.SetParameterByName(element=all_elements_of_category, parameterName=code_block.out2, value=remove)  # frozen

# group: Section Linteau - Fenetres + Portes
code_block_5 = CodeBlock()
# ---------- code_block_5.designscript (9 lines) ----------
[Category.ByName("Fenêtres"),Category.ByName("Portes")];

"L 20x20ht";
"L 20x25ht";
"L 20x30ht";
"L Dimensions Personnalisées (b x h)";

"L Dimensions Personnalisées (b)";
"L Dimensions Personnalisées (h)";
# ----------------------------------------
all_elements_of_category_2 = ElementsOfCategory(Category=code_block_5.out0)
code_block_6 = CodeBlock { "Dyn Section Linteau"; }
getParameterValueByName_2 = Element.GetParameterValueByName(element=all_elements_of_category_2, parameterName=code_block_5.out1)
getParameterValueByName_3 = Element.GetParameterValueByName(element=all_elements_of_category_2, parameterName=code_block_5.out2)
getParameterValueByName_4 = Element.GetParameterValueByName(element=all_elements_of_category_2, parameterName=code_block_5.out3)
getParameterValueByName_5 = Element.GetParameterValueByName(element=all_elements_of_category_2, parameterName=code_block_5.out4)
getParameterValueByName_6 = Element.GetParameterValueByName(element=all_elements_of_category_2, parameterName=code_block_5.out5)
code_block_7 = CodeBlock(b=getParameterValueByName_6) { ""+b; }
length_2 = String.Length(str=code_block_7)
code_block_8 = CodeBlock(x=length_2) { x-1; }
code_block_9 = CodeBlock { ",00"; }
contains = String.Contains(str=code_block_7, searchFor=code_block_9)
code_block_10 = CodeBlock(a=contains)
# ---------- code_block_10.designscript (5 lines) ----------
a;

a==true ?
	-7:
	-4;
# ----------------------------------------
remove_2 = String.Remove(str=code_block_7, startIndex=code_block_8, count=code_block_10.out1)
getParameterValueByName_7 = Element.GetParameterValueByName(element=all_elements_of_category_2, parameterName=code_block_5.out6)
code_block_11 = CodeBlock(h=getParameterValueByName_7) { ""+h; }
length_3 = String.Length(str=code_block_11)
code_block_12 = CodeBlock(x=length_3) { x-1; }
code_block_13 = CodeBlock { ",00"; }
contains_2 = String.Contains(str=code_block_11, searchFor=code_block_13)
code_block_14 = CodeBlock(a=contains_2)  # same code as code_block_10
remove_3 = String.Remove(str=code_block_11, startIndex=code_block_12, count=code_block_14.out1)
code_block_15 = CodeBlock(b=remove_2, h=remove_3) { b+"x"+h+"ht"; }
code_block_16 = CodeBlock(a=getParameterValueByName_2, b=getParameterValueByName_3, c=getParameterValueByName_4, d=getParameterValueByName_5, dimPerso=code_block_15)
# ---------- code_block_16.designscript (15 lines) ----------
a;
b;
c;
d;
dimPerso;

a==1?
"20x20ht":
	b==1?
	"20x25ht":
		c==1?
		"20x30ht":
			d==1?
			dimPerso:
			"Selectionner un LT";
# ----------------------------------------
setParameterByName_2 = Element.SetParameterByName(element=all_elements_of_category_2, parameterName=code_block_6, value=code_block_16.out5)

# group: WIP - RIP
categories = Categories()  # nothing selected
code_block_17 = CodeBlock { Category.ByName("Poteaux porteurs"); "Dyn Section Poteau"; }
all_elements_of_category_3 = ElementsOfCategory(Category=code_block_17.out0)
getParameterValueByName_8 = Element.GetParameterValueByName(element=all_elements_of_category_3, parameterName=code_block_17.out1)  # frozen
name = Parameter.Name(parameter=all_elements_of_category_3)  # frozen

# group: old - AS Murs
code_block_18 = CodeBlock { Category.ByName("Murs"); "Contrainte supérieure"; "Contrainte inférieure"; "Hauteur non contrainte"; }
all_elements_of_category_4 = ElementsOfCategory(Category=code_block_18.out0)
code_block_19 = CodeBlock { "Dyn AS Murs REL"; }
setParameterByName_3 = Element.SetParameterByName(element=all_elements_of_category_4, parameterName=code_block_19)  # frozen; unwired: value
getParameterValueByName_9 = Element.GetParameterValueByName(element=all_elements_of_category_4, parameterName=code_block_18.out2)
elevation = Level.Elevation(level=getParameterValueByName_9)
round = Math.Round(number=elevation)
getParameterValueByName_10 = Element.GetParameterValueByName(element=all_elements_of_category_4, parameterName=code_block_18.out3)
round_2 = Math.Round(number=getParameterValueByName_10)
code_block_20 = CodeBlock(AltNiveau=round, HtSousLinteau=round_2) { AltNiveau+HtSousLinteau; }

# group: AS Murs
code_block_21 = CodeBlock { Category.ByName("Murs"); "Contrainte supérieure"; }
all_elements_of_category_5 = ElementsOfCategory(Category=code_block_21.out0)
code_block_22 = CodeBlock { "Dyn AS Murs REL"; }
getParameterValueByName_11 = Element.GetParameterValueByName(element=all_elements_of_category_5, parameterName=code_block_21.out1)
elevation_2 = Level.Elevation(level=getParameterValueByName_11)

round_3 = Math.Round(number=elevation_2)

# group (continued): AS Murs
setParameterByName_4 = Element.SetParameterByName(element=all_elements_of_category_5, parameterName=code_block_22, value=round_3)

# group: AI Linteau
code_block_23 = CodeBlock { [Category.ByName("Fenêtres"),Category.ByName("Portes")]; "Niveau"; "Hauteur sous linteau"; }
all_elements_of_category_6 = ElementsOfCategory(Category=code_block_23.out0)
code_block_24 = CodeBlock { "Dyn AI Linteau REL"; }
getParameterValueByName_12 = Element.GetParameterValueByName(element=all_elements_of_category_6, parameterName=code_block_23.out1)
elevation_3 = Level.Elevation(level=getParameterValueByName_12)
round_4 = Math.Round(number=elevation_3)
getParameterValueByName_13 = Element.GetParameterValueByName(element=all_elements_of_category_6, parameterName=code_block_23.out2)
code_block_25 = CodeBlock(AltNiveau=round_4, HtSousLinteau=getParameterValueByName_13) { AltNiveau+HtSousLinteau; }
setParameterByName_5 = Element.SetParameterByName(element=all_elements_of_category_6, parameterName=code_block_24, value=code_block_25)

# group: Ai Reservations REL
code_block_26 = CodeBlock { Category.ByName("Modèles génériques"); "Élévation par rapport au niveau"; "Niveau de nomenclature"; }
all_elements_of_category_7 = ElementsOfCategory(Category=code_block_26.out0)
code_block_27 = CodeBlock { "Dyn Ai Reservation REL"; }
getParameterValueByName_14 = Element.GetParameterValueByName(element=all_elements_of_category_7, parameterName=code_block_26.out2)
elevation_4 = Level.Elevation(level=getParameterValueByName_14)
round_5 = Math.Round(number=elevation_4)
getParameterValueByName_15 = Element.GetParameterValueByName(element=all_elements_of_category_7, parameterName=code_block_26.out1)
round_6 = Math.Round(number=getParameterValueByName_15)
code_block_28 = CodeBlock(lvl=round_5, offset=round_6) { lvl+offset; }
setParameterByName_6 = Element.SetParameterByName(element=all_elements_of_category_7, parameterName=code_block_27, value=code_block_28)

# group: ProgressBar
# note: Ctrl+W - VERSION(S) OPTIMISE DE DYNAMO
# 0.00.0
# note: https://github.com/Cyril-Pop/Dynamo_PythonProgressBar
python_script_progressbarutils = Python()
# ---------- python_script_progressbarutils.python (153 lines) ----------
import sys
import clr
import System
clr.AddReference('System.Drawing')
clr.AddReference('System.Windows.Forms')
import System.Drawing
import System.Windows.Forms

from System.Drawing import *
from System.Windows.Forms import *

from System.Windows.Forms import Application, Form, ProgressBar
from System.Threading import ThreadStart, Thread
from System import Int32, Int64

__author__ = "Cyril POUPIN"
__copyright__ = "Copyright (c) 2021 Cyril.P"
__license__ = "MIT License"
__version__ = "1.0.1"

class ProgressBarUtils():

	def __init__(self):
		pass
		
	def __name__(self):
		return 'ProgressBarUtils'
		

	class ProgressBarDialog(Form):
		def __init__(self, theBroadcaster, numberLines, myTitle ):
			self._numberLines = numberLines
			self._theBroadcaster = theBroadcaster
			self._theBroadcaster.onChange += self.myFunction
			self._myTitle = myTitle
			self.InitializeComponent()
			
		
		def InitializeComponent(self):
			self._buttonCancel = System.Windows.Forms.Button()
			self._progressBar1 = System.Windows.Forms.ProgressBar()
			self._label1 = System.Windows.Forms.Label()
			self.SuspendLayout()
			# 
			# buttonCancel
			# 
			self._buttonCancel.Location = System.Drawing.Point(228, 96)
			self._buttonCancel.Name = "buttonCancel"
			self._buttonCancel.Size = System.Drawing.Size(116, 32)
			self._buttonCancel.TabIndex = 0
			self._buttonCancel.Text = "Quit"
			self._buttonCancel.UseVisualStyleBackColor = True
			self._buttonCancel.Click += self.ButtonCancelClick
			# 
			# progressBar1
			# 
			self._progressBar1.Location = System.Drawing.Point(12, 48)
			self._progressBar1.Name = "progressBar1"
			self._progressBar1.Size = System.Drawing.Size(535, 23)
			self._progressBar1.Minimum = 1
			self._progressBar1.Maximum = self._numberLines
			self._progressBar1.Step = 1
			self._progressBar1.Value = 1
			self._progressBar1.TabIndex = 1
			# 
			# label1
			# 
			self._label1.Location = System.Drawing.Point(12, 22)
			self._label1.Name = "label1"
			self._label1.Size = System.Drawing.Size(250, 23)
			self._label1.TabIndex = 2
			self._label1.Text = "Items Processing 0/" + str(self._numberLines)
			# 
			# MainForm
			# 
			self.ClientSize = System.Drawing.Size(567, 140)
			self.Controls.Add(self._label1)
			self.Controls.Add(self._progressBar1)
			#self.Controls.Add(self._buttonCancel)
			self.Name = "MainForm"
			self.Text = self._myTitle
			self.ResumeLayout(False)
			
		def myFunction(self):
			if self._progressBar1.Value < self._progressBar1.Maximum:
				self._progressBar1.Value += 1
				self._label1.Text = "Items Processing {}/{}".format(str(self._progressBar1.Value), str(self._numberLines))
				try:
					Application.DoEvents()
				except:pass	
			else:
				self._theBroadcaster.onChange -= self.myFunction	
				self.Close()				
	
	
		def ButtonCancelClick(self, sender, e):
			self.Close()
			
	
			
	class EventHook():
		def __init__(self):
			self.__handlers = []
			
		def __iadd__(self, handler):
			self.__handlers.append(handler)
			return self
	
		def __isub__(self, handler):
			self.__handlers.remove(handler)
			return self
	
		def next_p(self, *args, **keywargs):
			for handler in self.__handlers:
				handler(*args, **keywargs)
	
		def clearObjectHandlers(self, inObject):
			for theHandler in self.__handlers:
				if theHandler.im_self == inObject:
					self -= theHandler
					
		def forceClearHandlers(self):
			for theHandler in self.__handlers:
				self -= theHandler
				
	
	class MyProgressBroadcaster():
		"""
		main Class to Start UI and build a custom Event with a  ContextManager
		"""
		def __init__(self, number_Iteration,  UI_Title = "Progress Bar"):
			if isinstance(number_Iteration, (Int32, Int64, int)):
				self._number_Iteration = number_Iteration
			else:
				raise Exception("MyProgressBroadcaster : wrong 1st argument need an integer")
			if isinstance(UI_Title, str):    
				self._title = UI_Title
			else:
				raise Exception("MyProgressBroadcaster : wrong 2nd argument need an string")
			self.purg = False
			
		def __enter__(self):		
			self.onChange = ProgressBarUtils.EventHook()	
			Application.EnableVisualStyles()
			f = ProgressBarUtils.ProgressBarDialog(self, self._number_Iteration, self._title)
			f.Show()
			return 	self
			
		def __exit__(self, type, value, traceback):
			self.onChange.forceClearHandlers()

					
OUT = ProgressBarUtils
# ----------------------------------------
python_script = Python(IN[0]=python_script_progressbarutils, IN[1]=setParameterByName_4, IN[2]=setParameterByName_5, IN[3]=setParameterByName_6)  # frozen
# ---------- python_script.python (26 lines) ----------
from System.Threading import ThreadStart, Thread

ProgressBarUtils = IN[0]
pgb = ProgressBarUtils()

#example of list to processing
walls = IN[1]
windows = IN[2][0]
doors = IN[2][1]
hole  = IN[3]

lstProcessing = walls + windows + doors + hole
out = []


with pgb.MyProgressBroadcaster(len(lstProcessing), "Dyn123STR - Progression - Portes - Fenêtre - Murs") as broadcaster:
    for i in lstProcessing:
        #some operations with long duration
        Thread.Sleep(100)
        #
        #
        # increment Progress Bar via EventHook
        broadcaster.onChange.next_p()
 
        
OUT = out
# ----------------------------------------

# group: Projet IGC ?
code_block_29 = CodeBlock { Category.ByName("Cartouches"); "Nom de la feuille"; }
all_elements_of_category_8 = ElementsOfCategory(Category=code_block_29.out0)
getParameterValueByName_16 = Element.GetParameterValueByName(element=all_elements_of_category_8, parameterName=code_block_29.out1)
code_block_30 = CodeBlock(name=getParameterValueByName_16) { name=="Dossier de plan d'exécution"; }
filterByBoolMask = List.FilterByBoolMask(list=all_elements_of_category_8, mask=code_block_30)
name_2 = Family.Name(family=filterByBoolMask.in)
code_block_31 = CodeBlock(name=name_2) { name; name=="123STR Clisson"; name=="123STR Lyon"; name=="123STR Pau"; name=="123STR Strasbourg"; }
code_block_32 = CodeBlock(clisson=code_block_31.out1, lyon=code_block_31.out2, pau=code_block_31.out3, strasbourg=code_block_31.out4)
# ---------- code_block_32.designscript (7 lines) ----------
// 123 Structure
clisson;
lyon;
pau;
strasbourg;

clisson||lyon||pau||strasbourg;
# ----------------------------------------
filterByBoolMask_2 = List.FilterByBoolMask(list=filterByBoolMask.in, mask=code_block_32.out4)
code_block_33 = CodeBlock { "IGC"; 1; }
getParameterValueByName_17 = Element.GetParameterValueByName(element=filterByBoolMask_2.in, parameterName=code_block_33.out0)
contains_3 = List.Contains(list=getParameterValueByName_17, item=code_block_33.out1)

# group: LU / LB / LT IGC ?
code_block_34 = CodeBlock { [Category.ByName("Fenêtres"),Category.ByName("Portes")]; "Dyn IGC"; "Identifiant"; }
all_elements_of_category_9 = ElementsOfCategory(Category=code_block_34.out0)
setParameterByName_7 = Element.SetParameterByName(element=all_elements_of_category_9, parameterName=code_block_34.out1, value=contains_3)
code_block_35 = CodeBlock { "Dyn Linteau U"; "Dyn Linteau Béton"; }
getParameterValueByName_18 = Element.GetParameterValueByName(element=all_elements_of_category_9, parameterName=code_block_34.out2)
length_4 = String.Length(str=getParameterValueByName_18)
code_block_36 = CodeBlock(len=length_4)
# ---------- code_block_36.designscript (11 lines) ----------
len;
len-1;
len==6 ?
	-4 :
	len==5 ?
		-3 :
		len==4 ?
			-2 :
			len==3 ?
			-1:
				0;
# ----------------------------------------
remove_4 = String.Remove(str=getParameterValueByName_18, startIndex=code_block_36.out1, count=code_block_36.out2)
code_block_37 = CodeBlock(e=remove_4) { e=="LU" ? 1 : 0; e=="LB" ? 1 : 0; }
setParameterByName_8 = Element.SetParameterByName(element=all_elements_of_category_9, parameterName=code_block_35.out0, value=code_block_37.out0)
setParameterByName_9 = Element.SetParameterByName(element=all_elements_of_category_9, parameterName=code_block_35.out1, value=code_block_37.out1)

# group: Epaisseur réservation si traversant
code_block_38 = CodeBlock { Category.ByName("Modèles génériques"); "Traversant"; "Hôte"; }
all_elements_of_category_10 = ElementsOfCategory(Category=code_block_38.out0)
getParameterValueByName_19 = Element.GetParameterValueByName(element=all_elements_of_category_10, parameterName=code_block_38.out1)
code_block_39 = CodeBlock(param=getParameterValueByName_19) { param != 0; }
filterByBoolMask_3 = List.FilterByBoolMask(list=all_elements_of_category_10, mask=code_block_39)
code_block_40 = CodeBlock { "Epaisseur Reservation"; }
getParameterValueByName_20 = Element.GetParameterValueByName(element=all_elements_of_category_10, parameterName=code_block_38.out2)
length_5 = String.Length(str=getParameterValueByName_20)
code_block_41 = CodeBlock(x=length_5) { x-4; 0; }
remove_5 = String.Remove(str=getParameterValueByName_20, startIndex=code_block_41.out1, count=code_block_41.out0)
code_block_42 = CodeBlock { 2; }
remove_6 = String.Remove(str=remove_5, startIndex=code_block_42, count=code_block_42)
toNumber = String.ToNumber(str=remove_6)
setParameterByName_10 = Element.SetParameterByName(element=filterByBoolMask_3.in, parameterName=code_block_40, value=toNumber)

# group: Paramétrage ligne de modèle Reservation
code_block_43 = CodeBlock { Category.ByName("Modèles génériques"); "Élévation par rapport au niveau"; "Implantation"; "Niveau de nomenclature"; }
all_elements_of_category_11 = ElementsOfCategory(Category=code_block_43.out0)
code_block_44 = CodeBlock { "Longueur Ligne de modèle (haut)"; "Longueur Ligne de modèle (bas)"; }
python_script_2 = Python(IN[0]=all_elements_of_category_11)
# ---------- python_script_2.python (27 lines) ----------
import clr
clr.AddReference('ProtoGeometry')
from Autodesk.DesignScript.Geometry import *

clr.AddReference('RevitAPI')
import Autodesk
from Autodesk.Revit.DB import * 

toList = lambda x : x if hasattr(x, '__iter__') else [x]
lstelems = toList(UnwrapElement(IN[0]))

def getHostLink(elem):
	hostRvt = elem.Host
	hostfaceref = elem.HostFace 
	if isinstance(hostRvt, RevitLinkInstance):
		linkdoc = hostRvt.GetLinkDocument()
		hostelem = linkdoc.GetElement(hostfaceref.LinkedElementId)
		return hostelem
	else:
		return 	hostRvt
	
lsthost = []
for elem in lstelems:
	host = getHostLink(elem)
	lsthost.append(host)
	
OUT = lsthost	
# ----------------------------------------
code_block_45 = CodeBlock { "Contrainte inférieure"; "Hauteur non contrainte"; }
getParameterValueByName_21 = Element.GetParameterValueByName(element=python_script_2, parameterName=code_block_45.out0)
code_block_46 = CodeBlock(lvl=getParameterValueByName_21) { lvl == "" ? 12345 : lvl.Elevation; }
round_7 = Math.Round(number=code_block_46)
getParameterValueByName_22 = Element.GetParameterValueByName(element=all_elements_of_category_11, parameterName=code_block_43.out3)
elevation_5 = Level.Elevation(level=getParameterValueByName_22)
round_8 = Math.Round(number=elevation_5)
code_block_47 = CodeBlock(fini=round_8, brut=round_7) { fini-brut; }
getParameterValueByName_23 = Element.GetParameterValueByName(element=all_elements_of_category_11, parameterName=code_block_43.out1)
round_9 = Math.Round(number=getParameterValueByName_23)
getParameterValueByName_24 = Element.GetParameterValueByName(element=all_elements_of_category_11, parameterName=code_block_43.out2)
code_block_48 = CodeBlock(lvlInf=round_7, deltaFiniBrut=code_block_47, offset=round_9, impl=getParameterValueByName_24) { lvlInf == 12345 ? 20 : deltaFiniBrut+offset+impl; }
setParameterByName_11 = Element.SetParameterByName(element=all_elements_of_category_11, parameterName=code_block_44.out1, value=code_block_48)
getParameterValueByName_25 = Element.GetParameterValueByName(element=python_script_2, parameterName=code_block_45.out1)
code_block_49 = CodeBlock(ht=getParameterValueByName_25) { ht == "" ? 0 : ht; }
round_10 = Math.Round(number=code_block_49)
code_block_50 = CodeBlock(lvl=round_7, ht=round_10, offset=round_9, impl=getParameterValueByName_24, deltaFiniBrut=code_block_47) { lvl == 12345 ? 20 : ht-(offset+impl+deltaFiniBrut); }
setParameterByName_12 = Element.SetParameterByName(element=all_elements_of_category_11, parameterName=code_block_44.out0, value=code_block_50)

# group: Section / Diametre Reservations
code_block_51 = CodeBlock { Category.ByName("Modèles génériques"); "A"; }
all_elements_of_category_12 = ElementsOfCategory(Category=code_block_51.out0)
getParameterValueByName_26 = Element.GetParameterValueByName(element=all_elements_of_category_12, parameterName=code_block_51.out1)
code_block_52 = CodeBlock(a=getParameterValueByName_26) { a != ""; }
filterByBoolMask_4 = List.FilterByBoolMask(list=all_elements_of_category_12, mask=code_block_52)
code_block_53 = CodeBlock { "Dyn Section Reservation"; }
code_block_54 = CodeBlock { "A"; "B"; }
getParameterValueByName_27 = Element.GetParameterValueByName(element=filterByBoolMask_4.in, parameterName=code_block_54.out0)
code_block_55 = CodeBlock(a=getParameterValueByName_27) { ""+a; }
length_6 = String.Length(str=code_block_55)
code_block_56 = CodeBlock(x=length_6) { x-1; }
code_block_57 = CodeBlock { ",00"; }
contains_4 = String.Contains(str=code_block_55, searchFor=code_block_57)
code_block_58 = CodeBlock(a=contains_4)  # same code as code_block_10
remove_7 = String.Remove(str=code_block_55, startIndex=code_block_56, count=code_block_58.out1)
getParameterValueByName_28 = Element.GetParameterValueByName(element=filterByBoolMask_4.in, parameterName=code_block_54.out1)
code_block_59 = CodeBlock(b=getParameterValueByName_28) { ""+b; }
length_7 = String.Length(str=code_block_59)
code_block_60 = CodeBlock(x=length_7) { x-1; }
code_block_61 = CodeBlock { ",00"; }
contains_5 = String.Contains(str=code_block_59, searchFor=code_block_61)
code_block_62 = CodeBlock(a=contains_5)  # same code as code_block_10
remove_8 = String.Remove(str=code_block_59, startIndex=code_block_60, count=code_block_62.out1)
code_block_63 = CodeBlock(a=remove_7, b=remove_8) { a+"x"+b; }
setParameterByName_13 = Element.SetParameterByName(element=filterByBoolMask_4.in, parameterName=code_block_53, value=code_block_63)
code_block_64 = CodeBlock { "Dyn Section Reservation"; }
code_block_65 = CodeBlock { "Diametre Reservation"; }
getParameterValueByName_29 = Element.GetParameterValueByName(element=filterByBoolMask_4.out, parameterName=code_block_65)
code_block_66 = CodeBlock(d=getParameterValueByName_29) { ""+d; }
length_8 = String.Length(str=code_block_66)
code_block_67 = CodeBlock(x=length_8) { x-1; }
code_block_68 = CodeBlock { ",00"; }
contains_6 = String.Contains(str=code_block_66, searchFor=code_block_68)
code_block_69 = CodeBlock(a=contains_6)  # same code as code_block_10
remove_9 = String.Remove(str=code_block_66, startIndex=code_block_67, count=code_block_69.out1)
code_block_70 = CodeBlock(d=remove_9) { "Ø"+d; }
setParameterByName_14 = Element.SetParameterByName(element=filterByBoolMask_4.out, parameterName=code_block_64, value=code_block_70)

code_block_71 = CodeBlock(l=all_elements_of_category_2) { l[0]; }
isEmpty = List.IsEmpty(list=code_block_71)
code_block_72 = CodeBlock(l=all_elements_of_category_2) { l[1]; }
isEmpty_2 = List.IsEmpty(list=code_block_72)
code_block_73 = CodeBlock(windows=isEmpty, doors=isEmpty_2) { windows && doors ? 1: 0; }
