# Dynamo graph script.dyn "Dyn123STR-DEV-Numerotation Axes" (Dynamo 2.6.1.8786)
# packages: Clockwork for Dynamo 2.x 2.3.0

code_block = CodeBlock { Category.ByName("Quadrillages"); }
all_elements_of_category = ElementsOfCategory(Category=code_block)
code_block_2 = CodeBlock { "Type"; }
getParameterValueByName = Element.GetParameterValueByName(element=all_elements_of_category, parameterName=code_block_2)
code_block_3 = CodeBlock(e=getParameterValueByName) { e.Name; }
code_block_4 = CodeBlock(name=code_block_3) { name != "LDP"; }
filterByBoolMask = List.FilterByBoolMask(list=all_elements_of_category, mask=code_block_4)
code_block_5 = CodeBlock { "Nom"; }
code_block_6 = CodeBlock { "Nom"; }
getParameterValueByName_2 = Element.GetParameterValueByName(element=filterByBoolMask.in, parameterName=code_block_6)
toUpper = String.ToUpper(str=getParameterValueByName_2)
setParameterByName = Element.SetParameterByName(element=filterByBoolMask.in, parameterName=code_block_5, value=toUpper)
code_block_7 = CodeBlock { alphabet = "A".."Z"; List.Flatten([alphabet,alphabet<1>+alphabet<2>]); 1..100; }
contains = String.Contains(str=toUpper, searchFor=code_block_7.out1, lacing=CrossProduct)
anyTrue = Custom[Booleans.AnyTrue](seq=contains)  # package Clockwork for Dynamo 2.x; Returns true if any item in a list of booleans is true.
filterByBoolMask_2 = List.FilterByBoolMask(list=setParameterByName, mask=anyTrue)
curve = Grid.Curve(grid=filterByBoolMask_2.in)
direction = Line.Direction(line=curve)
X = Vector.X(vector=direction)
round = Math.Round(number=X)
Y = Vector.Y(vector=direction)
round_2 = Math.Round(number=Y)
code_block_8 = CodeBlock(vectorX=round, vectorY=round_2) { vectorX == 0; vectorY == 0; }
anyTrue_2 = Custom[Booleans.AnyTrue](seq=code_block_8.out0)
anyTrue_3 = Custom[Booleans.AnyTrue](seq=code_block_8.out1)
code_block_9 = CodeBlock(x=anyTrue_2, y=anyTrue_3) { x == false && y == true; }
startPoint = Curve.StartPoint(curve=curve)
X_2 = Point.X(point=startPoint)
endPoint = Curve.EndPoint(curve=curve)
X_3 = Point.X(point=endPoint)
Y_2 = Point.Y(point=startPoint)
Y_3 = Point.Y(point=endPoint)
code_block_10 = CodeBlock(startX=X_2, endX=X_3, startY=Y_2, endY=Y_3)
# ---------- code_block_10.designscript (4 lines) ----------
// X
(startX+endX)/2;
// Y
(startY+endY)/2;
# ----------------------------------------
python_script = Python(IN[0]=code_block_9, IN[1]=code_block_10.out0, IN[2]=code_block_10.out1, IN[3]=filterByBoolMask_2.in)
# ---------- python_script.python (32 lines) ----------
# Charger les bibliothèques DesignScript et Standard Python
import sys
import clr
clr.AddReference('ProtoGeometry')
from Autodesk.DesignScript.Geometry import *

# Les entrées effectuées dans ce noeud sont stockées sous forme de liste dans les variables IN.
dataEnteringNode = IN

# Placer votre code au-dessous de cette ligne
orientation = IN[0]
ptX = IN[1]
ptY = IN[2]
grid = IN[3]

list = []
out = []

if orientation == True :
	for i in range(len(ptY)):
		line = [grid[i],ptY[i]]
		list.append(line)
		out = sorted(list, key=lambda x: x[1], reverse=True)

else : 
	for i in range(len(ptX)):
		line = [grid[i],ptX[i]]
		list.append(line)
		out = sorted(list, key=lambda x: x[1], reverse=False)

# Affectez la sortie à la variable OUT.
OUT = out
# ----------------------------------------
code_block_11 = CodeBlock { 0; }
getItemAtIndex = List.GetItemAtIndex(list=python_script@L2, index=code_block_11)
code_block_12 = CodeBlock { "Nom"; }
getParameterValueByName_3 = Element.GetParameterValueByName(element=getItemAtIndex, parameterName=code_block_12)
code_block_13 = CodeBlock(name=getParameterValueByName_3) { "Nom"; "_"+name; }
setParameterByName_2 = Element.SetParameterByName(element=getItemAtIndex, parameterName=code_block_13.out0, value=code_block_13.out1)
passthrough = Custom[Passthrough](passThrough=setParameterByName_2, waitFor=setParameterByName_2)  # package Clockwork for Dynamo 2.x; Forces a sequential order of execution. The node wired into the output of the Passthrough node will be executed *after* the node wired into the waitFor input (e.g. important for some Revit operations). The value of the passThrough input will be passed on to the node wired into the output port of the Passthrough node.
code_block_14 = CodeBlock { "Nom"; }
code_block_15 = CodeBlock { "A"; }
count = List.Count(list=passthrough)
sequence = Sequence(start=code_block_15, amount=count)
setParameterByName_3 = Element.SetParameterByName(element=passthrough, parameterName=code_block_14, value=sequence)
curve_2 = Grid.Curve(grid=filterByBoolMask_2.out)
direction_2 = Line.Direction(line=curve_2)
X_4 = Vector.X(vector=direction_2)
round_3 = Math.Round(number=X_4)
Y_4 = Vector.Y(vector=direction_2)
round_4 = Math.Round(number=Y_4)
code_block_16 = CodeBlock(vectorX=round_3, vectorY=round_4) { vectorX == 0; vectorY == 0; }
anyTrue_4 = Custom[Booleans.AnyTrue](seq=code_block_16.out0)
anyTrue_5 = Custom[Booleans.AnyTrue](seq=code_block_16.out1)
code_block_17 = CodeBlock(x=anyTrue_4, y=anyTrue_5) { x == false && y == true; }
startPoint_2 = Curve.StartPoint(curve=curve_2)
X_5 = Point.X(point=startPoint_2)
endPoint_2 = Curve.EndPoint(curve=curve_2)
X_6 = Point.X(point=endPoint_2)
Y_5 = Point.Y(point=startPoint_2)
Y_6 = Point.Y(point=endPoint_2)
code_block_18 = CodeBlock(startX=X_5, endX=X_6, startY=Y_5, endY=Y_6)  # same code as code_block_10
python_script_2 = Python(IN[0]=code_block_17, IN[1]=code_block_18.out0, IN[2]=code_block_18.out1, IN[3]=filterByBoolMask_2.out)  # same code as python_script
code_block_19 = CodeBlock { 0; }
getItemAtIndex_2 = List.GetItemAtIndex(list=python_script_2@L2, index=code_block_19)
code_block_20 = CodeBlock { "Nom"; }
getParameterValueByName_4 = Element.GetParameterValueByName(element=getItemAtIndex_2, parameterName=code_block_20)
code_block_21 = CodeBlock(name=getParameterValueByName_4) { "Nom"; "_"+name; }
setParameterByName_4 = Element.SetParameterByName(element=getItemAtIndex_2, parameterName=code_block_21.out0, value=code_block_21.out1)
passthrough_2 = Custom[Passthrough](passThrough=setParameterByName_4, waitFor=setParameterByName_4)
code_block_22 = CodeBlock { 1; }
count_2 = List.Count(list=passthrough_2)
sequence_2 = Sequence(start=code_block_22, amount=count_2)
code_block_23 = CodeBlock(num=sequence_2) { "Nom"; ""+num; }
setParameterByName_5 = Element.SetParameterByName(element=passthrough_2, parameterName=code_block_23.out0, value=code_block_23.out1)
code_block_24 = CodeBlock { "Nom"; }
code_block_25 = CodeBlock { 1; }
count_3 = List.Count(list=filterByBoolMask.out)
sequence_3 = Sequence(start=code_block_25, amount=count_3, step=code_block_25)
code_block_26 = CodeBlock(id=sequence_3) { "LDP"+id; }
setParameterByName_6 = Element.SetParameterByName(element=filterByBoolMask.out, parameterName=code_block_24, value=code_block_26)
