# Dynamo graph script.dyn "DEV_C3 - Sols - Purge" (Dynamo 2.6.1.8786)

# group: Initialisation info Sols
code_block = CodeBlock()
# ---------- code_block.designscript (28 lines) ----------
"1 - Radier";


"2 - Vide Sanitaire";


"3 - Champignon";


"4 - Dallage";


"5 - Dalle portée";


"6 - Dallage industriel";


"7 - Poutrelles Hourdis";


"8 - Prédalles";


"9 - Plancher BA";


Category.ByName("Sols");
# ----------------------------------------
all_elements_of_category = ElementsOfCategory(Category=code_block.out9)
getParameterValueByName = Element.GetParameterValueByName(element=all_elements_of_category, parameterName=code_block.out3)
code_block_2 = CodeBlock(dalle=getParameterValueByName) { dalle == ""; }
filterByBoolMask = List.FilterByBoolMask(list=all_elements_of_category, mask=code_block_2)
code_block_3 = CodeBlock { 0; }
setParameterByName = Element.SetParameterByName(element=filterByBoolMask.in, parameterName=code_block.out3, value=code_block_3)
getParameterValueByName_2 = Element.GetParameterValueByName(element=all_elements_of_category, parameterName=code_block.out2)
code_block_4 = CodeBlock(champi=getParameterValueByName_2) { champi == ""; }
filterByBoolMask_2 = List.FilterByBoolMask(list=all_elements_of_category, mask=code_block_4)
code_block_5 = CodeBlock { 0; }
setParameterByName_2 = Element.SetParameterByName(element=filterByBoolMask_2.in, parameterName=code_block.out2, value=code_block_5)
getParameterValueByName_3 = Element.GetParameterValueByName(element=all_elements_of_category, parameterName=code_block.out1)
code_block_6 = CodeBlock(ph=getParameterValueByName_3) { ph == ""; }
filterByBoolMask_3 = List.FilterByBoolMask(list=all_elements_of_category, mask=code_block_6)
code_block_7 = CodeBlock { 0; }
setParameterByName_3 = Element.SetParameterByName(element=filterByBoolMask_3.in, parameterName=code_block.out1, value=code_block_7)
getParameterValueByName_4 = Element.GetParameterValueByName(element=all_elements_of_category, parameterName=code_block.out0)
code_block_8 = CodeBlock(vs=getParameterValueByName_4) { vs == ""; }
filterByBoolMask_4 = List.FilterByBoolMask(list=all_elements_of_category, mask=code_block_8)
code_block_9 = CodeBlock { 0; }
setParameterByName_4 = Element.SetParameterByName(element=filterByBoolMask_4.in, parameterName=code_block.out0, value=code_block_9)
getParameterValueByName_5 = Element.GetParameterValueByName(element=all_elements_of_category, parameterName=code_block.out4)
code_block_10 = CodeBlock(portee=getParameterValueByName_5) { portee == ""; }
filterByBoolMask_5 = List.FilterByBoolMask(list=all_elements_of_category, mask=code_block_10)
code_block_11 = CodeBlock { 0; }
setParameterByName_5 = Element.SetParameterByName(element=filterByBoolMask_5.in, parameterName=code_block.out4, value=code_block_11)
getParameterValueByName_6 = Element.GetParameterValueByName(element=all_elements_of_category, parameterName=code_block.out5)
code_block_12 = CodeBlock(indus=getParameterValueByName_6) { indus == ""; }
filterByBoolMask_6 = List.FilterByBoolMask(list=all_elements_of_category, mask=code_block_12)
code_block_13 = CodeBlock { 0; }
setParameterByName_6 = Element.SetParameterByName(element=filterByBoolMask_6.in, parameterName=code_block.out5, value=code_block_13)
getParameterValueByName_7 = Element.GetParameterValueByName(element=all_elements_of_category, parameterName=code_block.out6)
code_block_14 = CodeBlock(ph=getParameterValueByName_7) { ph == ""; }
filterByBoolMask_7 = List.FilterByBoolMask(list=all_elements_of_category, mask=code_block_14)
code_block_15 = CodeBlock { 0; }
setParameterByName_7 = Element.SetParameterByName(element=filterByBoolMask_7.in, parameterName=code_block.out6, value=code_block_15)
getParameterValueByName_8 = Element.GetParameterValueByName(element=all_elements_of_category, parameterName=code_block.out7)
code_block_16 = CodeBlock(predalle=getParameterValueByName_8) { predalle == ""; }
filterByBoolMask_8 = List.FilterByBoolMask(list=all_elements_of_category, mask=code_block_16)
code_block_17 = CodeBlock { 0; }
setParameterByName_8 = Element.SetParameterByName(element=filterByBoolMask_8.in, parameterName=code_block.out7, value=code_block_17)
getParameterValueByName_9 = Element.GetParameterValueByName(element=all_elements_of_category, parameterName=code_block.out8)
code_block_18 = CodeBlock(predalle=getParameterValueByName_9) { predalle == ""; }
filterByBoolMask_9 = List.FilterByBoolMask(list=all_elements_of_category, mask=code_block_18)
code_block_19 = CodeBlock { 0; }
setParameterByName_9 = Element.SetParameterByName(element=filterByBoolMask_9.in, parameterName=code_block.out8, value=code_block_19)

# group: Initialisation info Sols
code_block_20 = CodeBlock()
# ---------- code_block_20.designscript (34 lines) ----------
"1 - P.B. SS";


"2 - P.H. SS";


"3 - P.B. RDC";


"4 - P.H. RDC";


"5 - P.H. R+1";


"6 - P.H. R+2";


"7 - P.H. R+3";


"8 - P.H. R+4";


"9 - P.H. R+5";


"10 - P.H. R+6";


"11 - P.H. R+7";


Category.ByName("Sols");
# ----------------------------------------
all_elements_of_category_2 = ElementsOfCategory(Category=code_block_20.out11)
getParameterValueByName_10 = Element.GetParameterValueByName(element=all_elements_of_category_2, parameterName=code_block_20.out0)
code_block_21 = CodeBlock(pbFdSS=getParameterValueByName_10) { pbFdSS == ""; }
filterByBoolMask_10 = List.FilterByBoolMask(list=all_elements_of_category_2, mask=code_block_21)
code_block_22 = CodeBlock { 0; }
setParameterByName_10 = Element.SetParameterByName(element=filterByBoolMask_10.in, parameterName=code_block_20.out0, value=code_block_22)
getParameterValueByName_11 = Element.GetParameterValueByName(element=all_elements_of_category_2, parameterName=code_block_20.out1)
code_block_23 = CodeBlock(phSS=getParameterValueByName_11) { phSS == ""; }
filterByBoolMask_11 = List.FilterByBoolMask(list=all_elements_of_category_2, mask=code_block_23)
code_block_24 = CodeBlock { 0; }
setParameterByName_11 = Element.SetParameterByName(element=filterByBoolMask_11.in, parameterName=code_block_20.out1, value=code_block_24)
getParameterValueByName_12 = Element.GetParameterValueByName(element=all_elements_of_category_2, parameterName=code_block_20.out2)
code_block_25 = CodeBlock(pbFd=getParameterValueByName_12) { pbFd == ""; }
filterByBoolMask_12 = List.FilterByBoolMask(list=all_elements_of_category_2, mask=code_block_25)
code_block_26 = CodeBlock { 0; }
setParameterByName_12 = Element.SetParameterByName(element=filterByBoolMask_12.in, parameterName=code_block_20.out2, value=code_block_26)
getParameterValueByName_13 = Element.GetParameterValueByName(element=all_elements_of_category_2, parameterName=code_block_20.out3)
code_block_27 = CodeBlock(phRdc=getParameterValueByName_13) { phRdc == ""; }
filterByBoolMask_13 = List.FilterByBoolMask(list=all_elements_of_category_2, mask=code_block_27)
code_block_28 = CodeBlock { 0; }
setParameterByName_13 = Element.SetParameterByName(element=filterByBoolMask_13.in, parameterName=code_block_20.out3, value=code_block_28)
getParameterValueByName_14 = Element.GetParameterValueByName(element=all_elements_of_category_2, parameterName=code_block_20.out4)
code_block_29 = CodeBlock(phR1=getParameterValueByName_14) { phR1 == ""; }
filterByBoolMask_14 = List.FilterByBoolMask(list=all_elements_of_category_2, mask=code_block_29)
code_block_30 = CodeBlock { 0; }
setParameterByName_14 = Element.SetParameterByName(element=filterByBoolMask_14.in, parameterName=code_block_20.out4, value=code_block_30)
getParameterValueByName_15 = Element.GetParameterValueByName(element=all_elements_of_category_2, parameterName=code_block_20.out5)
code_block_31 = CodeBlock(phR2=getParameterValueByName_15) { phR2 == ""; }
filterByBoolMask_15 = List.FilterByBoolMask(list=all_elements_of_category_2, mask=code_block_31)
code_block_32 = CodeBlock { 0; }
setParameterByName_15 = Element.SetParameterByName(element=filterByBoolMask_15.in, parameterName=code_block_20.out5, value=code_block_32)
getParameterValueByName_16 = Element.GetParameterValueByName(element=all_elements_of_category_2, parameterName=code_block_20.out6)
code_block_33 = CodeBlock(phR3=getParameterValueByName_16) { phR3== ""; }
filterByBoolMask_16 = List.FilterByBoolMask(list=all_elements_of_category_2, mask=code_block_33)
code_block_34 = CodeBlock { 0; }
setParameterByName_16 = Element.SetParameterByName(element=filterByBoolMask_16.in, parameterName=code_block_20.out6, value=code_block_34)
getParameterValueByName_17 = Element.GetParameterValueByName(element=all_elements_of_category_2, parameterName=code_block_20.out7)
code_block_35 = CodeBlock(phR2=getParameterValueByName_17) { phR2 == ""; }
filterByBoolMask_17 = List.FilterByBoolMask(list=all_elements_of_category_2, mask=code_block_35)
code_block_36 = CodeBlock { 0; }
setParameterByName_17 = Element.SetParameterByName(element=filterByBoolMask_17.in, parameterName=code_block_20.out7, value=code_block_36)
getParameterValueByName_18 = Element.GetParameterValueByName(element=all_elements_of_category_2, parameterName=code_block_20.out7)
code_block_37 = CodeBlock { phR4 == ""; }  # unwired: phR4
filterByBoolMask_18 = List.FilterByBoolMask(list=all_elements_of_category_2, mask=code_block_37)
code_block_38 = CodeBlock { 0; }
setParameterByName_18 = Element.SetParameterByName(element=filterByBoolMask_18.in, parameterName=code_block_20.out7, value=code_block_38)
getParameterValueByName_19 = Element.GetParameterValueByName(element=all_elements_of_category_2, parameterName=code_block_20.out8)
code_block_39 = CodeBlock(phR5=getParameterValueByName_19) { phR5 == ""; }
filterByBoolMask_19 = List.FilterByBoolMask(list=all_elements_of_category_2, mask=code_block_39)
code_block_40 = CodeBlock { 0; }
setParameterByName_19 = Element.SetParameterByName(element=filterByBoolMask_19.in, parameterName=code_block_20.out8, value=code_block_40)
getParameterValueByName_20 = Element.GetParameterValueByName(element=all_elements_of_category_2, parameterName=code_block_20.out9)
code_block_41 = CodeBlock(phR6=getParameterValueByName_20) { phR6 == ""; }
filterByBoolMask_20 = List.FilterByBoolMask(list=all_elements_of_category_2, mask=code_block_41)
code_block_42 = CodeBlock { 0; }
setParameterByName_20 = Element.SetParameterByName(element=filterByBoolMask_20.in, parameterName=code_block_20.out9, value=code_block_42)
getParameterValueByName_21 = Element.GetParameterValueByName(element=all_elements_of_category_2, parameterName=code_block_20.out10)
code_block_43 = CodeBlock(phR7=getParameterValueByName_21) { phR7 == ""; }
filterByBoolMask_21 = List.FilterByBoolMask(list=all_elements_of_category_2, mask=code_block_43)
code_block_44 = CodeBlock { 0; }
setParameterByName_21 = Element.SetParameterByName(element=filterByBoolMask_21.in, parameterName=code_block_20.out10, value=code_block_44)
