# Dynamo graph script.dyn "#Visibilite Plugin Revit" (Dynamo 2.6.1.8786)
# packages: Rhythm 2022.1.1, Data-Shapes 2021.2.94

code_block = CodeBlock { true; }
ʳʰʸᵗʰᵐ_ribbontab_gettabs = Rhythm.Revit.Ribbon.RibbonTab.GetTabs(toggle=code_block)
ʳʰʸᵗʰᵐ_ribbontab_name = Rhythm.Revit.Ribbon.RibbonTab.Name(tab=ʳʰʸᵗʰᵐ_ribbontab_gettabs)
ʳʰʸᵗʰᵐ_ribbontab_visibility = Rhythm.Revit.Ribbon.RibbonTab.Visibility(tab=ʳʰʸᵗʰᵐ_ribbontab_gettabs)
python_script = Python(IN[0]=ʳʰʸᵗʰᵐ_ribbontab_gettabs, IN[1]=ʳʰʸᵗʰᵐ_ribbontab_name, IN[2]=ʳʰʸᵗʰᵐ_ribbontab_visibility)
# ---------- python_script.python (28 lines) ----------
# Charger les bibliothèques DesignScript et Standard Python
import sys
import clr
clr.AddReference('ProtoGeometry')
from Autodesk.DesignScript.Geometry import *

# Les entrées effectuées dans ce noeud sont stockées sous forme de liste dans les variables IN.
dataEnteringNode = IN
el = IN[0]
name = IN[1]
visibility = IN[2]
out = [[],[],[]]

# Placer votre code au-dessous de cette ligne
for i in range(len(name)) :
	if name[i] not in out[0] : 
		out[0].append(name[i])
		out[1].append(el[i])
	else :
		out[0].append(name[i]+" (*)")
		out[1].append(el[i])
		
for i in range(len(visibility)) :
	if visibility[i] == True :
		out[2].append(i)

# Affectez la sortie à la variable OUT.
OUT = out
# ----------------------------------------
code_block_2 = CodeBlock { "Afficher / Masquer"; }
code_block_3 = CodeBlock(l=python_script) { l[0]; 475; true; l[2]; false; }
listview_data = Custom[Listview Data](Keys=code_block_3.out0, Values=code_block_3.out0, Height_optionnal=code_block_3.out1, ShowElementCount_optionnal=code_block_3.out2, DefaultValueIndices_optionnal=code_block_3.out3, SortItems_optionnal=code_block_3.out4)  # package Data-Shapes; Create data for ListView input in UI.MultiInputForm ++ . Check out www.data-shapes.net for more infos.
code_block_4 = CodeBlock { "Par défaut"; 0; "(/!\\ Les extensions seront masquées)"; }
boolean_input = Custom[Boolean input](InputName=code_block_4.out0, DefaultValue=code_block_4.out1, SideText=code_block_4.out2)  # package Data-Shapes; Creates a boolean input for UI.MultipleInputForm ++ . Check out www.data-shapes.net for more infos!
code_block_5 = CodeBlock { "(*) => Laisser désactivé pour éviter des doublons"; }
textnote_data = Custom[TextNote Data](TextNote=code_block_5)  # package Data-Shapes; Create Data for TextNote input in UI.MultipleInputForm ++ . Check out www.data-shapes.net for more informations
list_create = List.Create(item0=listview_data, item1=boolean_input, item2=textnote_data)
code_block_6 = CodeBlock { true; }
multipleinputform = Custom[MultipleInputForm ++](ButtonText_optional=code_block_2, Inputs=list_create, Toggle=code_block_6)  # package Data-Shapes; Create a form with multiple inputs. see www.data-shapes.net for tutorials and infos!
python_script_2 = Python(IN[0]=python_script, IN[1]=multipleinputform.User_Inputs)
# ---------- python_script_2.python (36 lines) ----------
# Charger les bibliothèques DesignScript et Standard Python
import sys
import clr
clr.AddReference('ProtoGeometry')
from Autodesk.DesignScript.Geometry import *

# Les entrées effectuées dans ce noeud sont stockées sous forme de liste dans les variables IN.
dataEnteringNode = IN
tabName = IN[0][0]
el = IN[0][1]
form = IN[1]
defaultName = ["Architecture", "Structure", "Acier", "Préfabrication", "Systèmes", "Insérer", "Annoter", "Analyser", "Volume et site", "Collaborer", "Vue", "Gérer", "Compléments", "Modifier"]
defaultTab = []
out = [[],[]]

# Placer votre code au-dessous de cette ligne
if form[1] == True :
	for i in range(len(tabName)) :
		if tabName[i] in defaultName :
			out[0].append(el[i])
			out[1].append(True)
		else :
			out[0].append(el[i])
			out[1].append(False)
else : 
	for i in range(len(tabName)) :
		if tabName[i] in form[0] :
			out[0].append(el[i])
			out[1].append(True)
		else :
			out[0].append(el[i])
			out[1].append(False)
		

# Affectez la sortie à la variable OUT.
OUT = out
# ----------------------------------------
code_block_7 = CodeBlock(l=python_script_2) { l[0]; l[1]; }
ʳʰʸᵗʰᵐ_ribbontab_setvisibility = Rhythm.Revit.Ribbon.RibbonTab.SetVisibility(tab=code_block_7.out0, toggle=code_block_7.out1)
