# Dynamo graph script.dyn "DEV_E3 - Elements Non Std + Details a supprimer" (Dynamo 2.6.1.8786)
# packages: bimorphNodes 4.0.13

# group: Filtre nomenclatures - Elevation
element_types = ElementTypes("ViewSchedule")
all_elements_of_type = ElementsOfType(element_type=element_types)
code_block = CodeBlock(a=all_elements_of_type) { a.Name; "3G - Fenêtres - LU"; "3H - Portes - LU"; "3G - Fenêtres - LB"; "3H - Portes - LB"; }
code_block_2 = CodeBlock(name=code_block.out0, luFenetre=code_block.out1, luPorte=code_block.out2, lbFenetre=code_block.out3, lbPorte=code_block.out4)
# ---------- code_block_2.designscript (6 lines) ----------
name == luFenetre ||
name == luPorte;


name == lbFenetre ||
name == lbPorte;
# ----------------------------------------

# group: Fenêtres / Portes - LU Standard
filterByBoolMask = List.FilterByBoolMask(list=all_elements_of_type, mask=code_block_2.out0)
code_block_3 = CodeBlock { true; 0; }
getData = Revit.Schedule.GetData(scheduleView=filterByBoolMask.in, removeHeading=code_block_3.out0)
removeItemAtIndex = List.RemoveItemAtIndex(list=getData@L3, indices=code_block_3.out1)
python_script = Python(IN[0]=removeItemAtIndex)
# ---------- python_script.python (148 lines) ----------
# Charger les bibliothèques DesignScript et Standard Python
import sys
import clr
clr.AddReference('ProtoGeometry')
from Autodesk.DesignScript.Geometry import *
from math import *

# Les entrées effectuées dans ce noeud sont stockées sous forme de liste dans les variables IN.
dataEnteringNode = IN
data = IN[0]

# Définition de la taille du tableau à retourner
out = [[],[],[],[],[],[],[],[],[],[],[],[]]

# Fonction arrondi personalisée
def myround(x, base=0.05):
    return base * ceil(float(x)/base)
    
def result(x, repere, longueur, avecVR, sansVR, ajout):
	if out[x] == []:
		lg = longueur
	else:
		lg = out[x][1]+longueur

	if out[x] == []:
		avVR = avecVR
	else:
		avVR = out[x][2]+avecVR

	if out[x] == []:
		ssVR = sansVR
	else:
		ssVR = out[x][3]+sansVR
		
	if out[x] == []:
		aj = ajout
	else:
		aj = out[x][4]+ajout
		
	out[x] = [repere, lg, avVR, ssVR, aj]
    
# Boucle parcourant chaque ligne de la nomenclature
for i in range(len(data[0])):
	
	# Récupération de la valeur de chaque paramètre
	repere = data[0][i][0]
	longueur = myround(data[0][i][1])
	avecVR = int(data[0][i][2])
	sansVR = int(data[0][i][3])
	ajout = myround(data[0][i][4])
	
	if repere == "LU1":
		result(0, repere, longueur, avecVR, sansVR, ajout)

	if repere == "LURf1":
		result(1, repere, longueur, avecVR, sansVR, ajout)

	if repere == "LU1=CH":
		result(2, repere, longueur, avecVR, sansVR, ajout)

	if repere == "LURf1=CH":
		result(3, repere, longueur, avecVR, sansVR, ajout)

	if repere == "LU2":
		result(4, repere, longueur, avecVR, sansVR, ajout)

	if repere == "LURf2":
		result(5, repere, longueur, avecVR, sansVR, ajout)

	if repere == "LU2=CH":
		result(6, repere, longueur, avecVR, sansVR, ajout)

	if repere == "LURf2=CH":
		result(7, repere, longueur, avecVR, sansVR, ajout)
		
	if repere == "LU3":
		result(8, repere, longueur, avecVR, sansVR, ajout)

	if repere == "LURf3":
		result(9, repere, longueur, avecVR, sansVR, ajout)

	if repere == "LU3=CH":
		result(10, repere, longueur, avecVR, sansVR, ajout)

	if repere == "LURf3=CH":
		result(11, repere, longueur, avecVR, sansVR, ajout)

for i in range(len(data[1])):
	
	# Récupération de la valeur de chaque paramètre
	repere = data[1][i][0]
	longueur = myround(data[1][i][1])
	avecVR = int(data[1][i][2])
	sansVR = int(data[1][i][3])
	ajout = myround(data[1][i][4])

	if repere == "LU1":
		result(0, repere, longueur, avecVR, sansVR, ajout)

	if repere == "LURf1":
		result(1, repere, longueur, avecVR, sansVR, ajout)

	if repere == "LU1=CH":
		result(2, repere, longueur, avecVR, sansVR, ajout)

	if repere == "LURf1=CH":
		result(3, repere, longueur, avecVR, sansVR, ajout)

	if repere == "LU2":
		result(4, repere, longueur, avecVR, sansVR, ajout)

	if repere == "LURf2":
		result(5, repere, longueur, avecVR, sansVR, ajout)

	if repere == "LU2=CH":
		result(6, repere, longueur, avecVR, sansVR, ajout)

	if repere == "LURf2=CH":
		result(7, repere, longueur, avecVR, sansVR, ajout)
		
	if repere == "LU3":
		result(8, repere, longueur, avecVR, sansVR, ajout)

	if repere == "LURf3":
		result(9, repere, longueur, avecVR, sansVR, ajout)

	if repere == "LU3=CH":
		result(10, repere, longueur, avecVR, sansVR, ajout)

	if repere == "LURf3=CH":
		result(11, repere, longueur, avecVR, sansVR, ajout)
		
# valeur par défaut si vide
if out[0] == [] : out[0] = ["LU1", "", "", "", ""]
if out[1] == [] : out[1] = ["LURf1", "", "", "", ""] 
if out[2] == [] : out[2] = ["LU1=CH", "", "", "", ""]
if out[3] == [] : out[3] = ["LURf1=CH", "", "", "", ""] 
if out[4] == [] : out[4] = ["LU2", "", "", "", ""]
if out[5] == [] : out[5] = ["LURf2", "", "", "", ""] 
if out[6] == [] : out[6] = ["LU2=CH", "", "", "", ""]
if out[7] == [] : out[7] = ["LURf2=CH", "", "", "", ""] 
if out[8] == [] : out[8] = ["LU3", "", "", "", ""]
if out[9] == [] : out[9] = ["LURf3", "", "", "", ""] 
if out[10] == [] : out[10] = ["LU3=CH", "", "", "", ""]
if out[11] == [] : out[11] = ["LURf3=CH", "", "", "", ""] 

# Affectez la sortie à la variable OUT.
OUT = out
# ----------------------------------------

# group: Fenêtres / Portes - LB Standard
filterByBoolMask_2 = List.FilterByBoolMask(list=all_elements_of_type, mask=code_block_2.out1)
code_block_4 = CodeBlock { true; 0; }
getData_2 = Revit.Schedule.GetData(scheduleView=filterByBoolMask_2.in, removeHeading=code_block_4.out0)
removeItemAtIndex_2 = List.RemoveItemAtIndex(list=getData_2@L3, indices=code_block_4.out1)
python_script_2 = Python(IN[0]=removeItemAtIndex_2)
# ---------- python_script_2.python (143 lines) ----------
# Charger les bibliothèques DesignScript et Standard Python
import sys
import clr
clr.AddReference('ProtoGeometry')
from Autodesk.DesignScript.Geometry import *
from math import *

# Les entrées effectuées dans ce noeud sont stockées sous forme de liste dans les variables IN.
dataEnteringNode = IN
data = IN[0]

# Définition de la taille du tableau à retourner
out = [[],[],[],[],[],[],[],[],[],[],[],[]]

# Fonction arrondi personalisée
def myround(x, base=0.05):
    return base * ceil(float(x)/base)
    
def result(x, repere, longueur, avecVR, sansVR):
	if out[x] == []:
		lg = longueur
	else:
		lg = out[x][1]+longueur

	if out[x] == []:
		avVR = avecVR
	else:
		avVR = out[x][2]+avecVR

	if out[x] == []:
		ssVR = sansVR
	else:
		ssVR = out[x][3]+sansVR
		
	out[x] = [repere, lg, avVR, ssVR]
    
# Boucle parcourant chaque ligne de la nomenclature
for i in range(len(data[0])):
	
	# Récupération de la valeur de chaque paramètre
	repere = data[0][i][0]
	longueur = myround(data[0][i][1])
	avecVR = int(data[0][i][2])
	sansVR = int(data[0][i][3])
	ajout = myround(data[0][i][4])
	
	if repere == "LB1":
		result(0, repere, longueur, avecVR, sansVR)

	if repere == "LBRf1":
		result(1, repere, longueur, avecVR, sansVR)

	if repere == "LB1=CH":
		result(2, repere, longueur, avecVR, sansVR)

	if repere == "LBRf1=CH":
		result(3, repere, longueur, avecVR, sansVR)

	if repere == "LB2":
		result(4, repere, longueur, avecVR, sansVR)

	if repere == "LBRf2":
		result(5, repere, longueur, avecVR, sansVR)

	if repere == "LB2=CH":
		result(6, repere, longueur, avecVR, sansVR)

	if repere == "LBRf2=CH":
		result(7, repere, longueur, avecVR, sansVR)
		
	if repere == "LB3":
		result(8, repere, longueur, avecVR, sansVR)

	if repere == "LBRf3":
		result(9, repere, longueur, avecVR, sansVR)

	if repere == "LB3=CH":
		result(10, repere, longueur, avecVR, sansVR)

	if repere == "LBRf3=CH":
		result(11, repere, longueur, avecVR, sansVR)

for i in range(len(data[1])):
	
	# Récupération de la valeur de chaque paramètre
	repere = data[1][i][0]
	longueur = myround(data[1][i][1])
	avecVR = int(data[1][i][2])
	sansVR = int(data[1][i][3])
	ajout = myround(data[1][i][4])

	if repere == "LB1":
		result(0, repere, longueur, avecVR, sansVR)

	if repere == "LBRf1":
		result(1, repere, longueur, avecVR, sansVR)

	if repere == "LB1=CH":
		result(2, repere, longueur, avecVR, sansVR)

	if repere == "LBRf1=CH":
		result(3, repere, longueur, avecVR, sansVR)

	if repere == "LB2":
		result(4, repere, longueur, avecVR, sansVR)

	if repere == "LBRf2":
		result(5, repere, longueur, avecVR, sansVR)

	if repere == "LB2=CH":
		result(6, repere, longueur, avecVR, sansVR)

	if repere == "LBRf2=CH":
		result(7, repere, longueur, avecVR, sansVR)
		
	if repere == "LB3":
		result(8, repere, longueur, avecVR, sansVR)

	if repere == "LBRf3":
		result(9, repere, longueur, avecVR, sansVR)

	if repere == "LB3=CH":
		result(10, repere, longueur, avecVR, sansVR)

	if repere == "LBRf3=CH":
		result(11, repere, longueur, avecVR, sansVR)
		
# valeur par défaut si vide
if out[0] == [] : out[0] = ["LB1", "", "", ""]
if out[1] == [] : out[1] = ["LBRf1", "", "", ""] 
if out[2] == [] : out[2] = ["LB1=CH", "", "", ""]
if out[3] == [] : out[3] = ["LBRf1=CH", "", "", ""] 
if out[4] == [] : out[4] = ["LB2", "", "", ""]
if out[5] == [] : out[5] = ["LBRf2", "", "", ""] 
if out[6] == [] : out[6] = ["LB2=CH", "", "", ""]
if out[7] == [] : out[7] = ["LBRf2=CH", "", "", ""] 
if out[8] == [] : out[8] = ["LB3", "", "", ""]
if out[9] == [] : out[9] = ["LBRf3", "", "", ""] 
if out[10] == [] : out[10] = ["LB3=CH", "", "", ""]
if out[11] == [] : out[11] = ["LBRf3=CH", "", "", ""] 

# Affectez la sortie à la variable OUT.
OUT = out
# ----------------------------------------

# group: Filtre nomenclatures - Fondations
element_types_2 = ElementTypes("ViewSchedule")
all_elements_of_type_2 = ElementsOfType(element_type=element_types_2)
code_block_5 = CodeBlock(a=all_elements_of_type_2) { a.Name; "1A - Fondations - SF"; }
code_block_6 = CodeBlock(name=code_block_5.out0, SF=code_block_5.out1) { name == SF; }

# group: Fondations - SF
filterByBoolMask_3 = List.FilterByBoolMask(list=all_elements_of_type_2, mask=code_block_6)
code_block_7 = CodeBlock { true; 0; }
getData_3 = Revit.Schedule.GetData(scheduleView=filterByBoolMask_3.in, removeHeading=code_block_7.out0)
removeItemAtIndex_3 = List.RemoveItemAtIndex(list=getData_3@L3, indices=code_block_7.out1)
python_script_3 = Python(IN[0]=removeItemAtIndex_3)
# ---------- python_script_3.python (57 lines) ----------
# Charger les bibliothèques DesignScript et Standard Python
import sys
import clr
clr.AddReference('ProtoGeometry')
from Autodesk.DesignScript.Geometry import *
from math import *

# Les entrées effectuées dans ce noeud sont stockées sous forme de liste dans les variables IN.
dataEnteringNode = IN
data = IN[0]

# Définition de la taille du tableau à retourner
out = [[],[],[],[],[],[]]

# Fonction arrondi personalisée
def myround(x, base=0.05):
    return base * ceil(float(x)/base)

# Boucle parcourant chaque ligne de la nomenclature
for i in range(len(data[0])):
	
	# Récupération de la valeur de chaque paramètre
	largeur = data[0][i][0]
	hauteur = data[0][i][1]
	repere = data[0][i][2]
	longueur = myround(data[0][i][4])
	recouvrement = data[0][i][6]
	
	if repere == "SF1":
		out[0] = [largeur, hauteur, repere, longueur, recouvrement]
		
	if repere == "SF2":
		out[1] = [largeur, hauteur, repere, longueur, recouvrement]
		
	if repere == "SF3":
		out[2] = [largeur, hauteur, repere, longueur, recouvrement]	
	
	if repere == "SF4":
		out[3] = [largeur, hauteur, repere, longueur, recouvrement]
		
	if repere == "SF5":
		out[4] = [largeur, hauteur, repere, longueur, recouvrement]
		
	if repere == "SF6":
		out[5] = [largeur, hauteur, repere, longueur, recouvrement]
		
		
# valeur par défaut si vide
if out[0] == [] : out[0] = [0.50, 0.25, "SF1", "", ""]
if out[1] == [] : out[1] = [0.50, 0.25, "SF2", "", ""]
if out[2] == [] : out[2] = [0.60, 0.25, "SF3", "", ""]
if out[3] == [] : out[3] = [0.50, 0.50, "SF4", "", ""]
if out[4] == [] : out[4] = [0.60, 0.50, "SF5", "", ""]
if out[5] == [] : out[5] = [0.70, 0.50, "SF6", "", ""]

# Affectez la sortie à la variable OUT.
OUT = out
# ----------------------------------------

python_script_4 = Python(IN[0]=python_script, IN[1]=python_script_2, IN[2]=python_script_3)
# ---------- python_script_4.python (48 lines) ----------
# Charger les bibliothèques DesignScript et Standard Python
import sys
import clr
clr.AddReference('ProtoGeometry')
from Autodesk.DesignScript.Geometry import *

# Les entrées effectuées dans ce noeud sont stockées sous forme de liste dans les variables IN.
dataEnteringNode = IN
lu = IN[0]
lb = IN[1]
sf = IN[2]

exclude = ["SF4", "SF5", "SF6", "LU1=CH", "LURf1=CH","LU2=CH", "LURf2=CH", "LU3", "LURf3", "LU3=CH", "LURf3=CH", "LB1=CH", "LBRf1=CH","LB2=CH", "LBRf2=CH", "LB3=CH", "LBRf3=CH",]

rep = [[],[],[]]

# Placer votre code au-dessous de cette ligne
for i in range(len(sf)):
	if sf[i][3] == "" and sf[i][2] not in exclude :
		rep[0].append(sf[i][2])

for i in range(len(lu)):
	if lu[i][1] == "" and lu[i][0] not in exclude :
		rep[1].append(lu[i][0])

for i in range(len(lb)):
	if lb[i][1] == "" and lb[i][0] not in exclude :
		rep[2].append(lb[i][0])

sfTxt = "> Semelle filante"
luTxt = "> Linteau U"
lbTxt = "> Linteau Béton"

for i in range(len(rep)):
	for k in range(len(rep[i])):
		if i == 0 :
			sfTxt = sfTxt+"\n• "+rep[i][k]
			
		if i == 1 :
			luTxt = luTxt+"\n• "+rep[i][k]
			
		if i == 2 :
			lbTxt = lbTxt+"\n• "+rep[i][k]
		
out = sfTxt+"\n\n"+luTxt+"\n\n"+lbTxt

# Affectez la sortie à la variable OUT.
OUT = out
# ----------------------------------------
python_script_5 = Python(IN[0]=python_script_4)
# ---------- python_script_5.python (26 lines) ----------
import clr
clr.AddReference("RevitAPIUI")
from Autodesk.Revit.UI import *
import webbrowser

# Les entrées effectuées dans ce noeud sont stockées sous forme de liste dans les variables IN.
dataEnteringNode = IN

msg = IN[0]

out = ""

dialog = TaskDialog("Paramétrage")
dialog.MainInstruction = "Détails à supprimer"
dialog.MainContent = msg

dialog.CommonButtons = TaskDialogCommonButtons.Close;
dialog.DefaultButton = TaskDialogResult.Close;

#dialog.FooterText = "<a href=\"http://usa.autodesk.com/adsk/servlet/index?siteID=123112&id=2484975 \"> Click here for the Revit API Developer Center</a>"


result = "" if msg == "> Semelle filante\n\n> ELEV Non Standard\n\n> Linteau Béton" else dialog.Show()

#Assign your output to the OUT variable.
OUT = out
# ----------------------------------------
