# Dynamo graph script.dyn "DEV_E4 - Elements Non Std" (Dynamo 2.6.1.8786)
# packages: bimorphNodes 4.0.13

code_block = CodeBlock { "\n"; "> FD Non Standard"; "> ELEV Non Standard"; "> FENETRES / PORTES Non Standard"; }

# group: Filtre nomenclatures - Fondations
element_types = ElementTypes("ViewSchedule")
all_elements_of_type = ElementsOfType(element_type=element_types)
code_block_2 = CodeBlock(a=all_elements_of_type)
# ---------- code_block_2.designscript (14 lines) ----------
a.Name;
"1E - Attentes Fondations Poteaux";


"1E - Longrines";


"2C - Poteaux Tous Niveaux";


"2G - Poutres Tous Niveaux";


"3H - Portes - LB Non Standard";
# ----------------------------------------
code_block_3 = CodeBlock(name=code_block_2.out0, attFdPt=code_block_2.out1, longrine=code_block_2.out2, ptTousNiv=code_block_2.out3, poutre=code_block_2.out4, lbNonStd=code_block_2.out5) { name == attFdPt; name == longrine; name == ptTousNiv; name == poutre; name == lbNonStd; }

# group: Fondations - Attentes Poteaux
filterByBoolMask = List.FilterByBoolMask(list=all_elements_of_type, mask=code_block_3.out0)
code_block_4 = CodeBlock { true; 0; }
getData = Revit.Schedule.GetData(scheduleView=filterByBoolMask.in, removeHeading=code_block_4.out0)
removeItemAtIndex = List.RemoveItemAtIndex(list=getData@L3, indices=code_block_4.out1)
code_block_5 = CodeBlock(l=removeItemAtIndex) { l[0]; }
isEmpty = List.IsEmpty(list=code_block_5)

code_block_6 = CodeBlock(isEmpty=isEmpty) { isEmpty ? "• -" : "• Fondations - Attentes Poteaux"; }

# group: Fondations - Longrines
filterByBoolMask_2 = List.FilterByBoolMask(list=all_elements_of_type, mask=code_block_3.out1)
code_block_7 = CodeBlock { true; 0; }
getData_2 = Revit.Schedule.GetData(scheduleView=filterByBoolMask_2.in, removeHeading=code_block_7.out0)
removeItemAtIndex_2 = List.RemoveItemAtIndex(list=getData_2@L3, indices=code_block_7.out1)
code_block_8 = CodeBlock(l=removeItemAtIndex_2) { l[0]; }
isEmpty_2 = List.IsEmpty(list=code_block_8)

code_block_9 = CodeBlock(isEmpty=isEmpty_2) { isEmpty ? "• -\n" : "• Fondations - Longrines\n"; }

# group: Elevation - Poteaux Tous Niveaux
filterByBoolMask_3 = List.FilterByBoolMask(list=all_elements_of_type, mask=code_block_3.out2)
code_block_10 = CodeBlock { true; 0; }
getData_3 = Revit.Schedule.GetData(scheduleView=filterByBoolMask_3.in, removeHeading=code_block_10.out0)
removeItemAtIndex_3 = List.RemoveItemAtIndex(list=getData_3@L3, indices=code_block_10.out1)
code_block_11 = CodeBlock(l=removeItemAtIndex_3) { l[0]; }
isEmpty_3 = List.IsEmpty(list=code_block_11)

code_block_12 = CodeBlock(isEmpty=isEmpty_3) { isEmpty ? "• -" : "• Elevation - Poteaux Tous Niveaux"; }

# group: Elevation - Poutres Tous Niveaux
filterByBoolMask_4 = List.FilterByBoolMask(list=all_elements_of_type, mask=code_block_3.out3)
code_block_13 = CodeBlock { true; 0; }
getData_4 = Revit.Schedule.GetData(scheduleView=filterByBoolMask_4.in, removeHeading=code_block_13.out0)
removeItemAtIndex_4 = List.RemoveItemAtIndex(list=getData_4@L3, indices=code_block_13.out1)
code_block_14 = CodeBlock(l=removeItemAtIndex_4) { l[0]; }
isEmpty_4 = List.IsEmpty(list=code_block_14)

code_block_15 = CodeBlock(isEmpty=isEmpty_4) { isEmpty ? "• -\n" : "• Elevation - Poutres Tous Niveaux\n"; }

# group: Fenêtres / Portes - LB Non Standard
filterByBoolMask_5 = List.FilterByBoolMask(list=all_elements_of_type, mask=code_block_3.out4)
code_block_16 = CodeBlock { true; 0; }
getData_5 = Revit.Schedule.GetData(scheduleView=filterByBoolMask_5.in, removeHeading=code_block_16.out0)
removeItemAtIndex_5 = List.RemoveItemAtIndex(list=getData_5@L3, indices=code_block_16.out1)
code_block_17 = CodeBlock(l=removeItemAtIndex_5) { l[0]; }
isEmpty_5 = List.IsEmpty(list=code_block_17)

code_block_18 = CodeBlock(isEmpty=isEmpty_5) { isEmpty ? "• -" : "• Fenêtres / Portes  - LB Non Standard"; }
join = String.Join(separator=code_block.out0, string0=code_block.out1, string1=code_block_6, string2=code_block_9, string3=code_block.out2, string4=code_block_12, string5=code_block_15, string6=code_block.out3, string7=code_block_18)
python_script = Python(IN[0]=join)
# ---------- python_script.python (27 lines) ----------
import clr
clr.AddReference("RevitAPIUI")
from Autodesk.Revit.UI import *
import webbrowser

# Les entrées effectuées dans ce noeud sont stockées sous forme de liste dans les variables IN.
dataEnteringNode = IN

nonStd = IN[0]

msg = "" if nonStd == "> FD Non Standard\n• -\n• -\n\n> ELEV Non Standard\n• -\n• -\n\n> FENETRES / PORTES Non Standard\n• -" else nonStd
title = "Aucun éléments Non Standard" if nonStd == "> FD Non Standard\n• -\n• -\n\n> ELEV Non Standard\n• -\n• -\n\n> FENETRES / PORTES Non Standard\n• -" else "Eléments non standard"

dialog = TaskDialog("Paramétrage")
dialog.MainInstruction = title
dialog.MainContent = msg

dialog.CommonButtons = TaskDialogCommonButtons.Close;
dialog.DefaultButton = TaskDialogResult.Close;

#dialog.FooterText = "<a href=\"http://usa.autodesk.com/adsk/servlet/index?siteID=123112&id=2484975 \"> Click here for the Revit API Developer Center</a>"


result = "" if msg == "> FD Non Standard\n• -\n• -\n\n> ELEV Non Standard\n• -\n• -\n\n> FENETRES / PORTES Non Standard\n• -" else dialog.Show()

#Assign your output to the OUT variable.
OUT = title
# ----------------------------------------
