# Dynamo graph script.dyn "DEV_B3 - Attentes A1 - A3_R - RA" (Dynamo 2.6.1.8786)

# group: Attente poteaux rect° + circ°
code_block = CodeBlock { Category.ByName("Poteaux porteurs"); "2 - Niveau Batiment"; }  # frozen
all_elements_of_category = ElementsOfCategory(Category=code_block.out0)
getParameterValueByName = Element.GetParameterValueByName(element=all_elements_of_category, parameterName=code_block.out1)
code_block_2 = CodeBlock(niv=getParameterValueByName) { niv=="FD"; }
filterByBoolMask = List.FilterByBoolMask(list=all_elements_of_category, mask=code_block_2)
code_block_3 = CodeBlock { "Type"; }
getParameterValueByName_2 = Element.GetParameterValueByName(element=filterByBoolMask.in, parameterName=code_block_3)
code_block_4 = CodeBlock(e=getParameterValueByName_2) { e.Name; }
code_block_5 = CodeBlock(type=code_block_4)
# ---------- code_block_5.designscript (12 lines) ----------
type != "A1" && type != "A1A" &&
type != "A3" && type != "A3A" &&
type != "A4" && type != "A4A" &&
type != "B1" && type != "B1A" &&
type != "B3" && type != "B3A" &&

type != "A2" && type != "A5" &&
type != "R" && type != "R1A" &&
type != "R1" &&

type != "RA" && type != "R4A" &&
type != "R1A";
# ----------------------------------------
filterByBoolMask_2 = List.FilterByBoolMask(list=filterByBoolMask.in, mask=code_block_5)
code_block_6 = CodeBlock { "Niveau supérieur"; "Niveau de base"; }
getParameterValueByName_3 = Element.GetParameterValueByName(element=filterByBoolMask_2.in, parameterName=code_block_6.out0)
elevation = Level.Elevation(level=getParameterValueByName_3)
getParameterValueByName_4 = Element.GetParameterValueByName(element=filterByBoolMask_2.in, parameterName=code_block_6.out1)
elevation_2 = Level.Elevation(level=getParameterValueByName_4)
code_block_7 = CodeBlock(up=elevation, down=elevation_2) { up-down; }
round = Math.Round(number=code_block_7)
code_block_8 = CodeBlock(ht=round) { ht<200; }
filterByBoolMask_3 = List.FilterByBoolMask(list=filterByBoolMask_2.in, mask=code_block_8)
code_block_9 = CodeBlock { "5 - Attente"; "b"; "c"; }
setParameterByName = Element.SetParameterByName(element=filterByBoolMask_3.in, parameterName=code_block_9.out0, value=code_block_9.out1)
setParameterByName_2 = Element.SetParameterByName(element=filterByBoolMask_3.out, parameterName=code_block_9.out0, value=code_block_9.out2)

# group: Zone Sismique
code_block_10 = CodeBlock { Category.ByName("Informations sur le projet"); "Sismique"; }
all_elements_of_category_2 = ElementsOfCategory(Category=code_block_10.out0)
getParameterValueByName_5 = Element.GetParameterValueByName(element=all_elements_of_category_2, parameterName=code_block_10.out1)
code_block_11 = CodeBlock(zone=getParameterValueByName_5) { zone == 1 || zone == 2; }

python_script = Python(IN[0]=code_block_11)  # frozen
# ---------- python_script.python (26 lines) ----------
import clr
clr.AddReference("RevitAPIUI")
from Autodesk.Revit.UI import *
import webbrowser

# Les entrées effectuées dans ce noeud sont stockées sous forme de liste dans les variables IN.
dataEnteringNode = IN

zone = IN[0][0]

msg = ""

dialog = TaskDialog("Attentes \"a1\" / \"a3\" / R / RA")
dialog.MainInstruction = "Le projet en Zone sismique 3 ou 4"
dialog.MainContent = msg

dialog.CommonButtons = TaskDialogCommonButtons.Close;
dialog.DefaultButton = TaskDialogResult.Close;

#dialog.FooterText = "<a href=\"http://usa.autodesk.com/adsk/servlet/index?siteID=123112&id=2484975 \"> Click here for the Revit API Developer Center</a>"


result = dialog.Show() if zone == False else ""

#Assign your output to the OUT variable.
OUT = msg
# ----------------------------------------

# group: Conversion "a1" / "a3" / R / RA
code_block_12 = CodeBlock()
# ---------- code_block_12.designscript (8 lines) ----------
Category.ByName("Poteaux porteurs");
["2 - Niveau Batiment",
"4HA10 (Zone 1/2)",
"BAB-20",
"BAB-25",
"BAB-30",
"Niveau supérieur",
"Niveau de base"];
# ----------------------------------------
all_elements_of_category_3 = ElementsOfCategory(Category=code_block_12.out0)
getParameterValueByName_6 = Element.GetParameterValueByName(element=all_elements_of_category_3, parameterName=code_block_12.out1, lacing=CrossProduct)
code_block_13 = CodeBlock()
# ---------- code_block_13.designscript (4 lines) ----------
["123STR_Attente_A1_A3",
"123STR_z_NPS_Attente_specifique",
"123STR_Raidisseur",
"123STR_z_NPS_Raidisseurs_specifique"];
# ----------------------------------------
byName = Family.ByName(name=code_block_13)
types = Family.Types(family=byName)
flatten = List.Flatten(list=types)
python_script_2 = Python(IN[0]=all_elements_of_category_3, IN[1]=getParameterValueByName_6, IN[2]=flatten, IN[3]=code_block_11)
# ---------- python_script_2.python (86 lines) ----------
# Charger les bibliothèques DesignScript et Standard Python
import sys
import clr
clr.AddReference('ProtoGeometry')
from Autodesk.DesignScript.Geometry import *

# Les entrées effectuées dans ce noeud sont stockées sous forme de liste dans les variables IN.
dataEnteringNode = IN
el = IN[0]
params = IN[1]
type = IN[2]
zone = IN[3][0]

out = [[],[]],[[],[]],[]
typeName = []
attenteA1 = ["A1", "A1A", "B1", "B1A", "A4", "A4A", "B4", "B4A"]
attenteA3 = ["A3", "A3A", "B3", "B3A"]
raidisseurR = ["R", "R1", "R4"]
raidisseurRA = ["RA", "R1A", "R4A"]

# Placer votre code au-dessous de cette ligne
for i in range(len(type)):
	typeName.append(type[i].Name)

for i in range(len(el)):

	name = el[i].Name
	
	_grandeHt = round(params[i][5].Elevation)-(params[i][6].Elevation) > 125
	_4ha10 = zone and params[i][1] == 1
	_bab = (params[i][2] == 1 or params[i][3] == 1 or params[i][4] == 1)
	
	if (name in attenteA1 or name in attenteA3) and (params[i][0] == "FD" or params[i][0] == "FD SS") :

		out[0][0].append(el[i])

		if name in attenteA1 and _bab and _4ha10 and _grandeHt:
			out[0][1].append(type[typeName.index("B4A")])
		elif name in attenteA1 and _bab and _4ha10:
			out[0][1].append(type[typeName.index("B4")])
		elif name in attenteA1 and _bab and _grandeHt:
			out[0][1].append(type[typeName.index("B1A")])
		elif name in attenteA1 and _bab:
			out[0][1].append(type[typeName.index("B1")])
		elif name in attenteA1 and _4ha10 and _grandeHt:
			out[0][1].append(type[typeName.index("A4A")])
		elif name in attenteA1 and _4ha10:
			out[0][1].append(type[typeName.index("A4")])
		elif name in attenteA1 and _grandeHt:
			out[0][1].append(type[typeName.index("A1A")])
		elif name in attenteA1:
			out[0][1].append(type[typeName.index("A1")])
		elif name in attenteA3 and _bab and _grandeHt:
			out[0][1].append(type[typeName.index("B3A")])
		elif name in attenteA3 and _bab:
			out[0][1].append(type[typeName.index("B3")])
		elif name in attenteA3 and _grandeHt:
			out[0][1].append(type[typeName.index("A3A")])
		elif name in attenteA3:
			out[0][1].append(type[typeName.index("A3")])
		else :
			out[0][1].append(type[typeName.index(_name)])

	elif (name in raidisseurR or name in raidisseurRA) :
		out[1][0].append(el[i])
		
		if name in raidisseurR and _4ha10:
			out[1][1].append(type[typeName.index("R4")])
		elif name in raidisseurR and _bab:
			out[1][1].append(type[typeName.index("R1")])
		elif name in raidisseurR:
			out[1][1].append(type[typeName.index("R")])
		elif name in raidisseurRA and _4ha10:
			out[1][1].append(type[typeName.index("R4A")])
		elif name in raidisseurRA and _bab:
			out[1][1].append(type[typeName.index("R1A")])
		elif name in raidisseurRA:
			out[1][1].append(type[typeName.index("RA")])
		else :
			out[1][1].append(type[typeName.index(_name)])
		
	else :
		out[2].append(el[i])

# Affectez la sortie à la variable OUT.
OUT = out
# ----------------------------------------
code_block_14 = CodeBlock(l=python_script_2)
# ---------- code_block_14.designscript (6 lines) ----------
// Attentes A1 / A3
l[0][0];
l[0][1];
// Raidisseurs R / RA
l[1][0];
l[1][1];
# ----------------------------------------
code_block_15 = CodeBlock { "Type"; }
setParameterByName_3 = Element.SetParameterByName(element=code_block_14.out0, parameterName=code_block_15, value=code_block_14.out1, lacing=Longest)
setParameterByName_4 = Element.SetParameterByName(element=code_block_14.out2, parameterName=code_block_15, value=code_block_14.out3, lacing=Longest)
