# Dynamo graph script.dyn "DEV_A2 - Ouvertures - LU - LB - Numerotation" (Dynamo 2.6.1.8786)
# packages: archi-lab.net 2022.212.3121, Clockwork for Dynamo 2.x 2.3.0

code_block = CodeBlock { [Category.ByName("Fenêtres"),Category.ByName("Portes")]; }
all_elements_of_category = ElementsOfCategory(Category=code_block)
flatten = List.Flatten(list=all_elements_of_category)
python_script = Python(IN[0]=flatten)
# ---------- python_script.python (32 lines) ----------
import clr
clr.AddReference('RevitAPI')
from Autodesk.Revit.DB import*
clr.AddReference('RevitServices')
from RevitServices.Persistence import DocumentManager
doc = DocumentManager.Instance.CurrentDBDocument

fams = list(FilteredElementCollector(doc).OfClass(Family))
inplace = [f for f in fams if f.IsInPlace]
inPlaceCategory = [f.FamilyCategory.Name for f in inplace]
inPlaceId = [f.Id for f in inplace]
inPlaceName = [f.Name for f in inplace]


import sys
import clr
clr.AddReference('ProtoGeometry')
from Autodesk.DesignScript.Geometry import *
# Les entrées effectuées dans ce noeud sont stockées sous forme de liste dans les variables IN.
dataEnteringNode = IN
element = IN[0]

out = []

# Placer votre code au-dessous de cette ligne
for i in range(len(element)):
	if element[i].Name not in inPlaceName :
		out.append(element[i])

# Affectez la sortie à la variable OUT.
OUT = out
#OUT = category, inplace , id
# ----------------------------------------

# group: AI Linteau - Fenêtres / Portes
code_block_2 = CodeBlock(e=python_script) { e.Name; "Ø"; }
contains = String.Contains(str=code_block_2.out0, searchFor=code_block_2.out1)
filterByBoolMask = List.FilterByBoolMask(list=python_script, mask=contains)
code_block_3 = CodeBlock { "Dyn AS Linteau REL"; "Dyn AI Linteau REL"; }
code_block_4 = CodeBlock { "Niveau"; "Hauteur sous linteau"; }
getParameterValueByName = Element.GetParameterValueByName(element=python_script, parameterName=code_block_4.out0)
elevation = Level.Elevation(level=getParameterValueByName)
round = Math.Round(number=elevation)
filterByBoolMask_2 = List.FilterByBoolMask(list=round, mask=contains)
getParameterValueByName_2 = Element.GetParameterValueByName(element=python_script, parameterName=code_block_4.out1)
filterByBoolMask_3 = List.FilterByBoolMask(list=getParameterValueByName_2, mask=contains)
code_block_5 = CodeBlock(AltNiveau=filterByBoolMask_2.out, HtSousLinteau=filterByBoolMask_3.out) { AltNiveau+HtSousLinteau; }
setParameterByName = Element.SetParameterByName(element=filterByBoolMask.out, parameterName=code_block_3.out1, value=code_block_5)
code_block_6 = CodeBlock { "Hauteur de l'appui"; }
getParameterValueByName_3 = Element.GetParameterValueByName(element=filterByBoolMask.in, parameterName=code_block_6)
type = archilab.Revit.Elements.Elements.Type(element=filterByBoolMask.in)
code_block_7 = CodeBlock { "Diametre brut"; }
getParameterValueByName_4 = Element.GetParameterValueByName(element=type, parameterName=code_block_7)
code_block_8 = CodeBlock(HtAppui=getParameterValueByName_3, DiametreBrut=getParameterValueByName_4, niveau=filterByBoolMask_2.in) { HtAppui + DiametreBrut + niveau; HtAppui + niveau; }
setParameterByName_2 = Element.SetParameterByName(element=filterByBoolMask.in, parameterName=code_block_3.out1, value=code_block_8.out1)
setParameterByName_3 = Element.SetParameterByName(element=filterByBoolMask.in, parameterName=code_block_3.out0, value=code_block_8.out0)

# group: Projet IGC, COVAL ou SATOV ?
code_block_9 = CodeBlock { Category.ByName("Cartouches"); "Nom de la feuille"; }
all_elements_of_category_2 = ElementsOfCategory(Category=code_block_9.out0)
getParameterValueByName_5 = Element.GetParameterValueByName(element=all_elements_of_category_2, parameterName=code_block_9.out1)
code_block_10 = CodeBlock(name=getParameterValueByName_5) { name=="PARAMETRAGE"; }
filterByBoolMask_4 = List.FilterByBoolMask(list=all_elements_of_category_2, mask=code_block_10)
code_block_11 = CodeBlock { "IGC"; }
getParameterValueByName_6 = Element.GetParameterValueByName(element=filterByBoolMask_4.in, parameterName=code_block_11)
code_block_12 = CodeBlock { "COVAL"; "SATOV"; }
getParameterValueByName_7 = Element.GetParameterValueByName(element=filterByBoolMask_4.in, parameterName=code_block_12.out0)
getParameterValueByName_8 = Element.GetParameterValueByName(element=filterByBoolMask_4.in, parameterName=code_block_12.out1)

# group: LT IGC
code_block_13 = CodeBlock { [Category.ByName("Fenêtres"),Category.ByName("Portes")]; "Dyn IGC"; }
all_elements_of_category_3 = ElementsOfCategory(Category=code_block_13.out0)
flatten_2 = List.Flatten(list=all_elements_of_category_3)
python_script_2 = Python(IN[0]=flatten_2)  # same code as python_script
setParameterByName_4 = Element.SetParameterByName(element=python_script_2, parameterName=code_block_13.out1, value=getParameterValueByName_6, lacing=Longest)

# group: Epaisseur mur hôte
getHost = FamilyInstance.GetHost(familyInstance=python_script)
python_script_3 = Python(IN[0]=getHost)
# ---------- python_script_3.python (17 lines) ----------
import clr

#Import the Revit API
clr.AddReference('RevitAPI')
import Autodesk
from Autodesk.Revit.DB import *

#Start scripting here:

walls = UnwrapElement(IN[0])

output = []

for i in walls:
	output.append(UnitUtils.ConvertFromInternalUnits(i.Width, DisplayUnitType.DUT_CENTIMETERS))

OUT = output
# ----------------------------------------

# group: Tri L=CH, L!=CH et Fenêtre ronde
code_block_14 = CodeBlock { "L = CH ?"; }
getParameterValueByName_9 = Element.GetParameterValueByName(element=python_script, parameterName=code_block_14)
python_script_4 = Python(IN[0]=python_script, IN[1]=getParameterValueByName_9, IN[2]=python_script_3, IN[3]=getHost)
# ---------- python_script_4.python (30 lines) ----------
# Charger les bibliothèques DesignScript et Standard Python
import sys
import clr
clr.AddReference('ProtoGeometry')
from Autodesk.DesignScript.Geometry import *

# Les entrées effectuées dans ce noeud sont stockées sous forme de liste dans les variables IN.
dataEnteringNode = IN
ouverture = UnwrapElement(IN[0])
ch = IN[1]
ep = IN[2]
host = IN[3]

out = [[[],[]],[[],[],[]],[[],[]]]

# Placer votre code au-dessous de cette ligne
for i in range(len(ouverture)):
	if ch[i] == 0 :
		out[0][0].append(ep[i])
		out[0][1].append(ouverture[i])
	elif ch[i] == 1 :
		out[1][0].append(host[i])
		out[1][1].append(ep[i])
		out[1][2].append(ouverture[i])
	else :
		out[2][0].append(ep[i])
		out[2][1].append(ouverture[i])
	
# Affectez la sortie à la variable OUT.
OUT = out
# ----------------------------------------

# group: Fenêtres rondes
code_block_15 = CodeBlock(l=python_script_4)
# ---------- code_block_15.designscript (6 lines) ----------
// Fenetre ronde
l[2][0];
l[2][1];
"Commentaires";
"EN";
"Epaisseur mur hôte";
# ----------------------------------------
setParameterByName_5 = Element.SetParameterByName(element=code_block_15.out1, parameterName=code_block_15.out2, value=code_block_15.out3)
setParameterByName_6 = Element.SetParameterByName(element=code_block_15.out1, parameterName=code_block_15.out4, value=code_block_15.out0)

# group: Dyn Section Linteau - L = CH + Actualisation des données
code_block_16 = CodeBlock(l=python_script_4)
# ---------- code_block_16.designscript (10 lines) ----------
// L = CH
["11 - CHU 20x20ht",
"12 - CHU 20x25ht",
"13 - CHU 20x30ht",
"14 - CH Dimensions Personnalisées (b x h)",
"15 - CH Dimensions Personnalisées (b)",
"16 - CH Dimensions Personnalisées (h)"];
l[1][0];
l[1][1];
l[1][2];
# ----------------------------------------
code_block_17 = CodeBlock()
# ---------- code_block_17.designscript (6 lines) ----------
["L 20x20ht",
"L 20x25ht",
"L 20x30ht",
"L Dimensions Personnalisées (b x h)",
"L Dimensions Personnalisées (b)",
"L Dimensions Personnalisées (h)"];
# ----------------------------------------
getParameterValueByName_10 = Element.GetParameterValueByName(element=code_block_16.out1, parameterName=code_block_16.out0, lacing=CrossProduct)
setParameterByName_7 = Element.SetParameterByName(element=code_block_16.out3@L1, parameterName=code_block_17, value=getParameterValueByName_10@L2)
code_block_18 = CodeBlock { "Dyn Section Linteau"; }
python_script_5 = Python(IN[0]=getParameterValueByName_10, IN[1]=code_block_16.out2)
# ---------- python_script_5.python (21 lines) ----------
# Charger les bibliothèques DesignScript et Standard Python
import sys
import clr
clr.AddReference('ProtoGeometry')
from Autodesk.DesignScript.Geometry import *

# Les entrées effectuées dans ce noeud sont stockées sous forme de liste dans les variables IN.
dataEnteringNode = IN
params = IN[0]
ep = IN[1]
out = []

# Placer votre code au-dessous de cette ligne
for i in range(len(params)):
	if params[i][0] == 1 : out.append(str(ep[i]).replace(".0","")+"x20ht")
	if params[i][1] == 1 : out.append(str(ep[i]).replace(".0","")+"x25ht")
	if params[i][2] == 1 : out.append(str(ep[i]).replace(".0","")+"x30ht")
	if params[i][3] == 1 : out.append(str(params[i][4]).replace(".0","")+"x"+str(params[i][5]).replace(".0","")+"ht")

# Affectez la sortie à la variable OUT.
OUT = out
# ----------------------------------------
setParameterByName_8 = Element.SetParameterByName(element=code_block_16.out3, parameterName=code_block_18, value=python_script_5)

# group: Dyn Section Linteau - L != CH + Actualisation des données
code_block_19 = CodeBlock(l=python_script_4)
# ---------- code_block_19.designscript (9 lines) ----------
// L != CH
["L 20x20ht",
"L 20x25ht",
"L 20x30ht",
"L Dimensions Personnalisées (b x h)",
"L Dimensions Personnalisées (b)",
"L Dimensions Personnalisées (h)"];
l[0][1];
l[0][0];
# ----------------------------------------
code_block_20 = CodeBlock { "L Dimensions Personnalisées (b)"; }
setParameterByName_9 = Element.SetParameterByName(element=code_block_19.out1, parameterName=code_block_20, value=code_block_19.out2)
code_block_21 = CodeBlock { "Dyn Section Linteau"; }
getParameterValueByName_11 = Element.GetParameterValueByName(element=code_block_19.out1, parameterName=code_block_19.out0, lacing=CrossProduct)
python_script_6 = Python(IN[0]=getParameterValueByName_11, IN[1]=code_block_19.out2)  # same code as python_script_5
setParameterByName_10 = Element.SetParameterByName(element=code_block_19.out1, parameterName=code_block_21, value=python_script_6)

# group: Récupération Données L != CH
code_block_22 = CodeBlock()
# ---------- code_block_22.designscript (11 lines) ----------
["LB Standard",
"LB Non Standard",
"L 20x20ht",
"L 20x25ht",
"L 20x30ht",
"L Dimensions Personnalisées (b x h)",
"L Dimensions Personnalisées (b)",
"L Dimensions Personnalisées (h)",
"Rf",
"L = CH ?",
"VR"];
# ----------------------------------------
getParameterValueByName_12 = Element.GetParameterValueByName(element=setParameterByName_10, parameterName=code_block_22, lacing=CrossProduct)

# group: Insertion des nouvelles données L = CH
code_block_23 = CodeBlock()
# ---------- code_block_23.designscript (5 lines) ----------
["LB Standard",
"LB Non Standard",
"Rf",
"L = CH ?",
"VR"];
# ----------------------------------------
getParameterValueByName_13 = Element.GetParameterValueByName(element=setParameterByName_8, parameterName=code_block_23, lacing=CrossProduct)
python_script_7 = Python(IN[0]=getParameterValueByName_10, IN[1]=getParameterValueByName_13)
# ---------- python_script_7.python (18 lines) ----------
# Charger les bibliothèques DesignScript et Standard Python
import sys
import clr
clr.AddReference('ProtoGeometry')
from Autodesk.DesignScript.Geometry import *

# Les entrées effectuées dans ce noeud sont stockées sous forme de liste dans les variables IN.
dataEnteringNode = IN
newParams = IN[0]
currentParams = IN[1]

# Placer votre code au-dessous de cette ligne
for i in range(len(currentParams)):
	for j in range(len(newParams[i])):
		currentParams[i].insert(j+2,newParams[i][j])

# Affectez la sortie à la variable OUT.
OUT = currentParams
# ----------------------------------------

# group: Zone Sismique
code_block_24 = CodeBlock { Category.ByName("Informations sur le projet"); "Sismique"; }
all_elements_of_category_4 = ElementsOfCategory(Category=code_block_24.out0)
getParameterValueByName_14 = Element.GetParameterValueByName(element=all_elements_of_category_4, parameterName=code_block_24.out1)
code_block_25 = CodeBlock(zone=getParameterValueByName_14)
# ---------- code_block_25.designscript (7 lines) ----------
zone == 1 || zone == 2 ?
	"Zone 1/2":
	zone == 3 ?
		"Zone 3" :
		zone == 4 ?
			"Zone 4":
			"Zone 1/2";
# ----------------------------------------

# group: Définition de l'ID pour les Linteaux Standard
list_create = List.Create(item0=setParameterByName_9, item1=setParameterByName_8)
flatten_3 = List.Flatten(list=list_create)
list_create_2 = List.Create(item0=getParameterValueByName_12, item1=python_script_7)
code_block_26 = CodeBlock { 1; }
flatten_4 = List.Flatten(list=list_create_2, amt=code_block_26)
code_block_27 = CodeBlock { "Identifiant"; }

# group: Si LU et (COVAL ou SATOV)-> Actualisation LB Standard
python_script_8 = Python(IN[0]=flatten_3, IN[1]=flatten_4, IN[2]=getParameterValueByName_7, IN[3]=getParameterValueByName_8)
# ---------- python_script_8.python (38 lines) ----------
import clr
clr.AddReference("RevitAPIUI")
from Autodesk.Revit.UI import *
import webbrowser

# Les entrées effectuées dans ce noeud sont stockées sous forme de liste dans les variables IN.
dataEnteringNode = IN

ouvertures = IN[0]
data = IN[1]
coval = IN[2][0]
satov = IN[3][0]

convertOuvertures = []
out = []

for i in range(len(ouvertures)):
	if data[i][10] == 1 and data[i][0] == 0 and data[i][1] == 0 and (coval==1 or satov ==1) :
		out.append(1)
		convertOuvertures.append(ouvertures[i])
	else :
		out.append(data[i][0])


dialog = TaskDialog("Ouvertures - LU - LB - Numerotation")
dialog.MainInstruction = "Ouvertures LU avec VR (SATOV / COVAL)"
dialog.MainContent = str(len(convertOuvertures))+" ouverture(s) avec LU et VR passée(s) en LB Standard"

dialog.CommonButtons = TaskDialogCommonButtons.Close;
dialog.DefaultButton = TaskDialogResult.Close;

#dialog.FooterText = "<a href=\"http://usa.autodesk.com/adsk/servlet/index?siteID=123112&id=2484975 \"> Click here for the Revit API Developer Center</a>"


result = dialog.Show() if (satov == 1 or coval == 1) and len(convertOuvertures)>0 else ""

#Assign your output to the OUT variable.
OUT = convertOuvertures, out
# ----------------------------------------
code_block_28 = CodeBlock(l=python_script_8)
# ---------- code_block_28.designscript (5 lines) ----------
// Ouvertures à convertir
l[0];

// Paramètre LB Standard mis à jour
l[1];
# ----------------------------------------
code_block_29 = CodeBlock { "LB Standard"; 1; }
setParameterByName_11 = Element.SetParameterByName(element=code_block_28.out0, parameterName=code_block_29.out0, value=code_block_29.out1)

# group (continued): Définition de l'ID pour les Linteaux Standard
python_script_9 = Python(IN[0]=flatten_4, IN[1]=code_block_25, IN[2]=code_block_28.out1)
# ---------- python_script_9.python (61 lines) ----------
# Charger les bibliothèques DesignScript et Standard Python
import sys
import clr
clr.AddReference('ProtoGeometry')
from Autodesk.DesignScript.Geometry import *

# Les entrées effectuées dans ce noeud sont stockées sous forme de liste dans les variables IN.
dataEnteringNode = IN

# Placer votre code au-dessous de cette ligne
data = IN[0]
zone = IN[1]
lbStd = IN[2]

lu_lb = []
id = []
rf = []
ch = []

out = []

for i in range(len(data)):

	lu_lb.append("LB") if (lbStd[i] == 1 or data[i][1] == 1) else lu_lb.append("LU")
		
for i in range(len(data)):
	if data[i][1] == 1 : 
		id.append("0")
	elif data[i][2] == 1 :
		id.append("1")
	elif data[i][3] == 1 :
		id.append("2")
	elif data[i][4] == 1 :
		id.append("3")
	elif data[i][5] == 1 :
		section = "{}{}".format(data[i][6],data[i][7])
		if section == "20.020.0" or section == "20.020.5" or section == "20.021.0" or section == "20.021.5" or section == "20.022.0" or section == "20.022.5" or section == "20.023.0" or section == "20.023.5" or section == "20.024.0" or section == "20.024.5" :
			id.append("1")
		elif section == "20.025.0" or section == "20.025.5" or section == "20.026.0" or section == "20.026.5" or section == "20.027.0" or section == "20.027.5" or section == "20.028.0" or section == "20.028.5" or section == "20.029.0" or section == "20.029.5" : 
			id.append("2")
		elif section == "20.030.0" or section == "20.030.5" or section == "20.031.0" or section == "20.031.5" or section == "20.032.0" or section == "20.032.5" or section == "20.033.0" or section == "20.033.5" or section == "20.034.0" or section == "20.034.5" :
			id.append("3")
		else :
			id.append("?")
	else :
		id.append("?")
		
for i in range(len(data)):
	rf.append("Rf") if (data[i][8] == 1 and data[i][1] == 0) else rf.append("")
	
for i in range(len(data)):
	ch.append("=CH") if (data[i][9] == 1) else ch.append("")

for i in range(len(data)):
	if zone == "Zone 1/2":
		out.append("{}{}{}".format(lu_lb[i],rf[i],id[i]))
	else:
		out.append("{}{}{}{}".format(lu_lb[i],rf[i],id[i],ch[i]))

# Affectez la sortie à la variable OUT.
OUT = out
# ----------------------------------------
code_block_30 = CodeBlock(id=python_script_9)
# ---------- code_block_30.designscript (4 lines) ----------
id != "LB0" &&
id != "LBRf0" &&
id != "LBRf0=CH" &&
id != "LB0=CH";
# ----------------------------------------
filterByBoolMask_5 = List.FilterByBoolMask(list=flatten_3, mask=code_block_30)
filterByBoolMask_6 = List.FilterByBoolMask(list=python_script_9, mask=code_block_30)
setParameterByName_12 = Element.SetParameterByName(element=filterByBoolMask_5.in, parameterName=code_block_27, value=filterByBoolMask_6.in)

# group: Définition de l'ID pour les Linteaux NON Standard
code_block_31 = CodeBlock { "Niveau"; }
getParameterValueByName_15 = Element.GetParameterValueByName(element=filterByBoolMask_5.out, parameterName=code_block_31)
elevation_2 = Level.Elevation(level=getParameterValueByName_15)
uniqueItems = List.UniqueItems(list=elevation_2)
sort = List.Sort(list=uniqueItems)
python_script_10 = Python(IN[0]=filterByBoolMask_5.out, IN[1]=filterByBoolMask_6.out, IN[2]=elevation_2, IN[3]=sort)
# ---------- python_script_10.python (28 lines) ----------
# Charger les bibliothèques DesignScript et Standard Python
import sys
import clr
clr.AddReference('ProtoGeometry')
from Autodesk.DesignScript.Geometry import *

# Les entrées effectuées dans ce noeud sont stockées sous forme de liste dans les variables IN.
dataEnteringNode = IN

# Placer votre code au-dessous de cette ligne
ouverture = IN[0]
id = IN[1]
elevation = IN[2]
level = IN[3]

out = []

for i in range(len(level)):
	out.append([])


for i in range(len(ouverture)):
	for j in range(len(level)):
		if level[j] == elevation[i]:
			 out[j].append([ouverture[i],id[i]])

# Affectez la sortie à la variable OUT.
OUT = out
# ----------------------------------------
code_block_32 = CodeBlock { 0; }
getItemAtIndex = List.GetItemAtIndex(list=python_script_10@@L2, index=code_block_32)
getHost_2 = FamilyInstance.GetHost(familyInstance=getItemAtIndex)
getLocation = Element.GetLocation(element=getHost_2)
direction = Line.Direction(line=getLocation)
X = Vector.X(vector=direction)
round_2 = Math.Round(number=X)
Y = Vector.Y(vector=direction)
round_3 = Math.Round(number=Y)
getLocation_2 = Element.GetLocation(element=getItemAtIndex)
X_2 = Point.X(point=getLocation_2)
Y_2 = Point.Y(point=getLocation_2)
python_script_11 = Python(IN[0]=round_2, IN[1]=round_3, IN[2]=python_script_10, IN[3]=X_2, IN[4]=Y_2)
# ---------- python_script_11.python (137 lines) ----------
# Charger les bibliothèques DesignScript et Standard Python
import sys
import clr
clr.AddReference('ProtoGeometry')
from Autodesk.DesignScript.Geometry import *

# Les entrées effectuées dans ce noeud sont stockées sous forme de liste dans les variables IN.
dataEnteringNode = IN

# Placer votre code au-dessous de cette ligne
vectorX = IN[0]
vectorY = IN[1]
el = IN[2]
ptX = IN[3]
ptY = IN[4]

orientation = []
list = []
sublistX=[]
sublistY=[]
out =[]

for i in range(len(vectorX)):
	orientation.append([])
	for j in range(len(vectorX[i])):
		if vectorX[i][j] < 0: vectorX[i][j]=vectorX[i][j]*-1
		if vectorY[i][j] < 0: vectorY[i][j]=vectorY[i][j]*-1
		if vectorX[i][j] >= 0 and vectorY[i][j] >= 0 :
			orientation[i].append(True) if vectorX[i][j] > vectorY[i][j] else orientation[i].append(False)

for i in range(len(vectorX)):
	list.append([])
	for j in range(2):
		list[i].append([])
	for k in range(len(vectorX[i])):
		line = [el[i][k],ptX[i][k],ptY[i][k]]	
		sublistY.append(line) if orientation[i][k] else sublistX.append(line)
			
		if k == (len(vectorX[i])-1) :
			tempY = sorted(sublistY, key = lambda x: x[2], reverse = True)
			tempX = sorted(sublistX, key = lambda x: x[1], reverse = False)		
			list[i][0] = tempY
			list[i][1] = tempX
			sublistY = []
			sublistX = []
tempX = []
tempY = []

tempSortedX = []
tempSortedY = []

for i in range(len(list)):
	for j in range(2):
		for k in range(len(list[i][j])):
			if j == 0 :
				if len(list[i][j]) == 1 : 
					tempSortedX.append(list[i][j][k])
					tempSortedX[len(tempSortedX)-1].append([i,j,k])
				else :
					if list[i][j][k][2] == list[i][j][k-1][2]:
						if (list[i][j][k-2][2] != list[i][j][k][2]) :
							tempX.append(list[i][j][k-1])
							tempX[len(tempX)-1].append([i,j,k-1])
						tempX.append(list[i][j][k])
						tempX[len(tempX)-1].append([i,j,k])
						tempSortedX = sorted(tempX, key = lambda x: x[1], reverse = False)
			
			elif j == 1 :
				if len(list[i][j]) == 1 : 
					tempSortedY.append(list[i][j][k])
					tempSortedY[len(tempSortedY)-1].append([i,j,k])
				else :
					if list[i][j][k][1] == list[i][j][k-1][1]:
						if (list[i][j][k-2][1] != list[i][j][k][1]) :
							tempY.append(list[i][j][k-1])
							tempY[len(tempY)-1].append([i,j,k-1])
						tempY.append(list[i][j][k])
						tempY[len(tempY)-1].append([i,j,k])
						tempSortedY = sorted(tempY, key = lambda x: x[2], reverse = False)

doublePosX = []
for i in range(len(tempSortedX)):
	if tempSortedX[i][2] not in doublePosX:
		doublePosX.append(tempSortedX[i][2])
		
doublePosY = []
for i in range(len(tempSortedY)):
	if tempSortedY[i][1] not in doublePosY:
		doublePosY.append(tempSortedY[i][1])
		
doubleX = []
for i in range(len(doublePosX)):
	doubleX.append([])
	for j in range(len(tempSortedX)):
		if tempSortedX[j][2] == doublePosX[i]:
			doubleX[i].append(tempSortedX[j])
					
doubleY = []
for i in range(len(doublePosY)):
	doubleY.append([])
	for j in range(len(tempSortedY)):
		if tempSortedY[j][1] == doublePosY[i]:
			doubleY[i].append(tempSortedY[j])
			
minX = []
for i in range(len(doubleX)):
	minX.append([])
	for j in range(len(doubleX[i])):
		if j == 0 :
			minX[i] = doubleX[i][j][3]
		elif doubleX[i][j][3][2] < minX[i][2] :
			minX[i] = doubleX[i][j][3]
				
minY = []
for i in range(len(doubleY)):
	minY.append([])
	for j in range(len(doubleY[i])):
		if j == 0 :
			minY[i] = doubleY[i][j][3]
		elif doubleY[i][j][3][2] < minY[i][2] :
			minY[i] = doubleY[i][j][3]

for i in range(len(doubleX)):
	for j in range(len(doubleX[i])):
		list[minX[i][0]][minX[i][1]][j+minX[i][2]] = [doubleX[i][j][0],doubleX[i][j][1],doubleX[i][j][2]]
		
for i in range(len(doubleY)):
	for j in range(len(doubleY[i])):
		list[minY[i][0]][minY[i][1]][j+minY[i][2]] = [doubleY[i][j][0],doubleY[i][j][1],doubleY[i][j][2]]

for i in range(len(list)):
	for j in range(2):
		for k in range(len(list[i][j])):
			out.append(list[i][j][k][0])

# Affectez la sortie à la variable OUT.
OUT = out
# ----------------------------------------
code_block_33 = CodeBlock { 0; }
getItemAtIndex_2 = List.GetItemAtIndex(list=python_script_11@L2, index=code_block_33)
code_block_34 = CodeBlock { "Identifiant"; }
code_block_35 = CodeBlock { 1; "0"; }
getItemAtIndex_3 = List.GetItemAtIndex(list=python_script_11@L2, index=code_block_35.out0)
code_block_36 = CodeBlock { 4; 1; }
count = List.Count(list=python_script_11)
sequence = Sequence(start=code_block_36.out0, amount=count, step=code_block_36.out1)
code_block_37 = CodeBlock(id=sequence) { ""+id; }
replace = String.Replace(str=getItemAtIndex_3, searchFor=code_block_35.out1, replaceWith=code_block_37)
setParameterByName_13 = Element.SetParameterByName(element=getItemAtIndex_2, parameterName=code_block_34, value=replace)

# group: Rapport Nombre ouvertures pour contrôle
passthrough = Custom[Passthrough](passThrough=python_script_9, waitFor=setParameterByName_11)  # package Clockwork for Dynamo 2.x; Forces a sequential order of execution. The node wired into the output of the Passthrough node will be executed *after* the node wired into the waitFor input (e.g. important for some Revit operations). The value of the passThrough input will be passed on to the node wired into the output port of the Passthrough node.
python_script_12 = Python(IN[0]=passthrough)
# ---------- python_script_12.python (63 lines) ----------
import clr
clr.AddReference("RevitAPIUI")
from Autodesk.Revit.UI import *
import webbrowser

# Les entrées effectuées dans ce noeud sont stockées sous forme de liste dans les variables IN.
dataEnteringNode = IN

id = IN[0]

msg = ""

idList = [
"LU1", 
"LU2", 
"LU3",
"LURf1", 
"LURf2", 
"LURf3",
"LU1=CH", 
"LU2=CH", 
"LU3=CH",
"LURf1=CH", 
"LURf2=CH", 
"LURf3=CH",
"LB1", 
"LB2", 
"LB3",
"LBRf1", 
"LBRf2", 
"LBRf3",
"LB1=CH", 
"LB2=CH", 
"LB3=CH",
"LBRf1=CH", 
"LBRf2=CH", 
"LBRf3=CH",
"LB0",
"LB0=CH",
]

for i in range(len(idList)):
	nb = id.count(idList[i])
	if nb > 0 : 
		msg = msg+"• "+str(nb)+" x "+idList[i]+"\n"


msg+="----------\nTOTAL : "+str(len(id))+" ouverture(s)"

dialog = TaskDialog("Ouvertures - LU - LB - Numerotation")
dialog.MainInstruction = "Répartition des ouvertures"
dialog.MainContent = msg.replace("LB0", "LB Non Standard").replace("LB0=CH", "LB Non Standard =CH")

dialog.CommonButtons = TaskDialogCommonButtons.Close;
dialog.DefaultButton = TaskDialogResult.Close;

#dialog.FooterText = "<a href=\"http://usa.autodesk.com/adsk/servlet/index?siteID=123112&id=2484975 \"> Click here for the Revit API Developer Center</a>"


result = dialog.Show()

#Assign your output to the OUT variable.
OUT = msg
# ----------------------------------------
