# Dynamo graph script.dyn "DEV_B1 - E - Ouvertures - Zone 3 - 4" (Dynamo 2.6.1.8786)

code_block = CodeBlock { Category.ByName("Informations sur le projet"); "Sismique"; }
all_elements_of_category = ElementsOfCategory(Category=code_block.out0)
getParameterValueByName = Element.GetParameterValueByName(element=all_elements_of_category, parameterName=code_block.out1)
python_script = Python(IN[0]=getParameterValueByName)
# ---------- python_script.python (20 lines) ----------
import clr
clr.AddReference("RevitAPIUI")
from Autodesk.Revit.UI import *
import webbrowser

# Les entrées effectuées dans ce noeud sont stockées sous forme de liste dans les variables IN.
dataEnteringNode = IN

zone = str(IN[0][0])[:-2]

out = ""

dialog = TaskDialog("Positionnnement Raidisseurs")
dialog.MainInstruction = "Le projet n'est pas en Zone sismique 3 ou 4"
dialog.MainContent = "Zone sismique : "+zone

result = "" if zone == "3" or zone == "4" else dialog.Show()

#Assign your output to the OUT variable.
OUT = zone
# ----------------------------------------
code_block_2 = CodeBlock(zone=python_script) { zone == "3" ||zone == "4"; ""; }
code_block_3 = CodeBlock { [Category.ByName("Fenêtres"),Category.ByName("Portes")]; }
all_elements_of_category_2 = ElementsOfCategory(Category=code_block_3)
if_ = If(test=code_block_2.out0, true=all_elements_of_category_2, false=code_block_2.out1)
flatten = List.Flatten(list=if_)
python_script_2 = Python(IN[0]=flatten)
# ---------- python_script_2.python (32 lines) ----------
import clr
clr.AddReference('RevitAPI')
from Autodesk.Revit.DB import*
clr.AddReference('RevitServices')
from RevitServices.Persistence import DocumentManager
doc = DocumentManager.Instance.CurrentDBDocument

fams = list(FilteredElementCollector(doc).OfClass(Family))
inplace = [f for f in fams if f.IsInPlace]
inPlaceCategory = [f.FamilyCategory.Name for f in inplace]
inPlaceId = [f.Id for f in inplace]
inPlaceName = [f.Name for f in inplace]


import sys
import clr
clr.AddReference('ProtoGeometry')
from Autodesk.DesignScript.Geometry import *
# Les entrées effectuées dans ce noeud sont stockées sous forme de liste dans les variables IN.
dataEnteringNode = IN
element = IN[0]

out = []

# Placer votre code au-dessous de cette ligne
for i in range(len(element)):
	if element[i].Name not in inPlaceName :
		out.append(element[i])

# Affectez la sortie à la variable OUT.
OUT = out
#OUT = category, inplace , id
# ----------------------------------------

# group: Murs hôtes
getHost = FamilyInstance.GetHost(familyInstance=python_script_2)
code_block_4 = CodeBlock { "Contrainte inférieure"; "Contrainte supérieure"; }
getParameterValueByName_2 = Element.GetParameterValueByName(element=getHost, parameterName=code_block_4.out0)
getLocation = Element.GetLocation(element=getHost)
direction = Line.Direction(line=getLocation)
XAxis = Vector.XAxis()
angleWithVector = Vector.AngleWithVector(vector=direction, otherVector=XAxis)
python_script_3 = Python(IN[0]=direction, IN[1]=angleWithVector)
# ---------- python_script_3.python (53 lines) ----------
# Charger les bibliothèques DesignScript et Standard Python
import sys
import clr
clr.AddReference('ProtoGeometry')
from Autodesk.DesignScript.Geometry import *

from math import *

# Les entrées effectuées dans ce noeud sont stockées sous forme de liste dans les variables IN.
dataEnteringNode = IN
vector = IN[0]
angle = IN[1]
out = []

# Placer votre code au-dessous de cette ligne
for i in range(len(vector)):
	
	out.append([])
	
	xMur = vector[i].X
	yMur = vector[i].Y
	
	if xMur >= 0 and yMur > 0 :
		out[i].append(1)
	elif xMur < 0 and yMur >= 0 :
		out[i].append(2)
	elif xMur <= 0 and yMur < 0 :
		out[i].append(3)
	elif xMur > 0 and yMur <= 0 :
		out[i].append(4)
		
	out[i].append(round(angle[i]))
	
	"""
	lgMur = sqrt(xMur**2+yMur**2)
	
	xUnitaire = lgMur
	yUnitaire = 0
	lgUnitaire = lgMur
	
	lgOppose = sqrt((xMur-xUnitaire)**2+(yMur-yUnitaire)**2)
	
	cosAngle = (lgOppose**2-lgUnitaire**2-lgMur**2)/(-2*lgUnitaire*lgMur)

	normalize = -1*cosAngle if cosAngle < 0 else cosAngle
	
	out[i].append(round(normalize,2))
	
	#out[i].append(round(degrees(acos(normalize))))
	"""
	
# Affectez la sortie à la variable OUT.
OUT = out
# ----------------------------------------
getParameterValueByName_3 = Element.GetParameterValueByName(element=getHost, parameterName=code_block_4.out1)

# group: Ouvertures
code_block_5 = CodeBlock { "Famille"; "Largeur brute"; "Hauteur"; "VR"; "Hauteur de l'appui"; "Niveau"; "Hauteur VR"; }
getParameterValueByName_4 = Element.GetParameterValueByName(element=python_script_2, parameterName=code_block_5.out5)
getParameterValueByName_5 = Element.GetParameterValueByName(element=python_script_2, parameterName=code_block_5.out0)
getParameterValueByName_6 = Element.GetParameterValueByName(element=getParameterValueByName_5, parameterName=code_block_5.out1)
getParameterValueByName_7 = Element.GetParameterValueByName(element=getParameterValueByName_5, parameterName=code_block_5.out2)
getParameterValueByName_8 = Element.GetParameterValueByName(element=python_script_2, parameterName=code_block_5.out3)
getLocation_2 = Element.GetLocation(element=python_script_2)
getParameterValueByName_9 = Element.GetParameterValueByName(element=python_script_2, parameterName=code_block_5.out4)

# group: E dans le projet
code_block_6 = CodeBlock { Category.ByName("Poteaux porteurs"); "Famille"; "Commentaires du type"; "Niveau de base"; "Niveau supérieur"; }
all_elements_of_category_3 = ElementsOfCategory(Category=code_block_6.out0)
getLocation_3 = Element.GetLocation(element=all_elements_of_category_3)
getParameterValueByName_10 = Element.GetParameterValueByName(element=all_elements_of_category_3, parameterName=code_block_6.out1)
getParameterValueByName_11 = Element.GetParameterValueByName(element=getParameterValueByName_10, parameterName=code_block_6.out2)
getParameterValueByName_12 = Element.GetParameterValueByName(element=all_elements_of_category_3, parameterName=code_block_6.out3)
getParameterValueByName_13 = Element.GetParameterValueByName(element=all_elements_of_category_3, parameterName=code_block_6.out4)
python_script_4 = Python(IN[0]=all_elements_of_category_3, IN[1]=getLocation_3, IN[2]=getParameterValueByName_11, IN[3]=getParameterValueByName_12, IN[4]=getParameterValueByName_13)
# ---------- python_script_4.python (24 lines) ----------
# Charger les bibliothèques DesignScript et Standard Python
import sys
import clr
clr.AddReference('ProtoGeometry')
from Autodesk.DesignScript.Geometry import *

# Les entrées effectuées dans ce noeud sont stockées sous forme de liste dans les variables IN.
dataEnteringNode = IN

el = IN[0]
position = IN[1]
type = IN[2]
contrainteInf = IN[3]
contrainteSup = IN[4]

out=[]

# Placer votre code au-dessous de cette ligne
for i in range(len(el)):
	if type[i] == "E":
		out.append([position[i], contrainteInf[i], contrainteSup[i]])
		
# Affectez la sortie à la variable OUT.
OUT = out
# ----------------------------------------

getParameterValueByName_14 = Element.GetParameterValueByName(element=getParameterValueByName_5, parameterName=code_block_5.out6)

# group: Positionnement E
family_types = FamilyTypes("123STR_Raidisseur:E")
python_script_5 = Python(IN[0]=python_script_3, IN[1]=getParameterValueByName_4, IN[2]=getParameterValueByName_3, IN[3]=python_script_2, IN[4]=getParameterValueByName_6, IN[5]=getParameterValueByName_7, IN[6]=getParameterValueByName_8, IN[7]=getLocation_2, IN[8]=python_script_4, IN[9]=getParameterValueByName_9, IN[10]=getParameterValueByName_14)
# ---------- python_script_5.python (90 lines) ----------
# Charger les bibliothèques DesignScript et Standard Python
import sys
import clr
clr.AddReference('ProtoGeometry')
from Autodesk.DesignScript.Geometry import *

from math import *

# Les entrées effectuées dans ce noeud sont stockées sous forme de liste dans les variables IN.
dataEnteringNode = IN

angle = IN[0]
contrainteInf = IN[1]
contrainteSup = IN[2]
el = IN[3]
largeur = IN[4]
hauteur = IN[5]
vr = IN[6]
position = IN[7]
r = IN[8]
appui = IN[9]
hauteurVR = IN[10]

decalage = 0

pt = [[],[],[],[],[],[]]
out = [[],[],[],[],[],[]]

# Placer votre code au-dessous de cette ligne
# Définition des paramètres
for i in range(len(el)) :

	surface = (largeur[i]/100)*(hauteur[i]/100)
	
	if surface < 1.50 :
	
		decalage = (largeur[i]/2)+20 if vr[i] == 1 else (largeur[i]/2)+10
		htVR = hauteurVR[i] if hauteurVR[i]!="" else 0
		
		pt[0].append(contrainteInf[i])
		pt[0].append(contrainteInf[i])
		pt[1].append(contrainteSup[i])
		pt[1].append(contrainteSup[i])
		pt[3].append(90-angle[i][1] if angle[i][0] == 1 or angle[i][0] == 2 else angle[i][1])
		pt[3].append(90-angle[i][1] if angle[i][0] == 1 or angle[i][0] == 2 else angle[i][1])
		pt[4].append(appui[i])
		pt[4].append(appui[i])
		pt[5].append(-((round(contrainteSup[i].Elevation)-round(contrainteInf[i].Elevation))-hauteur[i]-appui[i]-htVR))
		pt[5].append(-((round(contrainteSup[i].Elevation)-round(contrainteInf[i].Elevation))-hauteur[i]-appui[i]-htVR))
		
		if angle[i][1] == 0 or angle[i][1] == 180 :
			pt[2].append(Point.ByCoordinates(position[i].X+decalage,position[i].Y,position[i].Z))
			pt[2].append(Point.ByCoordinates(position[i].X-decalage,position[i].Y,position[i].Z))
			
		elif angle[i][1] == 90 or angle[i][1] == 270 :
			pt[2].append(Point.ByCoordinates(position[i].X,position[i].Y+decalage,position[i].Z))
			pt[2].append(Point.ByCoordinates(position[i].X,position[i].Y-decalage,position[i].Z))
			
		else :
				x1 = cos(radians(angle[i][1]))*decalage
				y1 = sin(radians(angle[i][1]))*decalage
				
				x2 = -1*x1
				y2 = -1*y1
								
				
				if angle[i][0] == 1 or angle[i][0] == 2 :
					pt[2].append(Point.ByCoordinates(position[i].X+x1,position[i].Y+y1,position[i].Z))
					pt[2].append(Point.ByCoordinates(position[i].X+x2,position[i].Y+y2,position[i].Z))
					
				elif angle[i][0] == 3 or angle[i][0] == 4 :
					pt[2].append(Point.ByCoordinates(position[i].X-x1,position[i].Y+y1,position[i].Z))
					pt[2].append(Point.ByCoordinates(position[i].X-x2,position[i].Y+y2,position[i].Z))

# Filtre si R présent dans le projet	
for i in range(len(pt[2])) :
	for j in range(len(r)) :
		if not isinstance(pt[0][i], str) :
			if round(r[j][0].X, 3) == round(pt[2][i].X,3) and round(r[j][0].Y,3) == round(pt[2][i].Y,3) and r[j][1] == pt[0][i] and r[j][2] == pt[1][i] :
				for k in range(len(pt)) :
					pt[k][i] = ""
			

for i in range(len(pt[0])) :
	for k in range(len(pt)) :
		if pt[0][i] != "" :
			out[k].append(pt[k][i])

# Affectez la sortie à la variable OUT.
OUT = out
# ----------------------------------------
code_block_7 = CodeBlock(l=python_script_5) { l[2]; l[0]; }
byPointAndLevel = FamilyInstance.ByPointAndLevel(familyType=family_types, point=code_block_7.out0, level=code_block_7.out1)
code_block_8 = CodeBlock(l=python_script_5) { "Niveau supérieur"; l[1]; l[3]; }
setParameterByName = Element.SetParameterByName(element=byPointAndLevel, parameterName=code_block_8.out0, value=code_block_8.out1)
setRotation = FamilyInstance.SetRotation(familyInstance=setParameterByName, degree=code_block_8.out2)
code_block_9 = CodeBlock(l=python_script_5) { "Décalage inférieur"; l[4]; "Décalage supérieur"; l[5]; }
setParameterByName_2 = Element.SetParameterByName(element=setRotation, parameterName=code_block_9.out0, value=code_block_9.out1)
setParameterByName_3 = Element.SetParameterByName(element=setRotation, parameterName=code_block_9.out2, value=code_block_9.out3)
