# Dynamo graph script.dyn "DEV_A5 - LG - Numerotation" (Dynamo 2.6.1.8786)
# packages: Clockwork for Dynamo 2.x 2.3.0

code_block = CodeBlock { Category.ByName("Ossature"); "Type"; }
all_elements_of_category = ElementsOfCategory(Category=code_block.out0)
getParameterValueByName = Element.GetParameterValueByName(element=all_elements_of_category, parameterName=code_block.out1)
code_block_2 = CodeBlock(e=getParameterValueByName) { e.Name; 0; 2; }
substring = String.Substring(str=code_block_2.out0, startIndex=code_block_2.out1, length=code_block_2.out2)
code_block_3 = CodeBlock(pt=substring) { pt == "LG"; }
filterByBoolMask = List.FilterByBoolMask(list=all_elements_of_category, mask=code_block_3)
code_block_4 = CodeBlock { "Niveau de référence"; }
getParameterValueByName_2 = Element.GetParameterValueByName(element=filterByBoolMask.in, parameterName=code_block_4)
code_block_5 = CodeBlock(l=getParameterValueByName_2) { l.Name; }
python_script = Python(IN[0]=code_block_5)
# ---------- python_script.python (27 lines) ----------
# Charger les bibliothèques DesignScript et Standard Python
import sys
import clr
clr.AddReference('ProtoGeometry')
from Autodesk.DesignScript.Geometry import *

# Les entrées effectuées dans ce noeud sont stockées sous forme de liste dans les variables IN.
dataEnteringNode = IN

level = IN[0]
out = []
# Placer votre code au-dessous de cette ligne
for i in range(len(level)):
	if "FD" in level[i]:
		out.append("FD")
	elif "RDC" in level[i]:
		out.append("RDC")
	elif "R+1" in level[i]:
		out.append("R+1")
	elif "R+2" in level[i]:
		out.append("R+2")
	elif "R+3" in level[i]:
		out.append("R+3")
	else :
		out.append("")
# Affectez la sortie à la variable OUT.
OUT = out
# ----------------------------------------
python_script_2 = Python(IN[0]=python_script, IN[1]=filterByBoolMask.in)
# ---------- python_script_2.python (29 lines) ----------
# Charger les bibliothèques DesignScript et Standard Python
import sys
import clr
clr.AddReference('ProtoGeometry')
from Autodesk.DesignScript.Geometry import *

# Les entrées effectuées dans ce noeud sont stockées sous forme de liste dans les variables IN.
dataEnteringNode = IN
level = IN[0]
element = IN[1]

out = [[],[],[],[],[]]

# Placer votre code au-dessous de cette ligne
for i in range(len(level)):

	if level[i] == "FD":
		out[0].append(element[i])
	if level[i] == "RDC":
		out[1].append(element[i])
	if level[i] == "R+1":
		out[2].append(element[i])
	if level[i] == "R+2":
		out[3].append(element[i])
	if level[i] == "R+3":
		out[4].append(element[i])

# Affectez la sortie à la variable OUT.
OUT = out
# ----------------------------------------
getLocation = Element.GetLocation(element=python_script_2)
direction = Line.Direction(line=getLocation)
X = Vector.X(vector=direction)
round = Math.Round(number=X)
round_2 = Math.Round(number=round)
Y = Vector.Y(vector=direction)
round_3 = Math.Round(number=Y)
round_4 = Math.Round(number=round_3)
startPoint = Curve.StartPoint(curve=getLocation)
X_2 = Point.X(point=startPoint)
endPoint = Curve.EndPoint(curve=getLocation)
X_3 = Point.X(point=endPoint)
Y_2 = Point.Y(point=startPoint)
Y_3 = Point.Y(point=endPoint)
code_block_6 = CodeBlock(startX=X_2, endX=X_3, startY=Y_2, endY=Y_3)
# ---------- code_block_6.designscript (4 lines) ----------
// X
(startX+endX)/2;
// Y
(startY+endY)/2;
# ----------------------------------------
round_5 = Math.Round(number=code_block_6.out0)
round_6 = Math.Round(number=code_block_6.out1)
python_script_3 = Python(IN[0]=round_2, IN[1]=round_4, IN[2]=python_script_2, IN[3]=round_5, IN[4]=round_6)
# ---------- python_script_3.python (138 lines) ----------
# Charger les bibliothèques DesignScript et Standard Python
import sys
import clr
clr.AddReference('ProtoGeometry')
from Autodesk.DesignScript.Geometry import *

# Les entrées effectuées dans ce noeud sont stockées sous forme de liste dans les variables IN.
dataEnteringNode = IN

# Placer votre code au-dessous de cette ligne
vectorX = IN[0]
vectorY = IN[1]
el = IN[2]
ptX = IN[3]
ptY = IN[4]

orientation = []
list = []
sublistX=[]
sublistY=[]
out =[]

for i in range(len(vectorX)):
	orientation.append([])
	for j in range(len(vectorX[i])):
		if vectorX[i][j] < 0: vectorX[i][j]=vectorX[i][j]*-1
		if vectorY[i][j] < 0: vectorY[i][j]=vectorY[i][j]*-1
		if vectorX[i][j] >= 0 and vectorY[i][j] >= 0 :
			orientation[i].append(True) if vectorX[i][j] > vectorY[i][j] else orientation[i].append(False)

for i in range(len(vectorX)):
	list.append([])
	for j in range(2):
		list[i].append([])
	for k in range(len(vectorX[i])):
		line = [el[i][k],ptX[i][k],ptY[i][k]]	
		sublistY.append(line) if orientation[i][k] else sublistX.append(line)
			
		if k == (len(vectorX[i])-1) :
			tempY = sorted(sublistY, key = lambda x: x[2], reverse = True)
			tempX = sorted(sublistX, key = lambda x: x[1], reverse = False)		
			list[i][0] = tempY
			list[i][1] = tempX
			sublistY = []
			sublistX = []

tempX = []
tempY = []

tempSortedX = []
tempSortedY = []

for i in range(len(list)):
	for j in range(2):
		for k in range(len(list[i][j])):
			if j == 0 :
				if len(list[i][j]) == 1 : 
					tempSortedX.append(list[i][j][k])
					tempSortedX[len(tempSortedX)-1].append([i,j,k])
				else :
					if list[i][j][k][2] == list[i][j][k-1][2]:
						if (list[i][j][k-2][2] != list[i][j][k][2]) :
							tempX.append(list[i][j][k-1])
							tempX[len(tempX)-1].append([i,j,k-1])
						tempX.append(list[i][j][k])
						tempX[len(tempX)-1].append([i,j,k])
						tempSortedX = sorted(tempX, key = lambda x: x[1], reverse = False)
			
			elif j == 1 :
				if len(list[i][j]) == 1 : 
					tempSortedY.append(list[i][j][k])
					tempSortedY[len(tempSortedY)-1].append([i,j,k])
				else :
					if list[i][j][k][1] == list[i][j][k-1][1]:
						if (list[i][j][k-2][1] != list[i][j][k][1]) :
							tempY.append(list[i][j][k-1])
							tempY[len(tempY)-1].append([i,j,k-1])
						tempY.append(list[i][j][k])
						tempY[len(tempY)-1].append([i,j,k])
						tempSortedY = sorted(tempY, key = lambda x: x[2], reverse = False)

doublePosX = []
for i in range(len(tempSortedX)):
	if tempSortedX[i][2] not in doublePosX:
		doublePosX.append(tempSortedX[i][2])
		
doublePosY = []
for i in range(len(tempSortedY)):
	if tempSortedY[i][1] not in doublePosY:
		doublePosY.append(tempSortedY[i][1])
		
doubleX = []
for i in range(len(doublePosX)):
	doubleX.append([])
	for j in range(len(tempSortedX)):
		if tempSortedX[j][2] == doublePosX[i]:
			doubleX[i].append(tempSortedX[j])
					
doubleY = []
for i in range(len(doublePosY)):
	doubleY.append([])
	for j in range(len(tempSortedY)):
		if tempSortedY[j][1] == doublePosY[i]:
			doubleY[i].append(tempSortedY[j])
			
minX = []
for i in range(len(doubleX)):
	minX.append([])
	for j in range(len(doubleX[i])):
		if j == 0 :
			minX[i] = doubleX[i][j][3]
		elif doubleX[i][j][3][2] < minX[i][2] :
			minX[i] = doubleX[i][j][3]
				
minY = []
for i in range(len(doubleY)):
	minY.append([])
	for j in range(len(doubleY[i])):
		if j == 0 :
			minY[i] = doubleY[i][j][3]
		elif doubleY[i][j][3][2] < minY[i][2] :
			minY[i] = doubleY[i][j][3]

for i in range(len(doubleX)):
	for j in range(len(doubleX[i])):
		list[minX[i][0]][minX[i][1]][j+minX[i][2]] = [doubleX[i][j][0],doubleX[i][j][1],doubleX[i][j][2]]
		
for i in range(len(doubleY)):
	for j in range(len(doubleY[i])):
		list[minY[i][0]][minY[i][1]][j+minY[i][2]] = [doubleY[i][j][0],doubleY[i][j][1],doubleY[i][j][2]]

for i in range(len(list)):
	for j in range(2):
		for k in range(len(list[i][j])):
			out.append(list[i][j][k][0])
			
# Affectez la sortie à la variable OUT.
OUT = out
# ----------------------------------------
code_block_7 = CodeBlock { "Commentaires"; }
code_block_8 = CodeBlock { 1; }
count = List.Count(list=python_script_3)
sequence = Sequence(start=code_block_8, amount=count, step=code_block_8)
code_block_9 = CodeBlock(id=sequence) { ""+id; }
setParameterByName = Element.SetParameterByName(element=python_script_3, parameterName=code_block_7, value=code_block_9)
code_block_10 = CodeBlock { "L Seuil 1"; "L Seuil 2"; "L Seuil 3"; }
code_block_11 = CodeBlock { "L Seuil 1"; "L Seuil 2"; "L Seuil 3"; }
getParameterValueByName_3 = Element.GetParameterValueByName(element=setParameterByName, parameterName=code_block_11.out0)  # frozen
getParameterValueByName_4 = Element.GetParameterValueByName(element=setParameterByName, parameterName=code_block_11.out1)  # frozen
getParameterValueByName_5 = Element.GetParameterValueByName(element=setParameterByName, parameterName=code_block_11.out2)  # frozen
code_block_12 = CodeBlock(Seuil1=getParameterValueByName_3, Seuil2=getParameterValueByName_4, Seuil3=getParameterValueByName_5) { Seuil1+1; Seuil2+1; Seuil3+1; }
setParameterByName_2 = Element.SetParameterByName(element=setParameterByName, parameterName=code_block_10.out0, value=code_block_12.out0)
code_block_13 = CodeBlock { "L Seuil 1"; "L Seuil 2"; "L Seuil 3"; }
getParameterValueByName_6 = Element.GetParameterValueByName(element=setParameterByName_2, parameterName=code_block_13.out0)
setParameterByName_3 = Element.SetParameterByName(element=setParameterByName, parameterName=code_block_10.out1, value=code_block_12.out1)
getParameterValueByName_7 = Element.GetParameterValueByName(element=setParameterByName_3, parameterName=code_block_13.out1)
setParameterByName_4 = Element.SetParameterByName(element=setParameterByName, parameterName=code_block_10.out2, value=code_block_12.out2)
getParameterValueByName_8 = Element.GetParameterValueByName(element=setParameterByName_4, parameterName=code_block_13.out2)
code_block_14 = CodeBlock(Seuil1=getParameterValueByName_6, Seuil2=getParameterValueByName_7, Seuil3=getParameterValueByName_8) { Seuil1-1; Seuil2-1; Seuil3-1; }
list_create = List.Create(item0=code_block_14.out0, item1=code_block_14.out1, item2=code_block_14.out2)
passthrough = Custom[Passthrough](passThrough=list_create)  # package Clockwork for Dynamo 2.x; Forces a sequential order of execution. The node wired into the output of the Passthrough node will be executed *after* the node wired into the waitFor input (e.g. important for some Revit operations). The value of the passThrough input will be passed on to the node wired into the output port of the Passthrough node.; unwired: waitFor
code_block_15 = CodeBlock(l=passthrough) { "L Seuil 1"; l[0]; "L Seuil 2"; l[1]; "L Seuil 3"; l[2]; }
setParameterByName_5 = Element.SetParameterByName(element=setParameterByName_2, parameterName=code_block_15.out0, value=code_block_14.out0)
code_block_16 = CodeBlock { "L Seuil 1"; "L Seuil 2"; "L Seuil 3"; }
getParameterValueByName_9 = Element.GetParameterValueByName(element=setParameterByName_5, parameterName=code_block_16.out0)
setParameterByName_6 = Element.SetParameterByName(element=setParameterByName_4, parameterName=code_block_15.out4, value=code_block_14.out2)
getParameterValueByName_10 = Element.GetParameterValueByName(element=setParameterByName_6, parameterName=code_block_16.out2)
setParameterByName_7 = Element.SetParameterByName(element=setParameterByName_3, parameterName=code_block_15.out2, value=code_block_14.out1)
getParameterValueByName_11 = Element.GetParameterValueByName(element=setParameterByName_7, parameterName=code_block_16.out1)
