# Dynamo graph DEV_A1 - Murs CHU - CHP + Purge.dyn (Dynamo 2.6.1.8786)

# group: AS Murs (Ai si Acrotere)
code_block = CodeBlock { Category.ByName("Murs"); "Contrainte supérieure"; }
all_elements_of_category = ElementsOfCategory(Category=code_block.out0)
getParameterValueByName = Element.GetParameterValueByName(element=all_elements_of_category, parameterName=code_block.out1)
type = Object.Type(obj=getParameterValueByName)
code_block_2 = CodeBlock { "Revit.Elements.Level"; }
contains = String.Contains(str=type, searchFor=code_block_2)
filterByBoolMask = List.FilterByBoolMask(list=all_elements_of_category, mask=contains)
code_block_3 = CodeBlock { "Dyn AS Murs REL"; }
filterByBoolMask_2 = List.FilterByBoolMask(list=getParameterValueByName, mask=contains)
elevation = Level.Elevation(level=filterByBoolMask_2.in)
code_block_4 = CodeBlock(b=elevation) { ""+b; }
length = String.Length(str=code_block_4)
code_block_5 = CodeBlock(x=length) { x-1; }
code_block_6 = CodeBlock { ",00"; }
contains_2 = String.Contains(str=code_block_4, searchFor=code_block_6)
code_block_7 = CodeBlock(a=contains_2)
# ---------- code_block_7.designscript (5 lines) ----------
a;

a==true ?
	-7:
	-4;
# ----------------------------------------
remove = String.Remove(str=code_block_4, startIndex=code_block_5, count=code_block_7.out1)
python_script = Python(IN[0]=remove)
# ---------- python_script.python (21 lines) ----------
# Charger les bibliothèques DesignScript et Standard Python
import sys
import clr
clr.AddReference('ProtoGeometry')
from Autodesk.DesignScript.Geometry import *

# Les entrées effectuées dans ce noeud sont stockées sous forme de liste dans les variables IN.
dataEnteringNode = IN
alt = IN[0]
out=[]

# Placer votre code au-dessous de cette ligne
for i in range(len(alt)):
	el = alt[i]
	if "," in el :
		el = el.replace(",",".")

	out.append(float(el))

# Affectez la sortie à la variable OUT.
OUT = out
# ----------------------------------------
code_block_8 = CodeBlock(lg=python_script)
# ---------- code_block_8.designscript (3 lines) ----------
lg > 0 ? "+"+lg/100 :
lg == 0 ? "±"+lg/100 :
""+lg/100;
# ----------------------------------------
code_block_9 = CodeBlock { ","; "."; }
replace = String.Replace(str=code_block_8, searchFor=code_block_9.out0, replaceWith=code_block_9.out1)
length_2 = String.Length(str=replace)
code_block_10 = CodeBlock(x=length_2) { x-1; }
code_block_11 = CodeBlock { -3; }
remove_2 = String.Remove(str=replace, startIndex=code_block_10, count=code_block_11)
setParameterByName = Element.SetParameterByName(element=filterByBoolMask.in, parameterName=code_block_3, value=remove_2)
round = Math.Round(number=elevation)
code_block_12 = CodeBlock { Category.ByName("Murs"); ["Niv. A","Niv. B"]; }
all_elements_of_category_2 = ElementsOfCategory(Category=code_block_12.out0)
code_block_13 = CodeBlock { "Dyn AS Murs REL Alt+"; }
code_block_14 = CodeBlock { "/"; }
getParameterValueByName_2 = Element.GetParameterValueByName(element=all_elements_of_category_2, parameterName=code_block_12.out1, lacing=CrossProduct)
code_block_15 = CodeBlock { ","; "."; }
code_block_16 = CodeBlock { "Dyn AS Murs REL Alt A"; "Dyn AS Murs REL Alt B"; }
code_block_17 = CodeBlock(lg=getParameterValueByName_2)
# ---------- code_block_17.designscript (3 lines) ----------
lg > 0 ? "+"+lg :
lg == 0 ? "?   " :
""+lg;
# ----------------------------------------
code_block_18 = CodeBlock { ","; "."; }
replace_2 = String.Replace(str=code_block_17, searchFor=code_block_18.out0, replaceWith=code_block_18.out1)
length_3 = String.Length(str=replace_2)
code_block_19 = CodeBlock(l=length_3) { l== 0 ? 0 : l-1; }
code_block_20 = CodeBlock(l=length_3) { l==0 ? 0 : -3; }
remove_3 = String.Remove(str=replace_2, startIndex=code_block_19, count=code_block_20)
code_block_21 = CodeBlock { 0; 1; }
getItemAtIndex = List.GetItemAtIndex(list=remove_3@L2, index=code_block_21.out0)
setParameterByName_2 = Element.SetParameterByName(element=all_elements_of_category_2, parameterName=code_block_16.out0, value=getItemAtIndex)
getItemAtIndex_2 = List.GetItemAtIndex(list=remove_3@L2, index=code_block_21.out1)
setParameterByName_3 = Element.SetParameterByName(element=all_elements_of_category_2, parameterName=code_block_16.out1, value=getItemAtIndex_2)

code_block_22 = CodeBlock(lg=getParameterValueByName_2) { lg == 0 ? "" : lg; }

# group (continued): AS Murs (Ai si Acrotere)
python_script_2 = Python(IN[0]=python_script, IN[1]=code_block_22)
# ---------- python_script_2.python (17 lines) ----------
# Charger les bibliothèques DesignScript et Standard Python
import sys
import clr
clr.AddReference('ProtoGeometry')
from Autodesk.DesignScript.Geometry import *

# Les entrées effectuées dans ce noeud sont stockées sous forme de liste dans les variables IN.
dataEnteringNode = IN
# Placer votre code au-dessous de cette ligne
base = IN[0]
alt = IN[1]

for i in range(len(base)):
		alt[i].append(base[i]/100)
		
# Affectez la sortie à la variable OUT.
OUT = alt
# ----------------------------------------
sort = List.Sort(list=python_script_2)
code_block_23 = CodeBlock(lg=sort)
# ---------- code_block_23.designscript (2 lines) ----------
lg > 0 ? "+"+lg :
""+lg;
# ----------------------------------------
replace_3 = String.Replace(str=code_block_23, searchFor=code_block_15.out0, replaceWith=code_block_15.out1)
length_4 = String.Length(str=replace_3)
code_block_24 = CodeBlock(l=length_4) { l== 0 ? 0 : l-1; }
code_block_25 = CodeBlock(l=length_4) { l==0 ? 0 : -3; }
remove_4 = String.Remove(str=replace_3, startIndex=code_block_24, count=code_block_25)
join = String.Join(separator=code_block_14, string0=remove_4)
flatten = List.Flatten(list=join)
length_5 = String.Length(str=flatten)
code_block_26 = CodeBlock(l=length_5) { l-1; l == 20 ? 0 : l == 8 ? -2 : -1; }
remove_5 = String.Remove(str=flatten, startIndex=code_block_26.out0, count=code_block_26.out1)
setParameterByName_4 = Element.SetParameterByName(element=all_elements_of_category_2, parameterName=code_block_13, value=remove_5)

# group: Type CHU / CHP - Section CH"10 - CHP"
code_block_27 = CodeBlock { Category.ByName("Murs"); "14 - CH Dimensions Personnalisées (b x h)"; }
all_elements_of_category_3 = ElementsOfCategory(Category=code_block_27.out0)
code_block_28 = CodeBlock { "11 - CHU 20x20ht"; "12 - CHU 20x25ht"; "13 - CHU 20x30ht"; }
code_block_29 = CodeBlock { "10 - CHP"; }
code_block_30 = CodeBlock { "Type"; }
code_block_31 = CodeBlock { "Type"; }
code_block_32 = CodeBlock { "Revit.Elements.WallType"; }
code_block_33 = CodeBlock { 0; }
code_block_34 = CodeBlock { "Dyn Section CH"; }
code_block_35 = CodeBlock { "11 - CHU 20x20ht"; "12 - CHU 20x25ht"; "13 - CHU 20x30ht"; }
code_block_36 = CodeBlock { "15 - CH Dimensions Personnalisées (b)"; "16 - CH Dimensions Personnalisées (h)"; }
code_block_37 = CodeBlock { ",00"; }
code_block_38 = CodeBlock { ",00"; }
code_block_39 = CodeBlock { "10 - CHP"; }
code_block_40 = CodeBlock { 0; }
code_block_41 = CodeBlock { "11 - CHU 20x20ht"; "12 - CHU 20x25ht"; "13 - CHU 20x30ht"; "14 - CH Dimensions Personnalisées (b x h)"; false; true; }
code_block_42 = CodeBlock { "Dyn Type CH"; }
code_block_43 = CodeBlock { "2 - Niveau Batiment"; "16 - CH Dimensions Personnalisées (h)"; "Identifiant"; }
code_block_44 = CodeBlock { "20 - Acrotère"; }
code_block_45 = CodeBlock { "15 - CH Dimensions Personnalisées (b)"; "16 - CH Dimensions Personnalisées (h)"; }
code_block_46 = CodeBlock { ",00"; }
code_block_47 = CodeBlock { ",00"; }
code_block_48 = CodeBlock { "15 - CH Dimensions Personnalisées (b)"; }

type_2 = Object.Type(obj=all_elements_of_category_3)
code_block_49 = CodeBlock { "Revit.Elements.Wall"; }
contains_3 = String.Contains(str=type_2, searchFor=code_block_49)
filterByBoolMask_3 = List.FilterByBoolMask(list=all_elements_of_category_3, mask=contains_3)

# group (continued): Type CHU / CHP - Section CH"10 - CHP"
getParameterValueByName_3 = Element.GetParameterValueByName(element=filterByBoolMask_3.in, parameterName=code_block_27.out1)
getParameterValueByName_4 = Element.GetParameterValueByName(element=filterByBoolMask_3.in, parameterName=code_block_28.out0)
getParameterValueByName_5 = Element.GetParameterValueByName(element=filterByBoolMask_3.in, parameterName=code_block_28.out1)
getParameterValueByName_6 = Element.GetParameterValueByName(element=filterByBoolMask_3.in, parameterName=code_block_28.out2)
code_block_50 = CodeBlock(dimPerso=getParameterValueByName_3, chu1=getParameterValueByName_4, chu2=getParameterValueByName_5, chu3=getParameterValueByName_6)
# ---------- code_block_50.designscript (4 lines) ----------
dimPerso == 1 &&
chu1 != 1 &&
chu2 != 1 &&
chu3 != 1;
# ----------------------------------------
filterByBoolMask_4 = List.FilterByBoolMask(list=filterByBoolMask_3.in, mask=code_block_50)
getParameterValueByName_7 = Element.GetParameterValueByName(element=filterByBoolMask_4.out, parameterName=code_block_29)
getParameterValueByName_8 = Element.GetParameterValueByName(element=filterByBoolMask_3.in, parameterName=code_block_30)
getParameterValueByName_9 = Element.GetParameterValueByName(element=filterByBoolMask_4.out, parameterName=code_block_31)
type_3 = Object.Type(obj=getParameterValueByName_9)
contains_4 = String.Contains(str=type_3, searchFor=code_block_32)
filterByBoolMask_5 = List.FilterByBoolMask(list=getParameterValueByName_8, mask=contains_4)
code_block_51 = CodeBlock(e=filterByBoolMask_5.in) { e.Name; "-"; }
split = String.Split(str=code_block_51.out0, separator0=code_block_51.out1)
getItemAtIndex_3 = List.GetItemAtIndex(list=split@L2, index=code_block_33)
code_block_52 = CodeBlock(chp=getParameterValueByName_7, type=getItemAtIndex_3)
# ---------- code_block_52.designscript (3 lines) ----------
chp != 1 &&
(type == "MAP" ||
type == "MAC");
# ----------------------------------------
filterByBoolMask_6 = List.FilterByBoolMask(list=filterByBoolMask_4.out, mask=code_block_52)
getParameterValueByName_10 = Element.GetParameterValueByName(element=filterByBoolMask_6.in, parameterName=code_block_35.out0)
getParameterValueByName_11 = Element.GetParameterValueByName(element=filterByBoolMask_6.in, parameterName=code_block_35.out1)
getParameterValueByName_12 = Element.GetParameterValueByName(element=filterByBoolMask_6.in, parameterName=code_block_35.out2)
code_block_53 = CodeBlock(chu1=getParameterValueByName_10, chu2=getParameterValueByName_11, chu3=getParameterValueByName_12)
# ---------- code_block_53.designscript (4 lines) ----------
chu1 ? "20x20ht":
	chu2 ? "20x25ht" :
		chu3 ? "20x30ht":
			"??x??ht";
# ----------------------------------------
setParameterByName_5 = Element.SetParameterByName(element=filterByBoolMask_6.in, parameterName=code_block_34, value=code_block_53)
getParameterValueByName_13 = Element.GetParameterValueByName(element=filterByBoolMask_4.in, parameterName=code_block_36.out0)
code_block_54 = CodeBlock(b=getParameterValueByName_13) { ""+b; }
length_6 = String.Length(str=code_block_54)
code_block_55 = CodeBlock(x=length_6) { x-1; }
contains_5 = String.Contains(str=code_block_54, searchFor=code_block_37)
code_block_56 = CodeBlock(a=contains_5)  # same code as code_block_7
remove_6 = String.Remove(str=code_block_54, startIndex=code_block_55, count=code_block_56.out1)
getParameterValueByName_14 = Element.GetParameterValueByName(element=filterByBoolMask_4.in, parameterName=code_block_36.out1)
code_block_57 = CodeBlock(h=getParameterValueByName_14) { ""+h; }
length_7 = String.Length(str=code_block_57)
code_block_58 = CodeBlock(x=length_7) { x-1; }
contains_6 = String.Contains(str=code_block_57, searchFor=code_block_38)
code_block_59 = CodeBlock(a=contains_6)  # same code as code_block_7
remove_7 = String.Remove(str=code_block_57, startIndex=code_block_58, count=code_block_59.out1)
code_block_60 = CodeBlock(b=remove_6, h=remove_7) { b+"x"+h+"ht"; }
setParameterByName_6 = Element.SetParameterByName(element=filterByBoolMask_4.in, parameterName=code_block_34, value=code_block_60)
getParameterValueByName_15 = Element.GetParameterValueByName(element=filterByBoolMask_3.in, parameterName=code_block_39)
code_block_61 = CodeBlock(e=getParameterValueByName_8) { e.Name; "-"; }
split_2 = String.Split(str=code_block_61.out0, separator0=code_block_61.out1)
getItemAtIndex_4 = List.GetItemAtIndex(list=split_2@L2, index=code_block_40)
code_block_62 = CodeBlock(chp=getParameterValueByName_15, type=getItemAtIndex_4) { chp == 1 && (type == "MAP" || type == "MAC"); }
filterByBoolMask_7 = List.FilterByBoolMask(list=filterByBoolMask_3.in, mask=code_block_62)
setParameterByName_7 = Element.SetParameterByName(element=filterByBoolMask_7.in, parameterName=code_block_41.out0, value=code_block_41.out4)
setParameterByName_8 = Element.SetParameterByName(element=filterByBoolMask_7.in, parameterName=code_block_41.out2, value=code_block_41.out4)
setParameterByName_9 = Element.SetParameterByName(element=filterByBoolMask_7.in, parameterName=code_block_41.out1, value=code_block_41.out4)
setParameterByName_10 = Element.SetParameterByName(element=filterByBoolMask_7.in, parameterName=code_block_41.out3, value=code_block_41.out5)
getParameterValueByName_16 = Element.GetParameterValueByName(element=filterByBoolMask_3.in, parameterName=code_block_43.out0)
getParameterValueByName_17 = Element.GetParameterValueByName(element=filterByBoolMask_3.in, parameterName=code_block_43.out2)
getParameterValueByName_18 = Element.GetParameterValueByName(element=filterByBoolMask_3.in, parameterName=code_block_44)
getParameterValueByName_19 = Element.GetParameterValueByName(element=filterByBoolMask_3.in, parameterName=code_block_43.out1)
getParameterValueByName_20 = Element.GetParameterValueByName(element=filterByBoolMask_3.in, parameterName=code_block_45.out0)
code_block_63 = CodeBlock(b=getParameterValueByName_20) { ""+b; }
length_8 = String.Length(str=code_block_63)
code_block_64 = CodeBlock(x=length_8) { x-1; }
contains_7 = String.Contains(str=code_block_63, searchFor=code_block_46)
code_block_65 = CodeBlock(a=contains_7)  # same code as code_block_7
remove_8 = String.Remove(str=code_block_63, startIndex=code_block_64, count=code_block_65.out1)
getParameterValueByName_21 = Element.GetParameterValueByName(element=filterByBoolMask_3.in, parameterName=code_block_45.out1)
code_block_66 = CodeBlock(h=getParameterValueByName_21) { ""+h; }
length_9 = String.Length(str=code_block_66)
code_block_67 = CodeBlock(x=length_9) { x-1; }
contains_8 = String.Contains(str=code_block_66, searchFor=code_block_47)
code_block_68 = CodeBlock(a=contains_8)  # same code as code_block_7
remove_9 = String.Remove(str=code_block_66, startIndex=code_block_67, count=code_block_68.out1)
code_block_69 = CodeBlock(b=remove_8, h=remove_9) { b+h; }
code_block_70 = CodeBlock(elv=getParameterValueByName_16, chp=getParameterValueByName_15, id=getParameterValueByName_17, ep=getParameterValueByName_19)
# ---------- code_block_70.designscript (8 lines) ----------
elv == "FD" && chp == 1 ? "CHP"+id:
elv != "FD" && chp == 1 && ep <= 17 ? "CHPA":
elv != "FD" && chp == 1 && ep >= 18 && ep <= 20 ? "CHPB":
elv != "FD" && chp == 1 && ep >= 21 && ep <= 25 ? "CHPC":
elv != "FD" && chp == 1 && ep >= 26 && ep <= 30 ? "CHPD":
"";

"Dyn Type CHP";
# ----------------------------------------
setParameterByName_11 = Element.SetParameterByName(element=filterByBoolMask_3.in, parameterName=code_block_70.out1, value=code_block_70.out0)
python_script_3 = Python(IN[0]=filterByBoolMask_3.in)
# ---------- python_script_3.python (17 lines) ----------
import clr

#Import the Revit API
clr.AddReference('RevitAPI')
import Autodesk
from Autodesk.Revit.DB import *

#Start scripting here:

walls = UnwrapElement(IN[0])

output = []

for i in walls:
	output.append(UnitUtils.ConvertFromInternalUnits(i.Width, DisplayUnitType.DUT_CENTIMETERS))

OUT = output
# ----------------------------------------
setParameterByName_12 = Element.SetParameterByName(element=filterByBoolMask_3.in, parameterName=code_block_48, value=python_script_3)

# group: Initialisation info Murs
code_block_71 = CodeBlock()
# ---------- code_block_71.designscript (33 lines) ----------
"10 - CHP";


"11 - CHU 20x20ht";


"12 - CHU 20x25ht";


"13 - CHU 20x30ht";

Category.ByName("Murs");

"14 - CH Dimensions Personnalisées (b x h)";


"15 - CH Dimensions Personnalisées (b)";


"16 - CH Dimensions Personnalisées (h)";


"17 - CHr1 20x10ht";


"18 - CHr2 20x15ht";


"19 - CHr3 20x20ht";

"20 - Acrotère";

"21 - Relevé";
# ----------------------------------------
all_elements_of_category_4 = ElementsOfCategory(Category=code_block_71.out4)
getParameterValueByName_22 = Element.GetParameterValueByName(element=all_elements_of_category_4, parameterName=code_block_71.out0)
code_block_72 = CodeBlock(chp=getParameterValueByName_22) { chp == ""; }
filterByBoolMask_8 = List.FilterByBoolMask(list=all_elements_of_category_4, mask=code_block_72)
code_block_73 = CodeBlock { false; }
setParameterByName_13 = Element.SetParameterByName(element=filterByBoolMask_8.in, parameterName=code_block_71.out0, value=code_block_73)
getParameterValueByName_23 = Element.GetParameterValueByName(element=all_elements_of_category_4, parameterName=code_block_71.out1)
code_block_74 = CodeBlock(chu2020=getParameterValueByName_23) { chu2020 == ""; }
filterByBoolMask_9 = List.FilterByBoolMask(list=all_elements_of_category_4, mask=code_block_74)
code_block_75 = CodeBlock { false; }
setParameterByName_14 = Element.SetParameterByName(element=filterByBoolMask_9.in, parameterName=code_block_71.out1, value=code_block_75)
getParameterValueByName_24 = Element.GetParameterValueByName(element=all_elements_of_category_4, parameterName=code_block_71.out2)
code_block_76 = CodeBlock(chu2025=getParameterValueByName_24) { chu2025 == ""; }
filterByBoolMask_10 = List.FilterByBoolMask(list=all_elements_of_category_4, mask=code_block_76)
code_block_77 = CodeBlock { false; }
setParameterByName_15 = Element.SetParameterByName(element=filterByBoolMask_10.in, parameterName=code_block_71.out2, value=code_block_77)
getParameterValueByName_25 = Element.GetParameterValueByName(element=all_elements_of_category_4, parameterName=code_block_71.out3)
code_block_78 = CodeBlock(chu2030=getParameterValueByName_25) { chu2030 == ""; }
filterByBoolMask_11 = List.FilterByBoolMask(list=all_elements_of_category_4, mask=code_block_78)
code_block_79 = CodeBlock { false; }
setParameterByName_16 = Element.SetParameterByName(element=filterByBoolMask_11.in, parameterName=code_block_71.out3, value=code_block_79)
getParameterValueByName_26 = Element.GetParameterValueByName(element=all_elements_of_category_4, parameterName=code_block_71.out5)
code_block_80 = CodeBlock(chPerso=getParameterValueByName_26) { chPerso == ""; }
filterByBoolMask_12 = List.FilterByBoolMask(list=all_elements_of_category_4, mask=code_block_80)
code_block_81 = CodeBlock { false; }
setParameterByName_17 = Element.SetParameterByName(element=filterByBoolMask_12.in, parameterName=code_block_71.out5, value=code_block_81)
getParameterValueByName_27 = Element.GetParameterValueByName(element=all_elements_of_category_4, parameterName=code_block_71.out6)
code_block_82 = CodeBlock(chPersoB=getParameterValueByName_27) { chPersoB == ""; }
filterByBoolMask_13 = List.FilterByBoolMask(list=all_elements_of_category_4, mask=code_block_82)
code_block_83 = CodeBlock { 0; }
setParameterByName_18 = Element.SetParameterByName(element=filterByBoolMask_13.in, parameterName=code_block_71.out6, value=code_block_83)
getParameterValueByName_28 = Element.GetParameterValueByName(element=all_elements_of_category_4, parameterName=code_block_71.out7)
code_block_84 = CodeBlock(chPersoB=getParameterValueByName_28) { chPersoB == ""; }
filterByBoolMask_14 = List.FilterByBoolMask(list=all_elements_of_category_4, mask=code_block_84)
code_block_85 = CodeBlock { 0; }
setParameterByName_19 = Element.SetParameterByName(element=filterByBoolMask_14.in, parameterName=code_block_71.out7, value=code_block_85)
getParameterValueByName_29 = Element.GetParameterValueByName(element=all_elements_of_category_4, parameterName=code_block_71.out8)
code_block_86 = CodeBlock(chr1=getParameterValueByName_29) { chr1 == ""; }
filterByBoolMask_15 = List.FilterByBoolMask(list=all_elements_of_category_4, mask=code_block_86)
code_block_87 = CodeBlock { 0; }
setParameterByName_20 = Element.SetParameterByName(element=filterByBoolMask_15.in, parameterName=code_block_71.out8, value=code_block_87)
getParameterValueByName_30 = Element.GetParameterValueByName(element=all_elements_of_category_4, parameterName=code_block_71.out9)
code_block_88 = CodeBlock(chr2=getParameterValueByName_30) { chr2 == ""; }
filterByBoolMask_16 = List.FilterByBoolMask(list=all_elements_of_category_4, mask=code_block_88)
code_block_89 = CodeBlock { 0; }
setParameterByName_21 = Element.SetParameterByName(element=filterByBoolMask_16.in, parameterName=code_block_71.out9, value=code_block_89)
getParameterValueByName_31 = Element.GetParameterValueByName(element=all_elements_of_category_4, parameterName=code_block_71.out10)
code_block_90 = CodeBlock(chr3=getParameterValueByName_31) { chr3 == ""; }
filterByBoolMask_17 = List.FilterByBoolMask(list=all_elements_of_category_4, mask=code_block_90)
code_block_91 = CodeBlock { 0; }
setParameterByName_22 = Element.SetParameterByName(element=filterByBoolMask_17.in, parameterName=code_block_71.out10, value=code_block_91)
code_block_92 = CodeBlock { "Niv. A"; "Long. A"; "Section A"; Category.ByName("Murs"); "Niv. B"; "Long. B"; "Section B"; "Long. CHP1a"; }
all_elements_of_category_5 = ElementsOfCategory(Category=code_block_92.out3)
getParameterValueByName_32 = Element.GetParameterValueByName(element=all_elements_of_category_5, parameterName=code_block_92.out0)
code_block_93 = CodeBlock(nivA=getParameterValueByName_32) { nivA == ""; }
filterByBoolMask_18 = List.FilterByBoolMask(list=all_elements_of_category_5, mask=code_block_93)
code_block_94 = CodeBlock { 0; }
setParameterByName_23 = Element.SetParameterByName(element=filterByBoolMask_18.in, parameterName=code_block_92.out0, value=code_block_94)
getParameterValueByName_33 = Element.GetParameterValueByName(element=all_elements_of_category_5, parameterName=code_block_92.out1)
code_block_95 = CodeBlock(longA=getParameterValueByName_33) { longA == ""; }
filterByBoolMask_19 = List.FilterByBoolMask(list=all_elements_of_category_5, mask=code_block_95)
code_block_96 = CodeBlock { 0; }
setParameterByName_24 = Element.SetParameterByName(element=filterByBoolMask_19.in, parameterName=code_block_92.out1, value=code_block_96)
getParameterValueByName_34 = Element.GetParameterValueByName(element=all_elements_of_category_5, parameterName=code_block_92.out2)
code_block_97 = CodeBlock(sectA=getParameterValueByName_34) { sectA == ""; }
filterByBoolMask_20 = List.FilterByBoolMask(list=all_elements_of_category_5, mask=code_block_97)
code_block_98 = CodeBlock { "?x?ht"; }
setParameterByName_25 = Element.SetParameterByName(element=filterByBoolMask_20.in, parameterName=code_block_92.out2, value=code_block_98)
getParameterValueByName_35 = Element.GetParameterValueByName(element=all_elements_of_category_5, parameterName=code_block_92.out6)
code_block_99 = CodeBlock(sectB=getParameterValueByName_35) { sectB == ""; }
filterByBoolMask_21 = List.FilterByBoolMask(list=all_elements_of_category_5, mask=code_block_99)
code_block_100 = CodeBlock { "?x?ht"; }
setParameterByName_26 = Element.SetParameterByName(element=filterByBoolMask_21.in, parameterName=code_block_92.out6, value=code_block_100)
getParameterValueByName_36 = Element.GetParameterValueByName(element=all_elements_of_category_5, parameterName=code_block_92.out5)
code_block_101 = CodeBlock(longB=getParameterValueByName_36) { longB == ""; }
filterByBoolMask_22 = List.FilterByBoolMask(list=all_elements_of_category_5, mask=code_block_101)
code_block_102 = CodeBlock { 0; }
setParameterByName_27 = Element.SetParameterByName(element=filterByBoolMask_22.in, parameterName=code_block_92.out5, value=code_block_102)
getParameterValueByName_37 = Element.GetParameterValueByName(element=all_elements_of_category_5, parameterName=code_block_92.out4)
code_block_103 = CodeBlock(nivB=getParameterValueByName_37) { nivB == ""; }
filterByBoolMask_23 = List.FilterByBoolMask(list=all_elements_of_category_5, mask=code_block_103)
code_block_104 = CodeBlock { 0; }
setParameterByName_28 = Element.SetParameterByName(element=filterByBoolMask_23.in, parameterName=code_block_92.out4, value=code_block_104)
getParameterValueByName_38 = Element.GetParameterValueByName(element=all_elements_of_category_5, parameterName=code_block_92.out7)
code_block_105 = CodeBlock(chp1a=getParameterValueByName_38) { chp1a == ""; }
filterByBoolMask_24 = List.FilterByBoolMask(list=all_elements_of_category_5, mask=code_block_105)
code_block_106 = CodeBlock { 0; }
setParameterByName_29 = Element.SetParameterByName(element=filterByBoolMask_24.in, parameterName=code_block_92.out7, value=code_block_106)

# group: Section Alt A + B
code_block_107 = CodeBlock { Category.ByName("Murs"); "Section A"; "Section B"; }
all_elements_of_category_6 = ElementsOfCategory(Category=code_block_107.out0)
code_block_108 = CodeBlock { "Dyn REP Sect. A"; "Dyn REP Sect. B"; }
getParameterValueByName_39 = Element.GetParameterValueByName(element=all_elements_of_category_6, parameterName=code_block_107.out1)
code_block_109 = CodeBlock(sectA=getParameterValueByName_39)
# ---------- code_block_109.designscript (34 lines) ----------
sectA == "20x20ht" ||
sectA == "20x20.5ht" ||
sectA == "20x21ht" ||
sectA == "20x21.5ht" ||
sectA == "20x22ht" ||
sectA == "20x22.5ht" ||
sectA == "20x23ht" ||
sectA == "20x23.5ht" ||
sectA == "20x24ht" ||
sectA == "20x24.5ht"
? "CHU1":
	sectA == "20x25ht" ||
	sectA == "20x25.5ht" ||
	sectA == "20x26ht" ||
	sectA == "20x26.5ht" ||
	sectA == "20x27ht" ||
	sectA == "20x27.5ht" ||
	sectA == "20x28ht" ||
	sectA == "20x28.5ht" ||
	sectA == "20x29ht" ||
	sectA == "20x29.5ht"
	? "CHU2":
		sectA == "20x30ht" ||
		sectA == "20x30.5ht" ||
		sectA == "20x31ht" ||
		sectA == "20x31.5ht" ||
		sectA == "20x32ht" ||
		sectA == "20x32.5ht" ||
		sectA == "20x33ht" ||
		sectA == "20x33.5ht" ||
		sectA == "20x34ht" ||
		sectA == "20x34.5ht"
		? "CHU3":
			"";
# ----------------------------------------
setParameterByName_30 = Element.SetParameterByName(element=all_elements_of_category_6, parameterName=code_block_108.out0, value=code_block_109)
getParameterValueByName_40 = Element.GetParameterValueByName(element=all_elements_of_category_6, parameterName=code_block_107.out2)
code_block_110 = CodeBlock(sectB=getParameterValueByName_40)
# ---------- code_block_110.designscript (34 lines) ----------
sectB == "20x20ht" ||
sectB == "20x20.5ht" ||
sectB == "20x21ht" ||
sectB == "20x21.5ht" ||
sectB == "20x22ht" ||
sectB == "20x22.5ht" ||
sectB == "20x23ht" ||
sectB == "20x23.5ht" ||
sectB == "20x24ht" ||
sectB == "20x24.5ht"
? "CHU1":
	sectB == "20x25ht" ||
	sectB == "20x25.5ht" ||
	sectB == "20x26ht" ||
	sectB	== "20x26.5ht" ||
	sectB == "20x27ht" ||
	sectB == "20x27.5ht" ||
	sectB == "20x28ht" ||
	sectB == "20x28.5ht" ||
	sectB == "20x29ht" ||
	sectB == "20x29.5ht"
	? "CHU2":
		sectB == "20x30ht" ||
		sectB == "20x30.5ht" ||
		sectB == "20x31ht" ||
		sectB == "20x31.5ht" ||
		sectB == "20x32ht" ||
		sectB == "20x32.5ht" ||
		sectB == "20x33ht" ||
		sectB == "20x33.5ht" ||
		sectB == "20x34ht" ||
		sectB == "20x34.5ht"
		? "CHU3":
			"";
# ----------------------------------------
setParameterByName_31 = Element.SetParameterByName(element=all_elements_of_category_6, parameterName=code_block_108.out1, value=code_block_110)

code_block_111 = CodeBlock { "21 - Relevé"; }
getParameterValueByName_41 = Element.GetParameterValueByName(element=filterByBoolMask_3.in, parameterName=code_block_111)

# group (continued): Type CHU / CHP - Section CH"10 - CHP"
code_block_112 = CodeBlock(chp=getParameterValueByName_15, type=getItemAtIndex_4, elv=getParameterValueByName_16, id=getParameterValueByName_17, ac=getParameterValueByName_18, rlv=getParameterValueByName_41, ep=getParameterValueByName_19, chu1=getParameterValueByName_4, perso=code_block_69, chu2=getParameterValueByName_5, chu3=getParameterValueByName_6)
# ---------- code_block_112.designscript (15 lines) ----------
chp == 1 && (type == "MAP" || type == "MAC") && elv == "FD" ? "CHP"+id:
ac == 1 && elv != "FD" ? "AC"+id:
rlv == 1 && elv != "FD" ? "RE"+id:
chp == 1 && (type == "MAP" || type == "MAC") && elv != "FD" && ep <= 17 ? "CHPA":
chp == 1 && (type == "MAP" || type == "MAC") && elv != "FD" && ep >= 18 && ep <= 20 ? "CHPB":
chp == 1 && (type == "MAP" || type == "MAC") && elv != "FD" && ep >= 21 && ep <= 25 ? "CHPC":
chp == 1 && (type == "MAP" || type == "MAC") && elv != "FD" && ep >= 26 && ep <= 30 ? "CHPD":
chp == 1 && (type == "MAP" || type == "MAC") && elv != "FD" ? "CHP"+id:
chp == 0 && (type == "MAP" || type == "MAC") && (chu1 || perso == "2020" || perso == "2020,50" || perso == "2021" || perso == "2021,50" || perso == "2022" || perso == "2022,50" ||perso == "2023" || perso == "2023,50" || perso == "2024" || perso == "2024,50") ? "CHU1" :
chp == 0 && (type == "MAP" || type == "MAC") && (chu2  || perso == "2025" || perso == "2025,50" || perso == "2026" || perso == "2026,50" || perso == "2027" || perso == "2027,50" || perso == "2028" || perso == "2028,50" || perso == "2029" || perso == "2029,50")? "CHU2" :
chp == 0 && (type == "MAP" || type == "MAC") && (chu3 || perso == "2030" || perso == "2030,50" || perso == "2031" || perso == "2031,50" || perso == "2032" || perso == "2032,50" || perso == "2033" || perso == "2033,50" || perso == "2034" || perso == "2034,50") ? "CHU3":
chp == 0 && (type == "MAP" || type == "MAC") ? "CHU" :
type == "VB" ? "CH" :
type == "EXISTANT" ? "EXISTANT":
"V"+id;
# ----------------------------------------
setParameterByName_32 = Element.SetParameterByName(element=filterByBoolMask_3.in, parameterName=code_block_42, value=code_block_112)

# group: LG CHU / CHP
code_block_113 = CodeBlock { "Dyn Type CH"; }
getParameterValueByName_42 = Element.GetParameterValueByName(element=setParameterByName_32, parameterName=code_block_113, lacing=CrossProduct)
python_script_4 = Python(IN[0]=getParameterValueByName_42)
# ---------- python_script_4.python (18 lines) ----------
# Charger les bibliothèques DesignScript et Standard Python
import sys
import clr
clr.AddReference('ProtoGeometry')
from Autodesk.DesignScript.Geometry import *

# Les entrées effectuées dans ce noeud sont stockées sous forme de liste dans les variables IN.
dataEnteringNode = IN

ch = IN[0]
out = []

# Placer votre code au-dessous de cette ligne
for i in range(len(ch)):
	out.append(True if "V" in ch[i] or ch[i] == "CH" else False)

# Affectez la sortie à la variable OUT.
OUT = out
# ----------------------------------------
filterByBoolMask_25 = List.FilterByBoolMask(list=setParameterByName_32, mask=python_script_4)
code_block_114 = CodeBlock { "Dyn Type CH"; }
getParameterValueByName_43 = Element.GetParameterValueByName(element=filterByBoolMask_25.out, parameterName=code_block_114, lacing=CrossProduct)
code_block_115 = CodeBlock { "Longueur"; "Dyn REP Sect. A"; "Long. A"; "Dyn REP Sect. B"; "Long. B"; }
getParameterValueByName_44 = Element.GetParameterValueByName(element=filterByBoolMask_25.out, parameterName=code_block_115.out0, lacing=CrossProduct)
code_block_116 = CodeBlock { "CHP"; }
startsWith = String.StartsWith(str=getParameterValueByName_43, searchFor=code_block_116)
code_block_117 = CodeBlock(base=getParameterValueByName_43, lgBase=getParameterValueByName_44, CHP=startsWith) { base == "CHU1" ? lgBase : 0; base == "CHU2" ? lgBase : 0; base == "CHU3" ? lgBase : 0; CHP ? lgBase : 0; }
getParameterValueByName_45 = Element.GetParameterValueByName(element=filterByBoolMask_25.out, parameterName=code_block_115.out1, lacing=CrossProduct)
getParameterValueByName_46 = Element.GetParameterValueByName(element=filterByBoolMask_25.out, parameterName=code_block_115.out2, lacing=CrossProduct)
code_block_118 = CodeBlock(altA=getParameterValueByName_45, lgAltA=getParameterValueByName_46) { altA == "CHU1" ? lgAltA : 0; altA == "CHU2" ? lgAltA : 0; altA == "CHU3" ? lgAltA : 0; }
getParameterValueByName_47 = Element.GetParameterValueByName(element=filterByBoolMask_25.out, parameterName=code_block_115.out3, lacing=CrossProduct)
getParameterValueByName_48 = Element.GetParameterValueByName(element=filterByBoolMask_25.out, parameterName=code_block_115.out4, lacing=CrossProduct)
code_block_119 = CodeBlock(altB=getParameterValueByName_47, lgAltB=getParameterValueByName_48) { altB == "CHU1" ? lgAltB : 0; altB == "CHU2" ? lgAltB : 0; altB == "CHU3" ? lgAltB : 0; }
code_block_120 = CodeBlock(chu1Base=code_block_117.out0, chu1AltA=code_block_118.out0, chu1AltB=code_block_119.out0, chu2Base=code_block_117.out1, chu2AltA=code_block_118.out1, chu2AltB=code_block_119.out1, chu3Base=code_block_117.out2, chu3AltA=code_block_118.out2, chu3AltB=code_block_119.out2, chpBase=code_block_117.out3)
# ---------- code_block_120.designscript (15 lines) ----------
//CHU1
"Dyn Long. CHU1";
chu1Base+chu1AltA+chu1AltB;

//CHU2
"Dyn Long. CHU2";
chu2Base+chu2AltA+chu2AltB;

//CHU3
"Dyn Long. CHU3";
chu3Base+chu3AltA+chu3AltB;

//CHP
"Dyn Long. CHP";
chpBase;
# ----------------------------------------
setParameterByName_33 = Element.SetParameterByName(element=filterByBoolMask_25.out, parameterName=code_block_120.out0, value=code_block_120.out1)
setParameterByName_34 = Element.SetParameterByName(element=filterByBoolMask_25.out, parameterName=code_block_120.out6, value=code_block_120.chpBase)
setParameterByName_35 = Element.SetParameterByName(element=filterByBoolMask_25.out, parameterName=code_block_120.out4, value=code_block_120.out5)
setParameterByName_36 = Element.SetParameterByName(element=filterByBoolMask_25.out, parameterName=code_block_120.out2, value=code_block_120.out3)
code_block_121 = CodeBlock { "11 - CHU 20x20ht"; "12 - CHU 20x25ht"; "13 - CHU 20x30ht"; "10 - CHP"; }
getParameterValueByName_49 = Element.GetParameterValueByName(element=filterByBoolMask_25.in, parameterName=code_block_121.out3)
getParameterValueByName_50 = Element.GetParameterValueByName(element=filterByBoolMask_25.in, parameterName=code_block_121.out0)
code_block_122 = CodeBlock { "15 - CH Dimensions Personnalisées (b)"; "16 - CH Dimensions Personnalisées (h)"; }
getParameterValueByName_51 = Element.GetParameterValueByName(element=filterByBoolMask_25.in, parameterName=code_block_122.out0)
code_block_123 = CodeBlock(b=getParameterValueByName_51) { ""+b; }
length_10 = String.Length(str=code_block_123)
code_block_124 = CodeBlock(x=length_10) { x-1; }
code_block_125 = CodeBlock { ",00"; }
contains_9 = String.Contains(str=code_block_123, searchFor=code_block_125)
code_block_126 = CodeBlock(a=contains_9)  # same code as code_block_7
remove_10 = String.Remove(str=code_block_123, startIndex=code_block_124, count=code_block_126.out1)
getParameterValueByName_52 = Element.GetParameterValueByName(element=filterByBoolMask_25.in, parameterName=code_block_122.out1)
code_block_127 = CodeBlock(h=getParameterValueByName_52) { ""+h; }
length_11 = String.Length(str=code_block_127)
code_block_128 = CodeBlock(x=length_11) { x-1; }
code_block_129 = CodeBlock { ",00"; }
contains_10 = String.Contains(str=code_block_127, searchFor=code_block_129)
code_block_130 = CodeBlock(a=contains_10)  # same code as code_block_7
remove_11 = String.Remove(str=code_block_127, startIndex=code_block_128, count=code_block_130.out1)
code_block_131 = CodeBlock(b=remove_10, h=remove_11) { b+h; }
getParameterValueByName_53 = Element.GetParameterValueByName(element=filterByBoolMask_25.in, parameterName=code_block_121.out1)
getParameterValueByName_54 = Element.GetParameterValueByName(element=filterByBoolMask_25.in, parameterName=code_block_121.out2)
code_block_132 = CodeBlock(chp=getParameterValueByName_49, chu1=getParameterValueByName_50, perso=code_block_131, chu2=getParameterValueByName_53, chu3=getParameterValueByName_54)
# ---------- code_block_132.designscript (6 lines) ----------
chp ? "CHP" :
chu1 || perso == "2020" || perso == "2020,50" || perso == "2021" || perso == "2021,50" || perso == "2022" || perso == "2022,50" ||perso == "2023" || perso == "2023,50" || perso == "2024" || perso == "2024,50" ? "CHU1" :
chu2 || perso == "2025" || perso == "2025,50" || perso == "2026" || perso == "2026,50" || perso == "2027" || perso == "2027,50" || perso == "2028" || perso == "2028,50" || perso == "2029" || perso == "2029,50" ? "CHU2" :
chu3 || perso == "2030" || perso == "2030,50" || perso == "2031" || perso == "2031,50" || perso == "2032" || perso == "2032,50" || perso == "2033" || perso == "2033,50" || perso == "2034" || perso == "2034,50" ? "CHU3" :

"";
# ----------------------------------------
code_block_133 = CodeBlock { "Longueur"; "Dyn REP Sect. A"; "Long. A"; "Dyn REP Sect. B"; "Long. B"; }
getParameterValueByName_55 = Element.GetParameterValueByName(element=filterByBoolMask_25.in, parameterName=code_block_133.out0, lacing=CrossProduct)
code_block_134 = CodeBlock(base=code_block_132, lgBase=getParameterValueByName_55) { base == "CHU1" ? lgBase : 0; base == "CHU2" ? lgBase : 0; base == "CHU3" ? lgBase : 0; base == "CHP"? lgBase : 0; }
getParameterValueByName_56 = Element.GetParameterValueByName(element=filterByBoolMask_25.in, parameterName=code_block_133.out1, lacing=CrossProduct)
getParameterValueByName_57 = Element.GetParameterValueByName(element=filterByBoolMask_25.in, parameterName=code_block_133.out2, lacing=CrossProduct)
code_block_135 = CodeBlock(altA=getParameterValueByName_56, lgAltA=getParameterValueByName_57) { altA == "CHU1" ? lgAltA : 0; altA == "CHU2" ? lgAltA : 0; altA == "CHU3" ? lgAltA : 0; }
getParameterValueByName_58 = Element.GetParameterValueByName(element=filterByBoolMask_25.in, parameterName=code_block_133.out3, lacing=CrossProduct)
getParameterValueByName_59 = Element.GetParameterValueByName(element=filterByBoolMask_25.in, parameterName=code_block_133.out4, lacing=CrossProduct)
code_block_136 = CodeBlock(altB=getParameterValueByName_58, lgAltB=getParameterValueByName_59) { altB == "CHU1" ? lgAltB : 0; altB == "CHU2" ? lgAltB : 0; altB == "CHU3" ? lgAltB : 0; }
code_block_137 = CodeBlock(chu1Base=code_block_134.out0, chu1AltA=code_block_135.out0, chu1AltB=code_block_136.out0, chu2Base=code_block_134.out1, chu2AltA=code_block_135.out1, chu2AltB=code_block_136.out1, chu3Base=code_block_134.out2, chu3AltA=code_block_135.out2, chu3AltB=code_block_136.out2, chpBase=code_block_134.out3)  # same code as code_block_120
setParameterByName_37 = Element.SetParameterByName(element=filterByBoolMask_25.in, parameterName=code_block_137.out0, value=code_block_137.out1)
setParameterByName_38 = Element.SetParameterByName(element=filterByBoolMask_25.in, parameterName=code_block_137.out2, value=code_block_137.out3)
setParameterByName_39 = Element.SetParameterByName(element=filterByBoolMask_25.in, parameterName=code_block_137.out4, value=code_block_137.out5)
setParameterByName_40 = Element.SetParameterByName(element=filterByBoolMask_25.in, parameterName=code_block_137.out6, value=code_block_137.chpBase)

# group: Longueur CHP1a
code_block_138 = CodeBlock { Category.ByName("Murs"); "Identifiant"; "Longueur"; }
all_elements_of_category_7 = ElementsOfCategory(Category=code_block_138.out0)
getParameterValueByName_60 = Element.GetParameterValueByName(element=all_elements_of_category_7, parameterName=code_block_138.out1, lacing=CrossProduct)
code_block_139 = CodeBlock(id=getParameterValueByName_60) { id == "1a" || id == "2a"; "Long. CHP1a"; }
filterByBoolMask_26 = List.FilterByBoolMask(list=all_elements_of_category_7, mask=code_block_139.out0)
getParameterValueByName_61 = Element.GetParameterValueByName(element=all_elements_of_category_7, parameterName=code_block_138.out2, lacing=CrossProduct)
filterByBoolMask_27 = List.FilterByBoolMask(list=getParameterValueByName_61, mask=code_block_139.out0)
setParameterByName_41 = Element.SetParameterByName(element=filterByBoolMask_26.in, parameterName=code_block_139.out1, value=filterByBoolMask_27.in)

getParameterValueByName_62 = Element.GetParameterValueByName(element=all_elements_of_category_4, parameterName=code_block_71.out11)
code_block_140 = CodeBlock(ac=getParameterValueByName_62) { ac == ""; }
filterByBoolMask_28 = List.FilterByBoolMask(list=all_elements_of_category_4, mask=code_block_140)
code_block_141 = CodeBlock { 0; }
setParameterByName_42 = Element.SetParameterByName(element=filterByBoolMask_28.in, parameterName=code_block_71.out11, value=code_block_141)
getParameterValueByName_63 = Element.GetParameterValueByName(element=all_elements_of_category_4, parameterName=code_block_71.out12)
code_block_142 = CodeBlock(rlv=getParameterValueByName_63) { rlv == ""; }
filterByBoolMask_29 = List.FilterByBoolMask(list=all_elements_of_category_4, mask=code_block_142)
code_block_143 = CodeBlock { 0; }
setParameterByName_43 = Element.SetParameterByName(element=filterByBoolMask_29.in, parameterName=code_block_71.out12, value=code_block_143)

# group: Reset Ajout Recouvrement Murs + Fondations
code_block_144 = CodeBlock()
# ---------- code_block_144.designscript (3 lines) ----------
[Category.ByName("Murs"),
Category.ByName("Fondations")];
"Ajout Recouvrement";
# ----------------------------------------
all_elements_of_category_8 = ElementsOfCategory(Category=code_block_144.out0)
flatten_2 = List.Flatten(list=all_elements_of_category_8)
getParameterValueByName_64 = Element.GetParameterValueByName(element=flatten_2, parameterName=code_block_144.out1)
code_block_145 = CodeBlock(recouvrement=getParameterValueByName_64) { recouvrement == ""; }
filterByBoolMask_30 = List.FilterByBoolMask(list=flatten_2, mask=code_block_145)
code_block_146 = CodeBlock { "Ajout Recouvrement"; 0; }
setParameterByName_44 = Element.SetParameterByName(element=filterByBoolMask_30.in, parameterName=code_block_146.out0, value=code_block_146.out1)
