# Dynamo graph DEV_A3 - Niveaux Batiment - Murs - Poteaux - R.dyn (Dynamo 2.6.1.8786)

code_block = CodeBlock()
# ---------- code_block.designscript (4 lines) ----------
[Category.ByName("Murs")];
[Category.ByName("Poteaux porteurs")];
[Category.ByName("Portes"),
Category.ByName("Fenêtres")];
# ----------------------------------------
all_elements_of_category = ElementsOfCategory(Category=code_block.out0)
code_block_2 = CodeBlock { "Contrainte inférieure"; }
getParameterValueByName = Element.GetParameterValueByName(element=all_elements_of_category, parameterName=code_block_2)
type = Object.Type(obj=getParameterValueByName)
code_block_3 = CodeBlock { "Revit.Elements.Level"; }
contains = String.Contains(str=type, searchFor=code_block_3)
filterByBoolMask = List.FilterByBoolMask(list=all_elements_of_category, mask=contains)
all_elements_of_category_2 = ElementsOfCategory(Category=code_block.out1)
all_elements_of_category_3 = ElementsOfCategory(Category=code_block.out2)
list_create = List.Create(item0=filterByBoolMask.in, item1=all_elements_of_category_2, item2=all_elements_of_category_3)
flatten = List.Flatten(list=list_create)
code_block_4 = CodeBlock(e=flatten) { e != null; }
filterByBoolMask_2 = List.FilterByBoolMask(list=flatten, mask=code_block_4)
code_block_5 = CodeBlock { "2 - Niveau Batiment"; }
filterByBoolMask_3 = List.FilterByBoolMask(list=getParameterValueByName, mask=contains)
code_block_6 = CodeBlock { "Niveau de base"; }
getParameterValueByName_2 = Element.GetParameterValueByName(element=all_elements_of_category_2, parameterName=code_block_6)
code_block_7 = CodeBlock { "Niveau"; }
getParameterValueByName_3 = Element.GetParameterValueByName(element=all_elements_of_category_3, parameterName=code_block_7)
list_create_2 = List.Create(item0=filterByBoolMask_3.in, item1=getParameterValueByName_2, item2=getParameterValueByName_3)
flatten_2 = List.Flatten(list=list_create_2)
code_block_8 = CodeBlock(e=flatten_2) { e != null; }
filterByBoolMask_4 = List.FilterByBoolMask(list=flatten_2, mask=code_block_8)
python_script = Python(IN[0]=filterByBoolMask_4.in)
# ---------- python_script.python (42 lines) ----------
# Charger les bibliothèques DesignScript et Standard Python
import sys
import clr
clr.AddReference('ProtoGeometry')
from Autodesk.DesignScript.Geometry import *

# Les entrées effectuées dans ce noeud sont stockées sous forme de liste dans les variables IN.
dataEnteringNode = IN
level = IN[0]

out = []

# Placer votre code au-dessous de cette ligne
for i in range(len(level)):
	
	nivBat = level[i].Name
	
	if "SS.FD" in nivBat:
		out.append("SS.FD")
	elif "SS" in nivBat:
		out.append("SS")
	elif "FD" in nivBat:
		out.append("FD")
	elif "RDC" in nivBat:
		out.append("RDC")
	elif "R+1" in nivBat:
		out.append("R+1")
	elif "R+2" in nivBat:
		out.append("R+2")
	elif "R+3" in nivBat:
		out.append("R+3")
	elif "R+4" in nivBat:
		out.append("R+4")
	elif "R+5" in nivBat:
		out.append("R+5")
	elif "R+6" in nivBat:
		out.append("R+6")
	elif "R+7" in nivBat:
		out.append("R+7")
		
# Affectez la sortie à la variable OUT.
OUT = out
# ----------------------------------------
setParameterByName = Element.SetParameterByName(element=filterByBoolMask_2.in, parameterName=code_block_5, value=python_script)
