# Dynamo graph DEV_B2 - Visibilite Reservation Murs.dyn "09 - Dyn123STR-DEV-Reservation" (Dynamo 2.6.1.8786)

# group: Epaisseur réservation si traversant
code_block = CodeBlock { Category.ByName("Modèles génériques"); "Traversant"; "Hôte"; }
all_elements_of_category = ElementsOfCategory(Category=code_block.out0)
getParameterValueByName = Element.GetParameterValueByName(element=all_elements_of_category, parameterName=code_block.out1)
code_block_2 = CodeBlock(param=getParameterValueByName) { param != 0; }
filterByBoolMask = List.FilterByBoolMask(list=all_elements_of_category, mask=code_block_2)
code_block_3 = CodeBlock { "Epaisseur Reservation"; }
getParameterValueByName_2 = Element.GetParameterValueByName(element=all_elements_of_category, parameterName=code_block.out2)
length = String.Length(str=getParameterValueByName_2)
code_block_4 = CodeBlock(x=length) { x-4; 0; }
remove = String.Remove(str=getParameterValueByName_2, startIndex=code_block_4.out1, count=code_block_4.out0)
code_block_5 = CodeBlock { 2; }
remove_2 = String.Remove(str=remove, startIndex=code_block_5, count=code_block_5)
toNumber = String.ToNumber(str=remove_2)
setParameterByName = Element.SetParameterByName(element=filterByBoolMask.in, parameterName=code_block_3, value=toNumber)

# group: Paramétrage ligne de modèle Reservation
code_block_6 = CodeBlock { Category.ByName("Modèles génériques"); "Élévation par rapport au niveau"; "Implantation"; "Niveau de nomenclature"; }
all_elements_of_category_2 = ElementsOfCategory(Category=code_block_6.out0)
code_block_7 = CodeBlock { "Longueur Ligne de modèle (haut)"; "Longueur Ligne de modèle (bas)"; }
python_script = Python(IN[0]=all_elements_of_category_2)
# ---------- python_script.python (27 lines) ----------
import clr
clr.AddReference('ProtoGeometry')
from Autodesk.DesignScript.Geometry import *

clr.AddReference('RevitAPI')
import Autodesk
from Autodesk.Revit.DB import * 

toList = lambda x : x if hasattr(x, '__iter__') else [x]
lstelems = toList(UnwrapElement(IN[0]))

def getHostLink(elem):
	hostRvt = elem.Host
	hostfaceref = elem.HostFace 
	if isinstance(hostRvt, RevitLinkInstance):
		linkdoc = hostRvt.GetLinkDocument()
		hostelem = linkdoc.GetElement(hostfaceref.LinkedElementId)
		return hostelem
	else:
		return 	hostRvt
	
lsthost = []
for elem in lstelems:
	host = getHostLink(elem)
	lsthost.append(host)
	
OUT = lsthost	
# ----------------------------------------
code_block_8 = CodeBlock { "Contrainte inférieure"; "Hauteur non contrainte"; }
getParameterValueByName_3 = Element.GetParameterValueByName(element=python_script, parameterName=code_block_8.out0)
code_block_9 = CodeBlock(lvl=getParameterValueByName_3) { lvl == "" ? 12345 : lvl.Elevation; }
round = Math.Round(number=code_block_9)
getParameterValueByName_4 = Element.GetParameterValueByName(element=all_elements_of_category_2, parameterName=code_block_6.out3)
elevation = Level.Elevation(level=getParameterValueByName_4)
round_2 = Math.Round(number=elevation)
code_block_10 = CodeBlock(fini=round_2, brut=round) { fini-brut; }
getParameterValueByName_5 = Element.GetParameterValueByName(element=all_elements_of_category_2, parameterName=code_block_6.out1)
round_3 = Math.Round(number=getParameterValueByName_5)
getParameterValueByName_6 = Element.GetParameterValueByName(element=all_elements_of_category_2, parameterName=code_block_6.out2)
code_block_11 = CodeBlock(lvlInf=round, deltaFiniBrut=code_block_10, offset=round_3, impl=getParameterValueByName_6) { lvlInf == 12345 ? 20 : deltaFiniBrut+offset+impl; }
setParameterByName_2 = Element.SetParameterByName(element=all_elements_of_category_2, parameterName=code_block_7.out1, value=code_block_11)
getParameterValueByName_7 = Element.GetParameterValueByName(element=python_script, parameterName=code_block_8.out1)
code_block_12 = CodeBlock(ht=getParameterValueByName_7) { ht == "" ? 0 : ht; }
round_4 = Math.Round(number=code_block_12)
code_block_13 = CodeBlock(lvl=round, ht=round_4, offset=round_3, impl=getParameterValueByName_6, deltaFiniBrut=code_block_10) { lvl == 12345 ? 20 : ht-(offset+impl+deltaFiniBrut); }
setParameterByName_3 = Element.SetParameterByName(element=all_elements_of_category_2, parameterName=code_block_7.out0, value=code_block_13)

# group: Section / Diametre Reservations
code_block_14 = CodeBlock { Category.ByName("Modèles génériques"); "A"; }
all_elements_of_category_3 = ElementsOfCategory(Category=code_block_14.out0)
getParameterValueByName_8 = Element.GetParameterValueByName(element=all_elements_of_category_3, parameterName=code_block_14.out1)
code_block_15 = CodeBlock(a=getParameterValueByName_8) { a != ""; }
filterByBoolMask_2 = List.FilterByBoolMask(list=all_elements_of_category_3, mask=code_block_15)
code_block_16 = CodeBlock { "Dyn Section Reservation"; }
code_block_17 = CodeBlock { "A"; "B"; }
getParameterValueByName_9 = Element.GetParameterValueByName(element=filterByBoolMask_2.in, parameterName=code_block_17.out0)
code_block_18 = CodeBlock(a=getParameterValueByName_9) { ""+a; }
length_2 = String.Length(str=code_block_18)
code_block_19 = CodeBlock(x=length_2) { x-1; }
code_block_20 = CodeBlock { ",00"; }
contains = String.Contains(str=code_block_18, searchFor=code_block_20)
code_block_21 = CodeBlock(a=contains)
# ---------- code_block_21.designscript (5 lines) ----------
a;

a==true ?
	-7:
	-4;
# ----------------------------------------
remove_3 = String.Remove(str=code_block_18, startIndex=code_block_19, count=code_block_21.out1)
getParameterValueByName_10 = Element.GetParameterValueByName(element=filterByBoolMask_2.in, parameterName=code_block_17.out1)
code_block_22 = CodeBlock(b=getParameterValueByName_10) { ""+b; }
length_3 = String.Length(str=code_block_22)
code_block_23 = CodeBlock(x=length_3) { x-1; }
code_block_24 = CodeBlock { ",00"; }
contains_2 = String.Contains(str=code_block_22, searchFor=code_block_24)
code_block_25 = CodeBlock(a=contains_2)  # same code as code_block_21
remove_4 = String.Remove(str=code_block_22, startIndex=code_block_23, count=code_block_25.out1)
code_block_26 = CodeBlock(a=remove_3, b=remove_4) { a+"x"+b; }
setParameterByName_4 = Element.SetParameterByName(element=filterByBoolMask_2.in, parameterName=code_block_16, value=code_block_26)
code_block_27 = CodeBlock { "Dyn Section Reservation"; }
code_block_28 = CodeBlock { "Diametre Reservation"; }
getParameterValueByName_11 = Element.GetParameterValueByName(element=filterByBoolMask_2.out, parameterName=code_block_28)
code_block_29 = CodeBlock(d=getParameterValueByName_11) { ""+d; }
length_4 = String.Length(str=code_block_29)
code_block_30 = CodeBlock(x=length_4) { x-1; }
code_block_31 = CodeBlock { ",00"; }
contains_3 = String.Contains(str=code_block_29, searchFor=code_block_31)
code_block_32 = CodeBlock(a=contains_3)  # same code as code_block_21
remove_5 = String.Remove(str=code_block_29, startIndex=code_block_30, count=code_block_32.out1)
code_block_33 = CodeBlock(d=remove_5) { "Ø"+d; }
setParameterByName_5 = Element.SetParameterByName(element=filterByBoolMask_2.out, parameterName=code_block_27, value=code_block_33)

# group: Ai Reservations REL
code_block_34 = CodeBlock { Category.ByName("Modèles génériques"); "Élévation par rapport au niveau"; "Niveau de nomenclature"; }
all_elements_of_category_4 = ElementsOfCategory(Category=code_block_34.out0)
code_block_35 = CodeBlock { "Dyn Ai Reservation REL"; }
getParameterValueByName_12 = Element.GetParameterValueByName(element=all_elements_of_category_4, parameterName=code_block_34.out2)
elevation_2 = Level.Elevation(level=getParameterValueByName_12)
round_5 = Math.Round(number=elevation_2)
getParameterValueByName_13 = Element.GetParameterValueByName(element=all_elements_of_category_4, parameterName=code_block_34.out1)
round_6 = Math.Round(number=getParameterValueByName_13)
code_block_36 = CodeBlock(lvl=round_5, offset=round_6) { lvl+offset; }
setParameterByName_6 = Element.SetParameterByName(element=all_elements_of_category_4, parameterName=code_block_35, value=code_block_36)

python_script_2 = Python()  # frozen; unwired: IN[0]; same code as python_script
