# Dynamo graph DEV_C1 - Coupe IGC - Autres.dyn (Dynamo 2.6.1.8786)
# packages: Clockwork for Dynamo 2.x 2.3.0

# group: Projet IGC ?
code_block = CodeBlock { Category.ByName("Cartouches"); "Nom de la feuille"; }
all_elements_of_category = ElementsOfCategory(Category=code_block.out0)
getParameterValueByName = Element.GetParameterValueByName(element=all_elements_of_category, parameterName=code_block.out1)
code_block_2 = CodeBlock(name=getParameterValueByName) { name=="PARAMETRAGE"; }
filterByBoolMask = List.FilterByBoolMask(list=all_elements_of_category, mask=code_block_2)
code_block_3 = CodeBlock { "IGC"; }
getParameterValueByName_2 = Element.GetParameterValueByName(element=filterByBoolMask.in, parameterName=code_block_3)

# group: Gabarit de vue IGC ? Mur1, Mur 2, Mur 3, ...
element_types = ElementTypes("ViewSection")
all_elements_of_type = ElementsOfType(element_type=element_types)
code_block_4 = CodeBlock { "Nom de la vue"; "Mur"; }
getParameterValueByName_3 = Element.GetParameterValueByName(element=all_elements_of_type, parameterName=code_block_4.out0)
startsWith = String.StartsWith(str=getParameterValueByName_3, searchFor=code_block_4.out1)
filterByBoolMask_2 = List.FilterByBoolMask(list=all_elements_of_type, mask=startsWith)
code_block_5 = CodeBlock { "Gabarit de vue"; }
name = Family.Name(family=all_elements_of_type)
code_block_6 = CodeBlock(name=name) { name == "123STR_CP"; name == "123STR_CP IGC"; }
filterByBoolMask_3 = List.FilterByBoolMask(list=all_elements_of_type, mask=code_block_6.out1)
filterByBoolMask_4 = List.FilterByBoolMask(list=all_elements_of_type, mask=code_block_6.out0)
if_ = If(test=getParameterValueByName_2, true=filterByBoolMask_3.in, false=filterByBoolMask_4.in)
setParameterByName = Element.SetParameterByName(element=filterByBoolMask_2.in, parameterName=code_block_5, value=if_, lacing=Longest)

# group: TEST - Positionnement CHU
code_block_7 = CodeBlock { Category.ByName("Murs"); }
element_types_2 = ElementTypes("ViewSection")  # frozen
all_elements_of_type_2 = ElementsOfType(element_type=element_types_2)
code_block_8 = CodeBlock { "Nom de la vue"; "Mur"; }
getParameterValueByName_4 = Element.GetParameterValueByName(element=all_elements_of_type_2, parameterName=code_block_8.out0)
startsWith_2 = String.StartsWith(str=getParameterValueByName_4, searchFor=code_block_8.out1)
filterByBoolMask_5 = List.FilterByBoolMask(list=all_elements_of_type_2, mask=startsWith_2)
all_elements_of_category_in_view = ElementsOfCategoryInView(Category=code_block_7, View=filterByBoolMask_5.in)
code_block_9 = CodeBlock { "3 - Type de chainage"; }
getParameterValueByName_5 = Element.GetParameterValueByName(element=all_elements_of_category_in_view, parameterName=code_block_9)
code_block_10 = CodeBlock { 0.5; }
code_block_11 = CodeBlock { "Hauteur non contrainte"; }
code_block_12 = CodeBlock { "123STR - CHU IGC"; "123STR - CHU"; }  # frozen
byName = FamilyType.ByName(name=code_block_12.out0)
byName_2 = FamilyType.ByName(name=code_block_12.out1)
if_2 = If(test=getParameterValueByName_2, true=byName, false=byName_2)
code_block_13 = CodeBlock { Category.ByName("Eléments de détail"); "Lg CHU"; }  # frozen
all_elements_of_category_2 = ElementsOfCategory(Category=code_block_13.out0)
getParameterValueByName_6 = Element.GetParameterValueByName(element=all_elements_of_category_2, parameterName=code_block_13.out1)
code_block_14 = CodeBlock(lg=getParameterValueByName_6) { lg != ""; }
filterByBoolMask_6 = List.FilterByBoolMask(list=all_elements_of_category_2, mask=code_block_14)
delete = Element.Delete(element=filterByBoolMask_6.in)
passthrough = Custom[Passthrough](passThrough=if_2, waitFor=delete)  # package Clockwork for Dynamo 2.x; Forces a sequential order of execution. The node wired into the output of the Passthrough node will be executed *after* the node wired into the waitFor input (e.g. important for some Revit operations). The value of the passThrough input will be passed on to the node wired into the output port of the Passthrough node.
code_block_15 = CodeBlock { "Lg CHU"; "Ht CHU"; }
code_block_16 = CodeBlock { "4 - Section chainage"; }

code_block_17 = CodeBlock(type=getParameterValueByName_5) { type == "CHU"; }

# group (continued): TEST - Positionnement CHU
filterByBoolMask_7 = List.FilterByBoolMask(list=all_elements_of_category_in_view, mask=code_block_17)
getLocation = Element.GetLocation(element=filterByBoolMask_7.in)
pointAtParameter = Curve.PointAtParameter(curve=getLocation, param=code_block_10)
X = Point.X(point=pointAtParameter)
Y = Point.Y(point=pointAtParameter)
Z = Point.Z(point=pointAtParameter)
getParameterValueByName_7 = Element.GetParameterValueByName(element=filterByBoolMask_7.in, parameterName=code_block_11)
code_block_18 = CodeBlock(z=Z, ht=getParameterValueByName_7) { z+ht; }
byCoordinates = Point.ByCoordinates(x=X, y=Y, z=code_block_18)
byPointInView = Custom[FamilyInstance.ByPointInView](point=byCoordinates, familyType=passthrough, view=filterByBoolMask_5.in, lacing=Longest)  # package Clockwork for Dynamo 2.x; Places a family instance at a given point in a given view (e.g. a detail component).
length = Curve.Length(curve=getLocation)
flatten = List.Flatten(list=filterByBoolMask_7.in)
python_script = Python(IN[0]=flatten)
# ---------- python_script.python (17 lines) ----------
import clr

#Import the Revit API
clr.AddReference('RevitAPI')
import Autodesk
from Autodesk.Revit.DB import *

#Start scripting here:

walls = UnwrapElement(IN[0])

output = []

for i in walls:
	output.append(UnitUtils.ConvertFromInternalUnits(i.Width, DisplayUnitType.DUT_CENTIMETERS))

OUT = output
# ----------------------------------------
code_block_19 = CodeBlock(len=length, width=python_script) { len+width; }
setParameterByName_2 = Element.SetParameterByName(element=byPointInView, parameterName=code_block_15.out0, value=code_block_19)  # frozen
getParameterValueByName_8 = Element.GetParameterValueByName(element=filterByBoolMask_7.in, parameterName=code_block_16)
code_block_20 = CodeBlock(str=getParameterValueByName_8) { 0; str!="" ? 3 : 0; }
remove = String.Remove(str=getParameterValueByName_8, startIndex=code_block_20.out0, count=code_block_20.out1)
code_block_21 = CodeBlock(str=remove) { str!="" ? -1 : 0; str!="" ? -2 : 0; }
remove_2 = String.Remove(str=remove, startIndex=code_block_21.out0, count=code_block_21.out1)
code_block_22 = CodeBlock(ht=remove_2) { ht == "" ? "0" : ht; }
toNumber = String.ToNumber(str=code_block_22)
setParameterByName_3 = Element.SetParameterByName(element=byPointInView, parameterName=code_block_15.out1, value=toNumber)  # frozen

# group: LT IGC
code_block_23 = CodeBlock { [Category.ByName("Fenêtres"),Category.ByName("Portes")]; "Dyn IGC"; }
all_elements_of_category_3 = ElementsOfCategory(Category=code_block_23.out0)
flatten_2 = List.Flatten(list=all_elements_of_category_3)
python_script_2 = Python(IN[0]=flatten_2)
# ---------- python_script_2.python (32 lines) ----------
import clr
clr.AddReference('RevitAPI')
from Autodesk.Revit.DB import*
clr.AddReference('RevitServices')
from RevitServices.Persistence import DocumentManager
doc = DocumentManager.Instance.CurrentDBDocument

fams = list(FilteredElementCollector(doc).OfClass(Family))
inplace = [f for f in fams if f.IsInPlace]
inPlaceCategory = [f.FamilyCategory.Name for f in inplace]
inPlaceId = [f.Id for f in inplace]
inPlaceName = [f.Name for f in inplace]


import sys
import clr
clr.AddReference('ProtoGeometry')
from Autodesk.DesignScript.Geometry import *
# Les entrées effectuées dans ce noeud sont stockées sous forme de liste dans les variables IN.
dataEnteringNode = IN
element = IN[0]

out = []

# Placer votre code au-dessous de cette ligne
for i in range(len(element)):
	if element[i].Name not in inPlaceName :
		out.append(element[i])

# Affectez la sortie à la variable OUT.
OUT = out
#OUT = category, inplace , id
# ----------------------------------------
setParameterByName_4 = Element.SetParameterByName(element=python_script_2, parameterName=code_block_23.out1, value=getParameterValueByName_2, lacing=Longest)
