# Dynamo graph DEV_D1 - Fiche Parametres.dyn (Dynamo 2.6.1.8786)
# packages: Clockwork for Dynamo 2.x 2.3.0

# group: Feuille de paramétrage
code_block = CodeBlock { Category.ByName("Cartouches"); "Nom de la feuille"; }
all_elements_of_category = ElementsOfCategory(Category=code_block.out0)
getParameterValueByName = Element.GetParameterValueByName(element=all_elements_of_category, parameterName=code_block.out1)
code_block_2 = CodeBlock(name=getParameterValueByName) { name=="PARAMETRAGE"; }
filterByBoolMask = List.FilterByBoolMask(list=all_elements_of_category, mask=code_block_2)

# group: Projet Titan ? Projet IGC ? Projet Alysia ?
code_block_3 = CodeBlock()
# ---------- code_block_3.designscript (4 lines) ----------
["SF Titan",
"IGC",
"Moustiquaire",
"Maisons Alysia"];
# ----------------------------------------
getParameterValueByName_2 = Element.GetParameterValueByName(element=filterByBoolMask.in, parameterName=code_block_3, lacing=CrossProduct)
code_block_4 = CodeBlock(l=getParameterValueByName_2) { l[0][0] == 1; l[0][1] == 1; l[0][2] == 1; l[0][3] == 1; }

# group: Ht Fondations - IGC
element_types = ElementTypes("WallFoundationType")
all_elements_of_type = ElementsOfType(element_type=element_types)
parameters = Element.Parameters(element=all_elements_of_type)
code_block_5 = CodeBlock(titan=code_block_4.out0, igc=code_block_4.out1) { "Epaisseur de fondation"; titan ? 50: igc ? 30 :25; }
setParameterByName = Element.SetParameterByName(element=all_elements_of_type, parameterName=code_block_5.out0, value=code_block_5.out1)
code_block_6 = CodeBlock(e=all_elements_of_type) { e.Name; }
code_block_7 = CodeBlock { "ht"; }
split = String.Split(str=code_block_6, separator0=code_block_7)
code_block_8 = CodeBlock { 0; }
getItemAtIndex = List.GetItemAtIndex(list=split@L2, index=code_block_8)
length = String.Length(str=getItemAtIndex)
code_block_9 = CodeBlock(l=length) { l-1; }
code_block_10 = CodeBlock { -2; }
remove = String.Remove(str=getItemAtIndex, startIndex=code_block_9, count=code_block_10)
code_block_11 = CodeBlock { 1; }
getItemAtIndex_2 = List.GetItemAtIndex(list=split@L2, index=code_block_11)
code_block_12 = CodeBlock(start=remove, ht=code_block_5.out1, end=getItemAtIndex_2) { start+ht+"ht"+end; }
setName = Custom[Element.SetName](element=setParameterByName, name=code_block_12)  # package Clockwork for Dynamo 2.x; Gets the name of a given Revit element

# group: Cartouche - Informations
code_block_13 = CodeBlock { Category.ByName("Cartouches"); "Numéro de la feuille"; }
all_elements_of_category_2 = ElementsOfCategory(Category=code_block_13.out0)
getParameterValueByName_3 = Element.GetParameterValueByName(element=all_elements_of_category_2, parameterName=code_block_13.out1)
code_block_14 = CodeBlock(name=getParameterValueByName_3)
# ---------- code_block_14.designscript (4 lines) ----------
name=="1" ||
name=="3A0" ||
name=="5A0" ||
name=="6A0";
# ----------------------------------------
filterByBoolMask_2 = List.FilterByBoolMask(list=all_elements_of_category_2, mask=code_block_14)
name = Family.Name(family=filterByBoolMask_2.in)
code_block_15 = CodeBlock(name=name) { name=="123STR - Cartouche"; }
filterByBoolMask_3 = List.FilterByBoolMask(list=filterByBoolMask_2.in, mask=code_block_15)
code_block_16 = CodeBlock()
# ---------- code_block_16.designscript (21 lines) ----------
"N° dossier Client";
"BigMat";
"Construction de l'Erdre";
"COVAL";
"IGC";
"JBAA";
"LMCR";
"Maisons Alysia";
"Maisons TEVA";
"MIKIT";
"Point P";
"POUDRY Materiaux";
"Design Habitat";
"SATOV";
"ADENOV";
"Arti Creations";
"Maisons Gochoki";
"Villas Club";

"Dessiné par";
"Vérifié par";
# ----------------------------------------
getParameterValueByName_4 = Element.GetParameterValueByName(element=filterByBoolMask.in, parameterName=code_block_16.out0)
setParameterByName_2 = Element.SetParameterByName(element=filterByBoolMask_3.in, parameterName=code_block_16.out0, value=getParameterValueByName_4, lacing=Longest)
getParameterValueByName_5 = Element.GetParameterValueByName(element=filterByBoolMask.in, parameterName=code_block_16.out19)
setParameterByName_3 = Element.SetParameterByName(element=filterByBoolMask_3.in, parameterName=code_block_16.out19, value=getParameterValueByName_5, lacing=Longest)
getParameterValueByName_6 = Element.GetParameterValueByName(element=filterByBoolMask.in, parameterName=code_block_16.out18)
setParameterByName_4 = Element.SetParameterByName(element=filterByBoolMask_3.in, parameterName=code_block_16.out18, value=getParameterValueByName_6, lacing=Longest)
getParameterValueByName_7 = Element.GetParameterValueByName(element=filterByBoolMask.in, parameterName=code_block_16.out13)
setParameterByName_5 = Element.SetParameterByName(element=filterByBoolMask_3.in, parameterName=code_block_16.out13, value=getParameterValueByName_7, lacing=Longest)
getParameterValueByName_8 = Element.GetParameterValueByName(element=filterByBoolMask.in, parameterName=code_block_16.out12)
setParameterByName_6 = Element.SetParameterByName(element=filterByBoolMask_3.in, parameterName=code_block_16.out12, value=getParameterValueByName_8, lacing=Longest)
getParameterValueByName_9 = Element.GetParameterValueByName(element=filterByBoolMask.in, parameterName=code_block_16.out11)
setParameterByName_7 = Element.SetParameterByName(element=filterByBoolMask_3.in, parameterName=code_block_16.out11, value=getParameterValueByName_9, lacing=Longest)
getParameterValueByName_10 = Element.GetParameterValueByName(element=filterByBoolMask.in, parameterName=code_block_16.out10)
setParameterByName_8 = Element.SetParameterByName(element=filterByBoolMask_3.in, parameterName=code_block_16.out10, value=getParameterValueByName_10, lacing=Longest)
getParameterValueByName_11 = Element.GetParameterValueByName(element=filterByBoolMask.in, parameterName=code_block_16.out9)
setParameterByName_9 = Element.SetParameterByName(element=filterByBoolMask_3.in, parameterName=code_block_16.out9, value=getParameterValueByName_11, lacing=Longest)
getParameterValueByName_12 = Element.GetParameterValueByName(element=filterByBoolMask.in, parameterName=code_block_16.out8)
setParameterByName_10 = Element.SetParameterByName(element=filterByBoolMask_3.in, parameterName=code_block_16.out8, value=getParameterValueByName_12, lacing=Longest)
getParameterValueByName_13 = Element.GetParameterValueByName(element=filterByBoolMask.in, parameterName=code_block_16.out7)
setParameterByName_11 = Element.SetParameterByName(element=filterByBoolMask_3.in, parameterName=code_block_16.out7, value=getParameterValueByName_13, lacing=Longest)
getParameterValueByName_14 = Element.GetParameterValueByName(element=filterByBoolMask.in, parameterName=code_block_16.out6)
setParameterByName_12 = Element.SetParameterByName(element=filterByBoolMask_3.in, parameterName=code_block_16.out6, value=getParameterValueByName_14, lacing=Longest)
getParameterValueByName_15 = Element.GetParameterValueByName(element=filterByBoolMask.in, parameterName=code_block_16.out5)
setParameterByName_13 = Element.SetParameterByName(element=filterByBoolMask_3.in, parameterName=code_block_16.out5, value=getParameterValueByName_15, lacing=Longest)
getParameterValueByName_16 = Element.GetParameterValueByName(element=filterByBoolMask.in, parameterName=code_block_16.out4)
setParameterByName_14 = Element.SetParameterByName(element=filterByBoolMask_3.in, parameterName=code_block_16.out4, value=getParameterValueByName_16, lacing=Longest)
getParameterValueByName_17 = Element.GetParameterValueByName(element=filterByBoolMask.in, parameterName=code_block_16.out3)
setParameterByName_15 = Element.SetParameterByName(element=filterByBoolMask_3.in, parameterName=code_block_16.out3, value=getParameterValueByName_17, lacing=Longest)
getParameterValueByName_18 = Element.GetParameterValueByName(element=filterByBoolMask.in, parameterName=code_block_16.out2)
setParameterByName_16 = Element.SetParameterByName(element=filterByBoolMask_3.in, parameterName=code_block_16.out2, value=getParameterValueByName_18, lacing=Longest)
getParameterValueByName_19 = Element.GetParameterValueByName(element=filterByBoolMask.in, parameterName=code_block_16.out1)
setParameterByName_17 = Element.SetParameterByName(element=filterByBoolMask_3.in, parameterName=code_block_16.out1, value=getParameterValueByName_19, lacing=Longest)
getParameterValueByName_20 = Element.GetParameterValueByName(element=filterByBoolMask.in, parameterName=code_block_16.out14)
setParameterByName_18 = Element.SetParameterByName(element=filterByBoolMask_3.in, parameterName=code_block_16.out14, value=getParameterValueByName_20, lacing=Longest)
getParameterValueByName_21 = Element.GetParameterValueByName(element=filterByBoolMask.in, parameterName=code_block_16.out15)
setParameterByName_19 = Element.SetParameterByName(element=filterByBoolMask_3.in, parameterName=code_block_16.out15, value=getParameterValueByName_21, lacing=Longest)
getParameterValueByName_22 = Element.GetParameterValueByName(element=filterByBoolMask.in, parameterName=code_block_16.out16)
setParameterByName_20 = Element.SetParameterByName(element=filterByBoolMask_3.in, parameterName=code_block_16.out16, value=getParameterValueByName_22, lacing=Longest)
getParameterValueByName_23 = Element.GetParameterValueByName(element=filterByBoolMask.in, parameterName=code_block_16.out17)
setParameterByName_21 = Element.SetParameterByName(element=filterByBoolMask_3.in, parameterName=code_block_16.out17, value=getParameterValueByName_23, lacing=Longest)

# group: Cartouche - Ville
code_block_17 = CodeBlock { "123STR Clisson"; "123STR Villefranche-sur-Saône"; "123STR Anglet"; }
getParameterValueByName_24 = Element.GetParameterValueByName(element=filterByBoolMask.in, parameterName=code_block_17.out1)
setParameterByName_22 = Element.SetParameterByName(element=filterByBoolMask_3.in, parameterName=code_block_17.out1, value=getParameterValueByName_24, lacing=Longest)
getParameterValueByName_25 = Element.GetParameterValueByName(element=filterByBoolMask.in, parameterName=code_block_17.out2)
setParameterByName_23 = Element.SetParameterByName(element=filterByBoolMask_3.in, parameterName=code_block_17.out2, value=getParameterValueByName_25, lacing=Longest)
getParameterValueByName_26 = Element.GetParameterValueByName(element=filterByBoolMask.in, parameterName=code_block_17.out0)
setParameterByName_24 = Element.SetParameterByName(element=filterByBoolMask_3.in, parameterName=code_block_17.out0, value=getParameterValueByName_26, lacing=Longest)

# group: Cartouche - HA10/HA14 ?
code_block_18 = CodeBlock { "HA14 (Horizontaux)"; "HA14 (Verticaux)"; }
code_block_19 = CodeBlock()  # unwired: seisme
# ---------- code_block_19.designscript (5 lines) ----------
seisme == "1" ||
seisme == "2" ||
seisme == "4";

false;
# ----------------------------------------
code_block_20 = CodeBlock { "HA14 (Horizontaux)"; "HA14 (Verticaux)"; }
getParameterValueByName_27 = Element.GetParameterValueByName(element=filterByBoolMask.in, parameterName=code_block_20.out0)
getParameterValueByName_28 = Element.GetParameterValueByName(element=filterByBoolMask.in, parameterName=code_block_20.out1)
list_create = List.Create(item0=getParameterValueByName_27, item1=getParameterValueByName_28)
flatten = List.Flatten(list=list_create)
if_ = If(test=code_block_19.out0, true=code_block_19.out1, false=flatten)
code_block_21 = CodeBlock(l=if_) { l[0]; l[1]; }
setParameterByName_25 = Element.SetParameterByName(element=filterByBoolMask.in, parameterName=code_block_18.out0, value=code_block_21.out0)
setParameterByName_26 = Element.SetParameterByName(element=filterByBoolMask.in, parameterName=code_block_18.out1, value=code_block_21.out1)

# group: Hauteur VR perso°
code_block_22 = CodeBlock { Category.ByName("Feuilles"); "Hauteur VR"; }
all_elements_of_category_3 = ElementsOfCategory(Category=code_block_22.out0)
code_block_23 = CodeBlock(e=all_elements_of_category_3) { e.Name == "PARAMETRAGE"; }
filterByBoolMask_4 = List.FilterByBoolMask(list=all_elements_of_category_3, mask=code_block_23)
getParameterValueByName_29 = Element.GetParameterValueByName(element=filterByBoolMask_4.in, parameterName=code_block_22.out1)

# group: Ht VR + Retour LT
code_block_24 = CodeBlock { ["Fenêtres","Portes"]; }
byName = Category.ByName(name=code_block_24)
all_family_types_of_category = Custom[All Family Types Of Category](category=byName)  # package Clockwork for Dynamo 2.x; Gets all family types/symbols of a given category in the model.
flatten_2 = List.Flatten(list=all_family_types_of_category)
python_script = Python(IN[0]=flatten_2)
# ---------- python_script.python (32 lines) ----------
import clr
clr.AddReference('RevitAPI')
from Autodesk.Revit.DB import*
clr.AddReference('RevitServices')
from RevitServices.Persistence import DocumentManager
doc = DocumentManager.Instance.CurrentDBDocument

fams = list(FilteredElementCollector(doc).OfClass(Family))
inplace = [f for f in fams if f.IsInPlace]
inPlaceCategory = [f.FamilyCategory.Name for f in inplace]
inPlaceId = [f.Id for f in inplace]
inPlaceName = [f.Name for f in inplace]


import sys
import clr
clr.AddReference('ProtoGeometry')
from Autodesk.DesignScript.Geometry import *
# Les entrées effectuées dans ce noeud sont stockées sous forme de liste dans les variables IN.
dataEnteringNode = IN
element = IN[0]

out = []

# Placer votre code au-dessous de cette ligne
for i in range(len(element)):
	if element[i].Name not in inPlaceName :
		out.append(element[i])

# Affectez la sortie à la variable OUT.
OUT = out
#OUT = category, inplace , id
# ----------------------------------------
code_block_25 = CodeBlock(e=python_script) { e.Family; }
string_from_object = FromObject(obj=code_block_25)
code_block_26 = CodeBlock { "ronde"; }
contains = String.Contains(str=string_from_object, searchFor=code_block_26)
filterByBoolMask_5 = List.FilterByBoolMask(list=python_script, mask=contains)
code_block_27 = CodeBlock(e=filterByBoolMask_5.out) { e.Family; }
string_from_object_2 = FromObject(obj=code_block_27)
code_block_28 = CodeBlock { "VR"; }
endsWith = String.EndsWith(str=string_from_object_2, searchFor=code_block_28)
filterByBoolMask_6 = List.FilterByBoolMask(list=filterByBoolMask_5.out, mask=endsWith)
code_block_29 = CodeBlock(moustiquaire=code_block_4.out2, igc=code_block_4.out1, alysia=code_block_4.out3, htVRPerso=getParameterValueByName_29)
# ---------- code_block_29.designscript (5 lines) ----------
"Hauteur VR";
moustiquaire && igc ?  27:
igc ? 31.5 :
alysia && htVRPerso[0] == 32 ? 32 :
alysia && htVRPerso[0] != 32 ? htVRPerso[0] : 30;
# ----------------------------------------
setParameterByName_27 = Element.SetParameterByName(element=filterByBoolMask_6.in, parameterName=code_block_29.out0, value=code_block_29.out1)
code_block_30 = CodeBlock(igc=code_block_4.out1) { "Retour Linteau"; igc ? 1.5 : 1; }
setParameterByName_28 = Element.SetParameterByName(element=filterByBoolMask_6.out, parameterName=code_block_30.out0, value=code_block_30.out1)

# group: SF Cadré
code_block_31 = CodeBlock { "SF Cadré"; }
getParameterValueByName_30 = Element.GetParameterValueByName(element=filterByBoolMask.in, parameterName=code_block_31)
code_block_32 = CodeBlock(igc=code_block_4.out1, param=getParameterValueByName_30) { igc ? 1 : param; }
setParameterByName_29 = Element.SetParameterByName(element=filterByBoolMask.in, parameterName=code_block_31, value=code_block_32)

# group: Web Request
code_block_33 = CodeBlock { Category.ByName("Informations sur le projet"); "Adresse du projet"; }
all_elements_of_category_4 = ElementsOfCategory(Category=code_block_33.out0)
getParameterValueByName_31 = Element.GetParameterValueByName(element=all_elements_of_category_4, parameterName=code_block_33.out1)

python_script_2 = Python(IN[0]=getParameterValueByName_31)
# ---------- python_script_2.python (26 lines) ----------
import clr
clr.AddReference("RevitAPIUI")
from Autodesk.Revit.UI import *
import webbrowser

# Les entrées effectuées dans ce noeud sont stockées sous forme de liste dans les variables IN.
dataEnteringNode = IN

adresse = IN[0][0]

msg = "Adresse non renseignée"

dialog = TaskDialog("Paramétrage")
dialog.MainInstruction = "/!\\ Adresse non renseignée"
dialog.MainContent = "Adresse défini sur : ADRESSE DU PROJET"

dialog.CommonButtons = TaskDialogCommonButtons.Close;
dialog.DefaultButton = TaskDialogResult.Close;

#dialog.FooterText = "<a href=\"http://usa.autodesk.com/adsk/servlet/index?siteID=123112&id=2484975 \"> Click here for the Revit API Developer Center</a>"


result = dialog.Show() if IN[0][0] == "ADRESSE DU PROJET" else ""

#Assign your output to the OUT variable.
OUT = "https://api-adresse.data.gouv.fr/search/?q="+"".join(adresse.split("\n"))+"&type=housenumber&autocomplete=1";
# ----------------------------------------

# group (continued): Web Request
web_request = WebRequest(url=python_script_2)
python_script_3 = Python(IN[0]=web_request)
# ---------- python_script_3.python (27 lines) ----------
# Charger les bibliothèques DesignScript et Standard Python
import sys
import clr
clr.AddReference('ProtoGeometry')
from Autodesk.DesignScript.Geometry import *
import json
# Les entrées effectuées dans ce noeud sont stockées sous forme de liste dans les variables IN.
dataEnteringNode = IN
out = ""

# Opening JSON file
data = json.loads(IN[0])["features"]

for i in range(len(data)):
	importance = json.loads(IN[0])["features"][i]["properties"]["importance"]
	citycode = json.loads(IN[0])["features"][i]["properties"]["citycode"]
	city = json.loads(IN[0])["features"][i]["properties"]["city"]
	
	out = [city, importance, citycode]
	
	if i == 0:
		out = [city, importance, citycode]
	elif out[1] < importance:
		out = [city, importance, citycode]
	
# Affectez la sortie à la variable OUT.
OUT = out
# ----------------------------------------
code_block_34 = CodeBlock(res=python_script_3) { "https://sismo-api.vercel.app/api/v1/city/insee/"+res[2]; }
web_request_2 = WebRequest(url=code_block_34)
python_script_4 = Python(IN[0]=web_request_2)
# ---------- python_script_4.python (25 lines) ----------
# Charger les bibliothèques DesignScript et Standard Python
import sys
import clr
clr.AddReference('ProtoGeometry')
from Autodesk.DesignScript.Geometry import *
import json
# Les entrées effectuées dans ce noeud sont stockées sous forme de liste dans les variables IN.
dataEnteringNode = IN
out = ""

# Opening JSON file
data = json.loads(IN[0])

for i in range(len(data)):
	nom = data[i]["nomCommune"]
	cp = data[i]["codePostal"]
	seisme = data[i]["seisme"]
	vent = data[i]["vent"]
	neige = data[i]["neige"]
	littoral = data[i]["littoral"]
	insee = data[i]["insee"]
	out = [nom, seisme, vent, neige, littoral, cp, insee]

# Affectez la sortie à la variable OUT.
OUT = out
# ----------------------------------------
code_block_35 = CodeBlock(res=python_script_4)
# ---------- code_block_35.designscript (12 lines) ----------
// SEISME
res[1];
// VENT
res[2];
// NEIGE
res[3];
// LITTORAL
res[4];
// NOM + CP
res[0]+" ("+res[5]+")";
//INSEE
res[6];
# ----------------------------------------

# group: Zone Sismique / Vent / Neige / Littoral
code_block_36 = CodeBlock(littoral=code_block_35.out3) { "Zone Littoral"; littoral == "Mer" || littoral =="Estuaire"; }
setParameterByName_30 = Element.SetParameterByName(element=filterByBoolMask.in, parameterName=code_block_36.out0, value=code_block_36.out1)
code_block_37 = CodeBlock { Category.ByName("Informations sur le projet"); "Sismique"; "Vent"; "Neige"; }
all_elements_of_category_5 = ElementsOfCategory(Category=code_block_37.out0)
code_block_38 = CodeBlock(zone=code_block_35.out0)
# ---------- code_block_38.designscript (4 lines) ----------
"Acier";

zone == "1" || zone == "2" ? "Fe= Adx 240 MPa - HA 500A MPa - TS 500A MPa\nRecouvrement au minimum 50 fois le diamètre des armatures\nPrévoir des bouchons de sécurité pour les attentes" :
"Fe= Adx 240 MPa - HA 500B MPa - TS 500B MPa\nRecouvrement au minimum 60 fois le diamètre des armatures\nPrévoir des bouchons de sécurité pour les attentes";
# ----------------------------------------
setParameterByName_31 = Element.SetParameterByName(element=all_elements_of_category_5, parameterName=code_block_38.out0, value=code_block_38.out1)
code_block_39 = CodeBlock(zone=code_block_35.out0)
# ---------- code_block_39.designscript (5 lines) ----------
zone == "1" ? [1,0,0,0]:
zone == "2" ? [0,1,0,0]:
zone == "3" ? [0,0,1,0]:
zone == "4" ? [0,0,0,1]:
[1,0,0,0];
# ----------------------------------------
code_block_40 = CodeBlock(l=code_block_39)
# ---------- code_block_40.designscript (15 lines) ----------
//Zone 1
"Zone 1";
l[0];

//Zone 2
"Zone 2";
l[1];

//Zone 3
"Zone 3";
l[2];

//Zone 4
"Zone 4";
l[3];
# ----------------------------------------
setParameterByName_32 = Element.SetParameterByName(element=filterByBoolMask.in, parameterName=code_block_40.out0, value=code_block_40.out1)
setParameterByName_33 = Element.SetParameterByName(element=filterByBoolMask.in, parameterName=code_block_40.out2, value=code_block_40.out3)
setParameterByName_34 = Element.SetParameterByName(element=filterByBoolMask.in, parameterName=code_block_40.out4, value=code_block_40.out5)
setParameterByName_35 = Element.SetParameterByName(element=filterByBoolMask.in, parameterName=code_block_40.out6, value=code_block_40.out7)
toNumber = String.ToNumber(str=code_block_35.out0)
setParameterByName_36 = Element.SetParameterByName(element=all_elements_of_category_5, parameterName=code_block_37.out1, value=toNumber)
setParameterByName_37 = Element.SetParameterByName(element=all_elements_of_category_5, parameterName=code_block_37.out2, value=code_block_35.out1)
setParameterByName_38 = Element.SetParameterByName(element=all_elements_of_category_5, parameterName=code_block_37.out3, value=code_block_35.out2)
python_script_5 = Python(IN[0]=code_block_35.out4, IN[1]=code_block_35.out0, IN[2]=code_block_35.out1, IN[3]=code_block_35.out2, IN[4]=code_block_35.out3, IN[5]=getParameterValueByName_31, IN[6]=code_block_35.out5)
# ---------- python_script_5.python (48 lines) ----------
import clr
clr.AddReference("RevitAPIUI")
from Autodesk.Revit.UI import *
import webbrowser

# Les entrées effectuées dans ce noeud sont stockées sous forme de liste dans les variables IN.
dataEnteringNode = IN

nom = IN[0]
seisme = IN[1]
vent = IN[2]
neige = IN[3]
littoral = IN[4]
adresse = IN[5][0]
insee = IN[6]

out = ""

expoBeton = "\n• /!\\ Adresse se situant en zone littorale : Possible Exposition de béton" if (littoral == "Mer" or littoral =="Estuaire") else "• -"
zone = "\n• /!\\ HA10 / HA14 ? Renseigner Horizontaux et Verticaux" if (seisme == "3") else "• -"

dialog = TaskDialog("Paramétrage")
dialog.MainInstruction = "Localisation du projet"
dialog.MainContent = nom+"\n\n• SEISME : "+seisme+"\n• VENT : "+vent+"\n• NEIGE : "+neige+"\n• LITTORAL : "+littoral+"\n\nREMARQUES / OBSERVATIONS :"+expoBeton+"\n"+zone

dialog.AddCommandLink(TaskDialogCommandLinkId.CommandLink1, "Ouvrir dans Google Maps", adresse)
dialog.AddCommandLink(TaskDialogCommandLinkId.CommandLink2, "Vérifier le résultat", "https://sismo.vercel.app/insee/"+insee )
dialog.AddCommandLink(TaskDialogCommandLinkId.CommandLink3, "Ouvrir dans Georiques", "https://www.georisques.gouv.fr/" )

dialog.CommonButtons = TaskDialogCommonButtons.Close;
dialog.DefaultButton = TaskDialogResult.Close;

#dialog.FooterText = "<a href=\"http://usa.autodesk.com/adsk/servlet/index?siteID=123112&id=2484975 \"> Click here for the Revit API Developer Center</a>"


result = "" if adresse == "ADRESSE DU PROJET" else dialog.Show()

if (TaskDialogResult.CommandLink1 == result):
	webbrowser.open("https://www.google.fr/maps/place/"+adresse)  # Go to Google Maps

if (TaskDialogResult.CommandLink2 == result):
	webbrowser.open("https://sismo.vercel.app/insee/"+insee)  # Go to Sismo
	
elif (TaskDialogResult.CommandLink3 == result):
	webbrowser.open("https://www.georisques.gouv.fr/")  # Go to Sismo

#Assign your output to the OUT variable.
OUT = out
# ----------------------------------------
list_create_2 = List.Create(item0=setParameterByName_32, item1=setParameterByName_33, item2=setParameterByName_34, item3=setParameterByName_35, item4=setParameterByName_36, item5=setParameterByName_37, item6=setParameterByName_38, item7=python_script_5)
code_block_41 = CodeBlock(zone=code_block_35.out0)  # same code as code_block_39
code_block_42 = CodeBlock(l=code_block_41)  # same code as code_block_40
setParameterByName_39 = Element.SetParameterByName(element=filterByBoolMask_3.in, parameterName=code_block_42.out0, value=code_block_42.out1)
setParameterByName_40 = Element.SetParameterByName(element=filterByBoolMask_3.in, parameterName=code_block_42.out2, value=code_block_42.out3)
setParameterByName_41 = Element.SetParameterByName(element=filterByBoolMask_3.in, parameterName=code_block_42.out4, value=code_block_42.out5)
setParameterByName_42 = Element.SetParameterByName(element=filterByBoolMask_3.in, parameterName=code_block_42.out6, value=code_block_42.out7)

# group: Avertissement réglage IGC / Alysia
list_create_3 = List.Create(item0=code_block_4.out1, item1=code_block_4.out3, item2=code_block_4.out2, item3=code_block_29.out1, item4=code_block_5.out1, item5=code_block_30.out1)
passthrough = Custom[Passthrough](passThrough=list_create_3, waitFor=python_script_5)  # package Clockwork for Dynamo 2.x; Forces a sequential order of execution. The node wired into the output of the Passthrough node will be executed *after* the node wired into the waitFor input (e.g. important for some Revit operations). The value of the passThrough input will be passed on to the node wired into the output port of the Passthrough node.
python_script_6 = Python(IN[0]=passthrough)
# ---------- python_script_6.python (36 lines) ----------
import clr
clr.AddReference("RevitAPIUI")
from Autodesk.Revit.UI import *
import webbrowser

# Les entrées effectuées dans ce noeud sont stockées sous forme de liste dans les variables IN.
dataEnteringNode = IN

isIGC = IN[0][0]
isAlysia = IN[0][1]
VRorMoustiquaire = "Moustiquaire" if IN[0][2] == 1 else "VR"
htVR = str(IN[0][3]).replace(".0","")
htFD = "\n\nHauteur des Fondations réglée sur "+str(IN[0][4])+"cm" if isIGC == 1 else ""
retourLT = "\n\nRetour Linteau réglé sur "+str(IN[0][5])+"cm" if isIGC == 1 else ""
moustiquaire =  "\n\nPrésence de Moustiquaire ?" if isIGC == 1 else ""

title = "IGC" if isIGC == 1 else "Alysia" if isAlysia == 1 else ""

msgICG = "Présence de "

msg = "Hauteur de "+VRorMoustiquaire+" réglée sur "+htVR+"cm - Vérifier la valeur sur les coupes ARCHI"+htFD+retourLT+moustiquaire

dialog = TaskDialog("Paramétrage")
dialog.MainInstruction = "/!\\ Projet "+title
dialog.MainContent = msg

dialog.CommonButtons = TaskDialogCommonButtons.Close;
dialog.DefaultButton = TaskDialogResult.Close;

#dialog.FooterText = "<a href=\"http://usa.autodesk.com/adsk/servlet/index?siteID=123112&id=2484975 \"> Click here for the Revit API Developer Center</a>"


result = "" if isIGC == 0 and isAlysia == 0 else dialog.Show()

#Assign your output to the OUT variable.
OUT = msg
# ----------------------------------------
