# Dynamo graph DEV_D2 - Renommer Niveau Pre-parametre.dyn (Dynamo 2.6.1.8786)

code_block = CodeBlock { Category.ByName("Niveaux"); "Elévation"; "Nom"; }
all_elements_of_category = ElementsOfCategory(Category=code_block.out0)
code_block_2 = CodeBlock { "Nom"; }
getParameterValueByName = Element.GetParameterValueByName(element=all_elements_of_category, parameterName=code_block.out1)
getParameterValueByName_2 = Element.GetParameterValueByName(element=all_elements_of_category, parameterName=code_block.out2)
python_script = Python(IN[0]=getParameterValueByName, IN[1]=getParameterValueByName_2)
# ---------- python_script.python (32 lines) ----------
# Charger les bibliothèques DesignScript et Standard Python
import sys
import clr
clr.AddReference('ProtoGeometry')
from Autodesk.DesignScript.Geometry import *

# Les entrées effectuées dans ce noeud sont stockées sous forme de liste dans les variables IN.
dataEnteringNode = IN

elevation = IN[0]
name = IN[1]

out = []

# Placer votre code au-dessous de cette ligne
for i in range(len(elevation)):
	level = round(elevation[i]/100, 3)
	levelName = name[i].split(" ",1)[1] if name[i] != "NPS1" and name[i] != "NPS2" else name[i]
	
	if levelName == "NPS1":
		out.append("NPS1")
	elif levelName == "NPS2":
		out.append("NPS2")
	elif level > 0 :
		out.append("+"+"{:<05}".format(level)+" "+levelName if elevation[i] <= 1000 else "+"+"{:<06}".format(level)+" "+levelName)
	elif level == 0 :
		out.append("±"+"{:<05}".format(level)+" "+levelName if elevation[i] <= 1000 else "±"+"{:<06}".format(level)+" "+levelName)
	else : 
		out.append("-"+"{:<05}".format(str(level)[1:])+" "+levelName if elevation[i] <= 1000 else "-"+"{:<06}".format(str(level)[1:])+" "+levelName)	
	
# Affectez la sortie à la variable OUT.
OUT = out
# ----------------------------------------
setParameterByName = Element.SetParameterByName(element=all_elements_of_category, parameterName=code_block_2, value=python_script)
