# Dynamo graph DEV_D4 - Echelle 1_75 vers 1_50.dyn "Dyn123STR-1_50eme-DEV" (Dynamo 2.6.1.8786)

element_types = ElementTypes("ViewPlan")
all_elements_of_type = ElementsOfType(element_type=element_types)
code_block = CodeBlock { "Type"; }
getParameterValueByName = Element.GetParameterValueByName(element=all_elements_of_type, parameterName=code_block)
code_block_2 = CodeBlock(type=getParameterValueByName) { type != ""; }
filterByBoolMask = List.FilterByBoolMask(list=all_elements_of_type, mask=code_block_2)
code_block_3 = CodeBlock { "Type"; }
getParameterValueByName_2 = Element.GetParameterValueByName(element=filterByBoolMask.in, parameterName=code_block_3)
name = ElementType.Name(elementType=getParameterValueByName_2)
code_block_4 = CodeBlock(type=name)
# ---------- code_block_4.designscript (4 lines) ----------
type != "02 - Armature dalle basse" &&
type != "04 - Plans Architecte" &&
type != "05 - Plans Architecte FD / Élévation Bois" &&
type != "06 - Controle Liaisons Raidisseurs";
# ----------------------------------------
filterByBoolMask_2 = List.FilterByBoolMask(list=filterByBoolMask.in, mask=code_block_4)
code_block_5 = CodeBlock { "Gabarit de vue"; }
getParameterValueByName_3 = Element.GetParameterValueByName(element=filterByBoolMask_2.in, parameterName=code_block_5)
code_block_6 = CodeBlock(type=getParameterValueByName_3) { type != "Aucun(e)"; }
filterByBoolMask_3 = List.FilterByBoolMask(list=filterByBoolMask_2.in, mask=code_block_6)
code_block_7 = CodeBlock { 50; }
setScale = View.SetScale(view=filterByBoolMask_3.in, scale=code_block_7)
parameters = Element.Parameters(element=all_elements_of_type)
