# Dynamo graph DEV_E1 - Gabarit Ingenieur - Dessin.dyn (Dynamo 2.6.1.8786)

# group: Changement du gabarit
element_types = ElementTypes("ViewPlan")
all_elements_of_type = ElementsOfType(element_type=element_types)
code_block = CodeBlock { "Nom de la vue"; }
getParameterValueByName = Element.GetParameterValueByName(element=all_elements_of_type, parameterName=code_block)
code_block_2 = CodeBlock(name=getParameterValueByName)
# ---------- code_block_2.designscript (61 lines) ----------
name == "5 - RDC";





name == "6 - R+1";





name == "7 - R+2";





name == "8 - R+3";





name == "9 - R+4";





name == "10 - R+5";





name == "11 - R+6";





name == "12 - R+7";





name == "4 - SS";





name == "2a - Fondations";





name == "4a - Fondations SS";
# ----------------------------------------
filterByBoolMask = List.FilterByBoolMask(list=all_elements_of_type, mask=code_block_2.out0)
code_block_3 = CodeBlock { "Gabarit de vue"; }
code_block_4 = CodeBlock { "Gabarit de vue"; }
getParameterValueByName_2 = Element.GetParameterValueByName(element=filterByBoolMask.in, parameterName=code_block_4)
name = Family.Name(family=getParameterValueByName_2)
code_block_5 = CodeBlock { "(Ingé°)"; }
contains = String.Contains(str=name, searchFor=code_block_5)
filterByBoolMask_2 = List.FilterByBoolMask(list=all_elements_of_type, mask=code_block_2.out1)
code_block_6 = CodeBlock { "Gabarit de vue"; }
code_block_7 = CodeBlock { "Gabarit de vue"; }
getParameterValueByName_3 = Element.GetParameterValueByName(element=filterByBoolMask_2.in, parameterName=code_block_7)
name_2 = Family.Name(family=getParameterValueByName_3)
code_block_8 = CodeBlock { "(Ingé°)"; }
contains_2 = String.Contains(str=name_2, searchFor=code_block_8)
filterByBoolMask_3 = List.FilterByBoolMask(list=all_elements_of_type, mask=code_block_2.out2)
code_block_9 = CodeBlock { "Gabarit de vue"; }
code_block_10 = CodeBlock { "Gabarit de vue"; }
getParameterValueByName_4 = Element.GetParameterValueByName(element=filterByBoolMask_3.in, parameterName=code_block_10)
name_3 = Family.Name(family=getParameterValueByName_4)
code_block_11 = CodeBlock { "(Ingé°)"; }
contains_3 = String.Contains(str=name_3, searchFor=code_block_11)
filterByBoolMask_4 = List.FilterByBoolMask(list=all_elements_of_type, mask=code_block_2.out3)
code_block_12 = CodeBlock { "Gabarit de vue"; }
code_block_13 = CodeBlock { "Gabarit de vue"; }
getParameterValueByName_5 = Element.GetParameterValueByName(element=filterByBoolMask_4.in, parameterName=code_block_13)
name_4 = Family.Name(family=getParameterValueByName_5)
code_block_14 = CodeBlock { "(Ingé°)"; }
contains_4 = String.Contains(str=name_4, searchFor=code_block_14)
filterByBoolMask_5 = List.FilterByBoolMask(list=all_elements_of_type, mask=code_block_2.out4)
code_block_15 = CodeBlock { "Gabarit de vue"; }
code_block_16 = CodeBlock { "Gabarit de vue"; }
getParameterValueByName_6 = Element.GetParameterValueByName(element=filterByBoolMask_5.in, parameterName=code_block_16)
name_5 = Family.Name(family=getParameterValueByName_6)
code_block_17 = CodeBlock { "(Ingé°)"; }
contains_5 = String.Contains(str=name_5, searchFor=code_block_17)
filterByBoolMask_6 = List.FilterByBoolMask(list=all_elements_of_type, mask=code_block_2.out5)
code_block_18 = CodeBlock { "Gabarit de vue"; }
code_block_19 = CodeBlock { "Gabarit de vue"; }
getParameterValueByName_7 = Element.GetParameterValueByName(element=filterByBoolMask_6.in, parameterName=code_block_19)
name_6 = Family.Name(family=getParameterValueByName_7)
code_block_20 = CodeBlock { "(Ingé°)"; }
contains_6 = String.Contains(str=name_6, searchFor=code_block_20)
filterByBoolMask_7 = List.FilterByBoolMask(list=all_elements_of_type, mask=code_block_2.out6)
code_block_21 = CodeBlock { "Gabarit de vue"; }
code_block_22 = CodeBlock { "Gabarit de vue"; }
getParameterValueByName_8 = Element.GetParameterValueByName(element=filterByBoolMask_7.in, parameterName=code_block_22)
name_7 = Family.Name(family=getParameterValueByName_8)
code_block_23 = CodeBlock { "(Ingé°)"; }
contains_7 = String.Contains(str=name_7, searchFor=code_block_23)
filterByBoolMask_8 = List.FilterByBoolMask(list=all_elements_of_type, mask=code_block_2.out7)
code_block_24 = CodeBlock { "Gabarit de vue"; }
code_block_25 = CodeBlock { "Gabarit de vue"; }
getParameterValueByName_9 = Element.GetParameterValueByName(element=filterByBoolMask_8.in, parameterName=code_block_25)
name_8 = Family.Name(family=getParameterValueByName_9)
code_block_26 = CodeBlock { "(Ingé°)"; }
contains_8 = String.Contains(str=name_8, searchFor=code_block_26)

# group: Gabarit de vue
name_9 = Family.Name(family=all_elements_of_type)
code_block_27 = CodeBlock(name=name_9)
# ---------- code_block_27.designscript (32 lines) ----------
name == "123STR RDC";
name == "123STR RDC (Ingé°)";

name == "123STR R+1";
name == "123STR R+1 (Ingé°)";

name == "123STR R+2";
name == "123STR R+2 (Ingé°)";

name == "123STR R+3";
name == "123STR R+3 (Ingé°)";

name == "123STR R+4";
name == "123STR R+4 (Ingé°)";

name == "123STR R+5";
name == "123STR R+5 (Ingé°)";

name == "123STR R+6";
name == "123STR R+6 (Ingé°)";

name == "123STR R+7";
name == "123STR R+7 (Ingé°)";

name == "123STR SS";
name == "123STR SS (Ingé°)";

name == "123STR Fondations RDC";
name == "123STR Fondations RDC (Ingé°)";

name == "123STR Fondations SS";
name == "123STR Fondations SS (Ingé°)";
# ----------------------------------------
filterByBoolMask_9 = List.FilterByBoolMask(list=all_elements_of_type, mask=code_block_27.out0)
filterByBoolMask_10 = List.FilterByBoolMask(list=all_elements_of_type, mask=code_block_27.out1)
code_block_28 = CodeBlock(std=filterByBoolMask_9.in, inge=filterByBoolMask_10.in) { List.Flatten([std, inge]); }
filterByBoolMask_11 = List.FilterByBoolMask(list=all_elements_of_type, mask=code_block_27.out2)
filterByBoolMask_12 = List.FilterByBoolMask(list=all_elements_of_type, mask=code_block_27.out3)
code_block_29 = CodeBlock(std=filterByBoolMask_11.in, inge=filterByBoolMask_12.in) { List.Flatten([std, inge]); }
filterByBoolMask_13 = List.FilterByBoolMask(list=all_elements_of_type, mask=code_block_27.out4)
filterByBoolMask_14 = List.FilterByBoolMask(list=all_elements_of_type, mask=code_block_27.out5)
code_block_30 = CodeBlock(std=filterByBoolMask_13.in, inge=filterByBoolMask_14.in) { List.Flatten([std, inge]); }
filterByBoolMask_15 = List.FilterByBoolMask(list=all_elements_of_type, mask=code_block_27.out6)
filterByBoolMask_16 = List.FilterByBoolMask(list=all_elements_of_type, mask=code_block_27.out7)
code_block_31 = CodeBlock(std=filterByBoolMask_15.in, inge=filterByBoolMask_16.in) { List.Flatten([std, inge]); }
filterByBoolMask_17 = List.FilterByBoolMask(list=all_elements_of_type, mask=code_block_27.out8)
filterByBoolMask_18 = List.FilterByBoolMask(list=all_elements_of_type, mask=code_block_27.out9)
code_block_32 = CodeBlock(std=filterByBoolMask_17.in, inge=filterByBoolMask_18.in) { List.Flatten([std, inge]); }
filterByBoolMask_19 = List.FilterByBoolMask(list=all_elements_of_type, mask=code_block_27.out10)
filterByBoolMask_20 = List.FilterByBoolMask(list=all_elements_of_type, mask=code_block_27.out11)
code_block_33 = CodeBlock(std=filterByBoolMask_19.in, inge=filterByBoolMask_20.in) { List.Flatten([std, inge]); }
filterByBoolMask_21 = List.FilterByBoolMask(list=all_elements_of_type, mask=code_block_27.out12)
filterByBoolMask_22 = List.FilterByBoolMask(list=all_elements_of_type, mask=code_block_27.out13)
code_block_34 = CodeBlock(std=filterByBoolMask_21.in, inge=filterByBoolMask_22.in) { List.Flatten([std, inge]); }
filterByBoolMask_23 = List.FilterByBoolMask(list=all_elements_of_type, mask=code_block_27.out14)
filterByBoolMask_24 = List.FilterByBoolMask(list=all_elements_of_type, mask=code_block_27.out15)
code_block_35 = CodeBlock(std=filterByBoolMask_23.in, inge=filterByBoolMask_24.in) { List.Flatten([std, inge]); }
filterByBoolMask_25 = List.FilterByBoolMask(list=all_elements_of_type, mask=code_block_27.out20)
filterByBoolMask_26 = List.FilterByBoolMask(list=all_elements_of_type, mask=code_block_27.out21)
code_block_36 = CodeBlock(std=filterByBoolMask_25.in, inge=filterByBoolMask_26.in) { List.Flatten([std, inge]); }
filterByBoolMask_27 = List.FilterByBoolMask(list=all_elements_of_type, mask=code_block_27.out16)
filterByBoolMask_28 = List.FilterByBoolMask(list=all_elements_of_type, mask=code_block_27.out17)
code_block_37 = CodeBlock(std=filterByBoolMask_27.in, inge=filterByBoolMask_28.in) { List.Flatten([std, inge]); }
filterByBoolMask_29 = List.FilterByBoolMask(list=all_elements_of_type, mask=code_block_27.out18)
filterByBoolMask_30 = List.FilterByBoolMask(list=all_elements_of_type, mask=code_block_27.out19)
code_block_38 = CodeBlock(std=filterByBoolMask_29.in, inge=filterByBoolMask_30.in) { List.Flatten([std, inge]); }

# group (continued): Changement du gabarit
code_block_39 = CodeBlock(l=code_block_28) { l[0]; l[1]; }
if_ = If(test=contains, true=code_block_39.out0, false=code_block_39.out1)
setParameterByName = Element.SetParameterByName(element=filterByBoolMask.in, parameterName=code_block_3, value=if_, lacing=Longest)
code_block_40 = CodeBlock(l=code_block_29) { l[0]; l[1]; }
if_2 = If(test=contains_2, true=code_block_40.out0, false=code_block_40.out1)
setParameterByName_2 = Element.SetParameterByName(element=filterByBoolMask_2.in, parameterName=code_block_6, value=if_2, lacing=Longest)
code_block_41 = CodeBlock(l=code_block_30) { l[0]; l[1]; }
if_3 = If(test=contains_3, true=code_block_41.out0, false=code_block_41.out1)
setParameterByName_3 = Element.SetParameterByName(element=filterByBoolMask_3.in, parameterName=code_block_9, value=if_3, lacing=Longest)
code_block_42 = CodeBlock(l=code_block_31) { l[0]; l[1]; }
if_4 = If(test=contains_4, true=code_block_42.out0, false=code_block_42.out1)
setParameterByName_4 = Element.SetParameterByName(element=filterByBoolMask_4.in, parameterName=code_block_12, value=if_4, lacing=Longest)
code_block_43 = CodeBlock(l=code_block_32) { l[0]; l[1]; }
if_5 = If(test=contains_5, true=code_block_43.out0, false=code_block_43.out1)
setParameterByName_5 = Element.SetParameterByName(element=filterByBoolMask_5.in, parameterName=code_block_15, value=if_5, lacing=Longest)
code_block_44 = CodeBlock(l=code_block_33) { l[0]; l[1]; }
if_6 = If(test=contains_6, true=code_block_44.out0, false=code_block_44.out1)
setParameterByName_6 = Element.SetParameterByName(element=filterByBoolMask_6.in, parameterName=code_block_18, value=if_6, lacing=Longest)
code_block_45 = CodeBlock(l=code_block_34) { l[0]; l[1]; }
if_7 = If(test=contains_7, true=code_block_45.out0, false=code_block_45.out1)
setParameterByName_7 = Element.SetParameterByName(element=filterByBoolMask_7.in, parameterName=code_block_21, value=if_7, lacing=Longest)
code_block_46 = CodeBlock(l=code_block_35) { l[0]; l[1]; }
if_8 = If(test=contains_8, true=code_block_46.out0, false=code_block_46.out1)
setParameterByName_8 = Element.SetParameterByName(element=filterByBoolMask_8.in, parameterName=code_block_24, value=if_8, lacing=Longest)

filterByBoolMask_31 = List.FilterByBoolMask(list=all_elements_of_type, mask=code_block_2.out10)
code_block_47 = CodeBlock { "Gabarit de vue"; }
code_block_48 = CodeBlock { "Gabarit de vue"; }
getParameterValueByName_10 = Element.GetParameterValueByName(element=filterByBoolMask_31.in, parameterName=code_block_48)
name_10 = Family.Name(family=getParameterValueByName_10)
code_block_49 = CodeBlock { "(Ingé°)"; }
contains_9 = String.Contains(str=name_10, searchFor=code_block_49)
code_block_50 = CodeBlock(l=code_block_36) { l[0]; l[1]; }
if_9 = If(test=contains_9, true=code_block_50.out0, false=code_block_50.out1)
setParameterByName_9 = Element.SetParameterByName(element=filterByBoolMask_31.in, parameterName=code_block_47, value=if_9, lacing=Longest)
filterByBoolMask_32 = List.FilterByBoolMask(list=all_elements_of_type, mask=code_block_2.out8)
code_block_51 = CodeBlock { "Gabarit de vue"; }
code_block_52 = CodeBlock { "Gabarit de vue"; }
getParameterValueByName_11 = Element.GetParameterValueByName(element=filterByBoolMask_32.in, parameterName=code_block_52)
name_11 = Family.Name(family=getParameterValueByName_11)
code_block_53 = CodeBlock { "(Ingé°)"; }
contains_10 = String.Contains(str=name_11, searchFor=code_block_53)
code_block_54 = CodeBlock(l=code_block_37) { l[0]; l[1]; }
if_10 = If(test=contains_10, true=code_block_54.out0, false=code_block_54.out1)
setParameterByName_10 = Element.SetParameterByName(element=filterByBoolMask_32.in, parameterName=code_block_51, value=if_10, lacing=Longest)
filterByBoolMask_33 = List.FilterByBoolMask(list=all_elements_of_type, mask=code_block_2.out9)
code_block_55 = CodeBlock { "Gabarit de vue"; }
code_block_56 = CodeBlock { "Gabarit de vue"; }
getParameterValueByName_12 = Element.GetParameterValueByName(element=filterByBoolMask_33.in, parameterName=code_block_56)
name_12 = Family.Name(family=getParameterValueByName_12)
code_block_57 = CodeBlock { "(Ingé°)"; }
contains_11 = String.Contains(str=name_12, searchFor=code_block_57)
code_block_58 = CodeBlock(l=code_block_38) { l[0]; l[1]; }
if_11 = If(test=contains_11, true=code_block_58.out0, false=code_block_58.out1)
setParameterByName_11 = Element.SetParameterByName(element=filterByBoolMask_33.in, parameterName=code_block_55, value=if_11, lacing=Longest)
