# Dynamo graph DEV_E2 - Export Excel.dyn (Dynamo 2.6.1.8786)
# packages: Clockwork for Dynamo 2.x 2.3.0, bimorphNodes 4.0.13

# group: Informations Projet
code_block = CodeBlock { Category.ByName("Informations sur le projet"); "Nom du client"; "Numéro de projet"; "N° Affaire Client"; }
all_elements_of_category = ElementsOfCategory(Category=code_block.out0)
getParameterValueByName = Element.GetParameterValueByName(element=all_elements_of_category, parameterName=code_block.out2)
code_block_2 = CodeBlock { "Nomenclature Z1-Z2"; "Nomenclature Z3"; "Nomenclature Z4"; 3; 8; }
code_block_3 = CodeBlock { Category.ByName("Cartouches"); "Nom de la feuille"; }
all_elements_of_category_2 = ElementsOfCategory(Category=code_block_3.out0)
getParameterValueByName_2 = Element.GetParameterValueByName(element=all_elements_of_category_2, parameterName=code_block_3.out1)
code_block_4 = CodeBlock(name=getParameterValueByName_2) { name=="PARAMETRAGE"; }
filterByBoolMask = List.FilterByBoolMask(list=all_elements_of_category_2, mask=code_block_4)
code_block_5 = CodeBlock()
# ---------- code_block_5.designscript (19 lines) ----------
"N° dossier Client";

["BigMat",
"Construction de l'Erdre",
"COVAL",
"IGC",
"Design Habitat",
"JBAA",
"LMCR",
"Maisons Alysia",
"Maisons TEVA",
"MIKIT",
"Point P",
"POUDRY Materiaux",
"SATOV",
"ADENOV",
"Arti Creations",
"Maisons Gochoki",
"Villas Club"];
# ----------------------------------------
getParameterValueByName_3 = Element.GetParameterValueByName(element=filterByBoolMask.in, parameterName=code_block_5.out0)
getParameterValueByName_4 = Element.GetParameterValueByName(element=filterByBoolMask.in, parameterName=code_block_5.out1, lacing=CrossProduct)
python_script = Python(IN[0]=code_block_5.out1, IN[1]=getParameterValueByName_4)
# ---------- python_script.python (21 lines) ----------
# Charger les bibliothèques DesignScript et Standard Python
import sys
import clr
clr.AddReference('ProtoGeometry')
from Autodesk.DesignScript.Geometry import *

# Les entrées effectuées dans ce noeud sont stockées sous forme de liste dans les variables IN.
dataEnteringNode = IN

name = IN[0]
value = IN[1][0]

out = []

# Boucle parcourant chaque ligne de la nomenclature
for i in range(len(name)):
	if value[i] == 1:
		out.append(name[i])

# Affectez la sortie à la variable OUT.
OUT = out
# ----------------------------------------
getParameterValueByName_5 = Element.GetParameterValueByName(element=all_elements_of_category, parameterName=code_block.out3)
code_block_6 = CodeBlock(dossierClient=getParameterValueByName_3, nomClient=python_script, nDossierClient=getParameterValueByName_5)
# ---------- code_block_6.designscript (3 lines) ----------
dossierClient == 1 ?
nomClient+" ("+nDossierClient+")" :
nomClient;
# ----------------------------------------
code_block_7 = CodeBlock { "Nomenclature Z1-Z2"; "Nomenclature Z3"; "Nomenclature Z4"; 2; 5; }
getParameterValueByName_6 = Element.GetParameterValueByName(element=all_elements_of_category, parameterName=code_block.out1)
code_block_8 = CodeBlock { "Nomenclature Z1-Z2"; "Nomenclature Z3"; "Nomenclature Z4"; 3; 2; }

# group: Recherche du chemin d'accès vers le fichier Excel
code_block_9 = CodeBlock { "\\"; }
current = Document.Current()
filePath = Document.FilePath(document=current)
directoryName = FileSystem.DirectoryName(path=filePath)
split = String.Split(str=directoryName, separator0=code_block_9)
count = List.Count(list=split)
code_block_10 = CodeBlock(l=count) { l-1; }
removeItemAtIndex = List.RemoveItemAtIndex(list=split, indices=code_block_10)
join = String.Join(separator=code_block_9, string0=removeItemAtIndex)
code_block_11 = CodeBlock(path=join) { path+"\\Beton\\EXE"; }
code_block_12 = CodeBlock(path=code_block_11, numAffaire=getParameterValueByName) { path+"\\"+numAffaire+"-NOMENCLATURE.xlsm"; }

# group: Menu contextuelle si Excel manquant
fileExists = FileSystem.FileExists(path=code_block_12)
python_script_2 = Python(IN[0]=fileExists, IN[1]=code_block_12, IN[2]=code_block_11)
# ---------- python_script_2.python (34 lines) ----------
import clr
clr.AddReference("RevitAPIUI")
from Autodesk.Revit.UI import *
import webbrowser
import os

# Les entrées effectuées dans ce noeud sont stockées sous forme de liste dans les variables IN.
dataEnteringNode = IN

fileExist = IN[0][0]
file = IN[1]
path = IN[2][0].replace("\\", "/")

msg = "Vérifier si la nomenclature est correctement nommée.\n\nFormat attendu : 00.00.000A-NOMENCLATURE.xlsm\n\nEmplacement attendu : 2-Plan 123\\Beton\\EXE"

dialog = TaskDialog("Export Revit > Excel")
dialog.MainInstruction = "Fichier Excel manquant."
dialog.MainContent = msg

dialog.AddCommandLink(TaskDialogCommandLinkId.CommandLink1, "Ouvrir le dossier dans l'Explorateur de fichiers", path)

dialog.CommonButtons = TaskDialogCommonButtons.Close;
dialog.DefaultButton = TaskDialogResult.Close;

#dialog.FooterText = "<a href=\"http://usa.autodesk.com/adsk/servlet/index?siteID=123112&id=2484975 \"> Click here for the Revit API Developer Center</a>"


result = "" if fileExist else dialog.Show()

if (TaskDialogResult.CommandLink1 == result):
	os.startfile(path)  # Open Explorer.exe

#Assign your output to the OUT variable.
OUT = file if fileExist else []
# ----------------------------------------

# group: BackUp
file_from_path = FileObject(path=python_script_2)
now = DateTime.Now()
code_block_13 = CodeBlock { ".yyMMdd_HHmmss"; }
format = DateTime.Format(dateTime=now, format=code_block_13)
code_block_14 = CodeBlock(path=code_block_11, numAffaire=getParameterValueByName, dateTime=format) { path+"\\_"+numAffaire+"-Nomenclature"+dateTime+".xlsm"; }
code_block_15 = CodeBlock { true; }
copyFile = FileSystem.CopyFile(file=file_from_path, destinationPath=code_block_14, overwrite=code_block_15)
passthrough = Custom[Passthrough](passThrough=code_block_11, waitFor=copyFile)  # package Clockwork for Dynamo 2.x; Forces a sequential order of execution. The node wired into the output of the Passthrough node will be executed *after* the node wired into the waitFor input (e.g. important for some Revit operations). The value of the passThrough input will be passed on to the node wired into the output port of the Passthrough node.
python_script_3 = Python(IN[0]=passthrough)
# ---------- python_script_3.python (21 lines) ----------
# Charger les bibliothèques DesignScript et Standard Python
import sys
import clr
clr.AddReference('ProtoGeometry')
from Autodesk.DesignScript.Geometry import *

from os import walk

# Les entrées effectuées dans ce noeud sont stockées sous forme de liste dans les variables IN.
dataEnteringNode = IN
pathBeton = IN[0]

# Placer votre code au-dessous de cette ligne
outBeton = []

for (dirpath, dirnames, filenames) in walk(pathBeton[0]):
    outBeton.extend(filenames)
    break
    
# Affectez la sortie à la variable OUT.
OUT = outBeton
# ----------------------------------------
code_block_16 = CodeBlock { "_2"; }
startsWith = String.StartsWith(str=python_script_3, searchFor=code_block_16)
filterByBoolMask_2 = List.FilterByBoolMask(list=python_script_3, mask=startsWith)
python_script_4 = Python(IN[0]=code_block_11, IN[1]=filterByBoolMask_2.in)
# ---------- python_script_4.python (24 lines) ----------
# Charger les bibliothèques DesignScript et Standard Python
import sys
import clr
clr.AddReference('ProtoGeometry')
from Autodesk.DesignScript.Geometry import *

# Les entrées effectuées dans ce noeud sont stockées sous forme de liste dans les variables IN.
dataEnteringNode = IN
path = IN[0]
name = IN[1]

bck = []
out = []

# Placer votre code au-dessous de cette ligne
for i in range(len(name)):
	bck.append(path[0]+"\\"+name[i])

if len(bck) > 3:
	for i in range(len(bck)-3):
		out.append(bck[i])

# Affectez la sortie à la variable OUT.
OUT = out
# ----------------------------------------
count_2 = List.Count(list=python_script_4)
code_block_17 = CodeBlock(len=count_2) { len > 3; len-3; }
deleteFile = FileSystem.DeleteFile(path=python_script_4)
if_ = If(test=code_block_17.out0, true=deleteFile)  # unwired: false

# group: Filtre nomenclatures - Elevation
element_types = ElementTypes("ViewSchedule")
all_elements_of_type = ElementsOfType(element_type=element_types)
code_block_18 = CodeBlock(a=all_elements_of_type)
# ---------- code_block_18.designscript (17 lines) ----------
a.Name;
"3G - Fenêtres - LU";


"3H - Portes - LU";


"3G - Fenêtres - LB";


"3H - Portes - LB";


"3G - Fenêtres - Allège (compris Non Std)";


"3I - Portes - Seuil SATOV (inf. 6cm)";
# ----------------------------------------
code_block_19 = CodeBlock(name=code_block_18.out0, luFenetre=code_block_18.out1, luPorte=code_block_18.out2, lbFenetre=code_block_18.out3, lbPorte=code_block_18.out4, allFenetre=code_block_18.out5, seuilSATOV=code_block_18.out6)
# ---------- code_block_19.designscript (10 lines) ----------
name == luFenetre ||
name == luPorte;


name == lbFenetre ||
name == lbPorte;

name == allFenetre;

name == seuilSATOV;
# ----------------------------------------

# group: Fenêtres / Portes - LU Standard
filterByBoolMask_3 = List.FilterByBoolMask(list=all_elements_of_type, mask=code_block_19.out0)
code_block_20 = CodeBlock { true; 0; }
getData = Revit.Schedule.GetData(scheduleView=filterByBoolMask_3.in, removeHeading=code_block_20.out0)
removeItemAtIndex_2 = List.RemoveItemAtIndex(list=getData@L3, indices=code_block_20.out1)
python_script_5 = Python(IN[0]=removeItemAtIndex_2)
# ---------- python_script_5.python (148 lines) ----------
# Charger les bibliothèques DesignScript et Standard Python
import sys
import clr
clr.AddReference('ProtoGeometry')
from Autodesk.DesignScript.Geometry import *
from math import *

# Les entrées effectuées dans ce noeud sont stockées sous forme de liste dans les variables IN.
dataEnteringNode = IN
data = IN[0]

# Définition de la taille du tableau à retourner
out = [[],[],[],[],[],[],[],[],[],[],[],[]]

# Fonction arrondi personalisée
def myround(x, base=0.05):
    return base * ceil(float(x)/base)
    
def result(x, repere, longueur, avecVR, sansVR, ajout):
	if out[x] == []:
		lg = longueur
	else:
		lg = out[x][1]+longueur

	if out[x] == []:
		avVR = avecVR
	else:
		avVR = out[x][2]+avecVR

	if out[x] == []:
		ssVR = sansVR
	else:
		ssVR = out[x][3]+sansVR
		
	if out[x] == []:
		aj = ajout
	else:
		aj = out[x][4]+ajout
		
	out[x] = [repere, lg, avVR, ssVR, aj]
    
# Boucle parcourant chaque ligne de la nomenclature
for i in range(len(data[0])):
	
	# Récupération de la valeur de chaque paramètre
	repere = data[0][i][0]
	longueur = myround(data[0][i][1])
	avecVR = int(data[0][i][2])
	sansVR = int(data[0][i][3])
	ajout = myround(data[0][i][4])
	
	if repere == "LU1":
		result(0, repere, longueur, avecVR, sansVR, ajout)

	if repere == "LURf1":
		result(1, repere, longueur, avecVR, sansVR, ajout)

	if repere == "LU1=CH":
		result(2, repere, longueur, avecVR, sansVR, ajout)

	if repere == "LURf1=CH":
		result(3, repere, longueur, avecVR, sansVR, ajout)

	if repere == "LU2":
		result(4, repere, longueur, avecVR, sansVR, ajout)

	if repere == "LURf2":
		result(5, repere, longueur, avecVR, sansVR, ajout)

	if repere == "LU2=CH":
		result(6, repere, longueur, avecVR, sansVR, ajout)

	if repere == "LURf2=CH":
		result(7, repere, longueur, avecVR, sansVR, ajout)
		
	if repere == "LU3":
		result(8, repere, longueur, avecVR, sansVR, ajout)

	if repere == "LURf3":
		result(9, repere, longueur, avecVR, sansVR, ajout)

	if repere == "LU3=CH":
		result(10, repere, longueur, avecVR, sansVR, ajout)

	if repere == "LURf3=CH":
		result(11, repere, longueur, avecVR, sansVR, ajout)

for i in range(len(data[1])):
	
	# Récupération de la valeur de chaque paramètre
	repere = data[1][i][0]
	longueur = myround(data[1][i][1])
	avecVR = int(data[1][i][2])
	sansVR = int(data[1][i][3])
	ajout = myround(data[1][i][4])

	if repere == "LU1":
		result(0, repere, longueur, avecVR, sansVR, ajout)

	if repere == "LURf1":
		result(1, repere, longueur, avecVR, sansVR, ajout)

	if repere == "LU1=CH":
		result(2, repere, longueur, avecVR, sansVR, ajout)

	if repere == "LURf1=CH":
		result(3, repere, longueur, avecVR, sansVR, ajout)

	if repere == "LU2":
		result(4, repere, longueur, avecVR, sansVR, ajout)

	if repere == "LURf2":
		result(5, repere, longueur, avecVR, sansVR, ajout)

	if repere == "LU2=CH":
		result(6, repere, longueur, avecVR, sansVR, ajout)

	if repere == "LURf2=CH":
		result(7, repere, longueur, avecVR, sansVR, ajout)
		
	if repere == "LU3":
		result(8, repere, longueur, avecVR, sansVR, ajout)

	if repere == "LURf3":
		result(9, repere, longueur, avecVR, sansVR, ajout)

	if repere == "LU3=CH":
		result(10, repere, longueur, avecVR, sansVR, ajout)

	if repere == "LURf3=CH":
		result(11, repere, longueur, avecVR, sansVR, ajout)
		
# valeur par défaut si vide
if out[0] == [] : out[0] = ["LU1", "", "", "", ""]
if out[1] == [] : out[1] = ["LURf1", "", "", "", ""] 
if out[2] == [] : out[2] = ["LU1=CH", "", "", "", ""]
if out[3] == [] : out[3] = ["LURf1=CH", "", "", "", ""] 
if out[4] == [] : out[4] = ["LU2", "", "", "", ""]
if out[5] == [] : out[5] = ["LURf2", "", "", "", ""] 
if out[6] == [] : out[6] = ["LU2=CH", "", "", "", ""]
if out[7] == [] : out[7] = ["LURf2=CH", "", "", "", ""] 
if out[8] == [] : out[8] = ["LU3", "", "", "", ""]
if out[9] == [] : out[9] = ["LURf3", "", "", "", ""] 
if out[10] == [] : out[10] = ["LU3=CH", "", "", "", ""]
if out[11] == [] : out[11] = ["LURf3=CH", "", "", "", ""] 

# Affectez la sortie à la variable OUT.
OUT = out
# ----------------------------------------
code_block_21 = CodeBlock { "Informations"; 65; 12; }
exportExcel = Data.ExportExcel(filePath=python_script_2, sheetName=code_block_21.out0, startRow=code_block_21.out1, startCol=code_block_21.out2, data=python_script_5)

# group: Fenêtres / Portes - LB Standard
filterByBoolMask_4 = List.FilterByBoolMask(list=all_elements_of_type, mask=code_block_19.out1)
code_block_22 = CodeBlock { true; 0; }
getData_2 = Revit.Schedule.GetData(scheduleView=filterByBoolMask_4.in, removeHeading=code_block_22.out0)
removeItemAtIndex_3 = List.RemoveItemAtIndex(list=getData_2@L3, indices=code_block_22.out1)
python_script_6 = Python(IN[0]=removeItemAtIndex_3)
# ---------- python_script_6.python (143 lines) ----------
# Charger les bibliothèques DesignScript et Standard Python
import sys
import clr
clr.AddReference('ProtoGeometry')
from Autodesk.DesignScript.Geometry import *
from math import *

# Les entrées effectuées dans ce noeud sont stockées sous forme de liste dans les variables IN.
dataEnteringNode = IN
data = IN[0]

# Définition de la taille du tableau à retourner
out = [[],[],[],[],[],[],[],[],[],[],[],[]]

# Fonction arrondi personalisée
def myround(x, base=0.05):
    return base * ceil(float(x)/base)
    
def result(x, repere, longueur, avecVR, sansVR):
	if out[x] == []:
		lg = longueur
	else:
		lg = out[x][1]+longueur

	if out[x] == []:
		avVR = avecVR
	else:
		avVR = out[x][2]+avecVR

	if out[x] == []:
		ssVR = sansVR
	else:
		ssVR = out[x][3]+sansVR
		
	out[x] = [repere, lg, avVR, ssVR]
    
# Boucle parcourant chaque ligne de la nomenclature
for i in range(len(data[0])):
	
	# Récupération de la valeur de chaque paramètre
	repere = data[0][i][0]
	longueur = myround(data[0][i][1])
	avecVR = int(data[0][i][2])
	sansVR = int(data[0][i][3])
	ajout = myround(data[0][i][4])
	
	if repere == "LB1":
		result(0, repere, longueur, avecVR, sansVR)

	if repere == "LBRf1":
		result(1, repere, longueur, avecVR, sansVR)

	if repere == "LB1=CH":
		result(2, repere, longueur, avecVR, sansVR)

	if repere == "LBRf1=CH":
		result(3, repere, longueur, avecVR, sansVR)

	if repere == "LB2":
		result(4, repere, longueur, avecVR, sansVR)

	if repere == "LBRf2":
		result(5, repere, longueur, avecVR, sansVR)

	if repere == "LB2=CH":
		result(6, repere, longueur, avecVR, sansVR)

	if repere == "LBRf2=CH":
		result(7, repere, longueur, avecVR, sansVR)
		
	if repere == "LB3":
		result(8, repere, longueur, avecVR, sansVR)

	if repere == "LBRf3":
		result(9, repere, longueur, avecVR, sansVR)

	if repere == "LB3=CH":
		result(10, repere, longueur, avecVR, sansVR)

	if repere == "LBRf3=CH":
		result(11, repere, longueur, avecVR, sansVR)

for i in range(len(data[1])):
	
	# Récupération de la valeur de chaque paramètre
	repere = data[1][i][0]
	longueur = myround(data[1][i][1])
	avecVR = int(data[1][i][2])
	sansVR = int(data[1][i][3])
	ajout = myround(data[1][i][4])

	if repere == "LB1":
		result(0, repere, longueur, avecVR, sansVR)

	if repere == "LBRf1":
		result(1, repere, longueur, avecVR, sansVR)

	if repere == "LB1=CH":
		result(2, repere, longueur, avecVR, sansVR)

	if repere == "LBRf1=CH":
		result(3, repere, longueur, avecVR, sansVR)

	if repere == "LB2":
		result(4, repere, longueur, avecVR, sansVR)

	if repere == "LBRf2":
		result(5, repere, longueur, avecVR, sansVR)

	if repere == "LB2=CH":
		result(6, repere, longueur, avecVR, sansVR)

	if repere == "LBRf2=CH":
		result(7, repere, longueur, avecVR, sansVR)
		
	if repere == "LB3":
		result(8, repere, longueur, avecVR, sansVR)

	if repere == "LBRf3":
		result(9, repere, longueur, avecVR, sansVR)

	if repere == "LB3=CH":
		result(10, repere, longueur, avecVR, sansVR)

	if repere == "LBRf3=CH":
		result(11, repere, longueur, avecVR, sansVR)
		
# valeur par défaut si vide
if out[0] == [] : out[0] = ["LB1", "", "", ""]
if out[1] == [] : out[1] = ["LBRf1", "", "", ""] 
if out[2] == [] : out[2] = ["LB1=CH", "", "", ""]
if out[3] == [] : out[3] = ["LBRf1=CH", "", "", ""] 
if out[4] == [] : out[4] = ["LB2", "", "", ""]
if out[5] == [] : out[5] = ["LBRf2", "", "", ""] 
if out[6] == [] : out[6] = ["LB2=CH", "", "", ""]
if out[7] == [] : out[7] = ["LBRf2=CH", "", "", ""] 
if out[8] == [] : out[8] = ["LB3", "", "", ""]
if out[9] == [] : out[9] = ["LBRf3", "", "", ""] 
if out[10] == [] : out[10] = ["LB3=CH", "", "", ""]
if out[11] == [] : out[11] = ["LBRf3=CH", "", "", ""] 

# Affectez la sortie à la variable OUT.
OUT = out
# ----------------------------------------
code_block_23 = CodeBlock { "Informations"; 77; 12; }
exportExcel_2 = Data.ExportExcel(filePath=python_script_2, sheetName=code_block_23.out0, startRow=code_block_23.out1, startCol=code_block_23.out2, data=python_script_6)

# group: Filtre nomenclatures - Fondations
element_types_2 = ElementTypes("ViewSchedule")
all_elements_of_type_2 = ElementsOfType(element_type=element_types_2)
code_block_24 = CodeBlock(a=all_elements_of_type_2)
# ---------- code_block_24.designscript (44 lines) ----------
a.Name;
"1A - Fondations - SF";


"1A - Fondations - M";


"1A - Fondations - Pu";


"1B - Plancher bas RDC";


"1C - Soubassements";


"1C - Attentes Fondations";


"1C - Hauteur max. Attentes \"a1a\"";


"1C - Hauteur max. Attentes \"a3a\"";


"1C - Hauteur max. Attentes \"a4a\"";


"1C - Hauteur max. Attentes \"b1a\"";


"1C - Hauteur max. Attentes \"b4a\"";


"1C - Hauteur max. Attentes \"b3a\"";


"1C - Fondations - Liaisons attentes";


"1D - CHP Fondations";


"1D - CHU Fondations";
# ----------------------------------------
code_block_25 = CodeBlock(name=code_block_24.out0, SF=code_block_24.out1, M=code_block_24.out2, Pu=code_block_24.out3, PB=code_block_24.out4, soubassement=code_block_24.out5, attenteFD=code_block_24.out6, attMaxA1a=code_block_24.out7, attMaxA3a=code_block_24.out8, attMaxA4a=code_block_24.out9, attMaxB1a=code_block_24.out10, attMaxB4a=code_block_24.out11, attMaxB3a=code_block_24.out12, liaisonAttFD=code_block_24.out13, chpFD=code_block_24.out14, chuFD=code_block_24.out15)
# ---------- code_block_25.designscript (33 lines) ----------
name == SF;


name == M;


name == Pu;


name == PB;


name == soubassement;


name == attenteFD;


name == attMaxA1a ||
name == attMaxA3a ||
name == attMaxA4a ||
name == attMaxB1a ||
name == attMaxB4a ||
name == attMaxB3a;


name == liaisonAttFD;


name == chpFD;


name == chuFD;
# ----------------------------------------

# group: Fondations - SF
filterByBoolMask_5 = List.FilterByBoolMask(list=all_elements_of_type_2, mask=code_block_25.out0)
code_block_26 = CodeBlock { true; 0; }
getData_3 = Revit.Schedule.GetData(scheduleView=filterByBoolMask_5.in, removeHeading=code_block_26.out0)
removeItemAtIndex_4 = List.RemoveItemAtIndex(list=getData_3@L3, indices=code_block_26.out1)
python_script_7 = Python(IN[0]=removeItemAtIndex_4)
# ---------- python_script_7.python (57 lines) ----------
# Charger les bibliothèques DesignScript et Standard Python
import sys
import clr
clr.AddReference('ProtoGeometry')
from Autodesk.DesignScript.Geometry import *
from math import *

# Les entrées effectuées dans ce noeud sont stockées sous forme de liste dans les variables IN.
dataEnteringNode = IN
data = IN[0]

# Définition de la taille du tableau à retourner
out = [[],[],[],[],[],[]]

# Fonction arrondi personalisée
def myround(x, base=0.05):
    return base * ceil(float(x)/base)

# Boucle parcourant chaque ligne de la nomenclature
for i in range(len(data[0])):
	
	# Récupération de la valeur de chaque paramètre
	largeur = data[0][i][0]
	hauteur = data[0][i][1]
	repere = data[0][i][2]
	longueur = myround(data[0][i][4])
	recouvrement = data[0][i][6]
	
	if repere == "SF1":
		out[0] = [largeur, hauteur, repere, longueur, recouvrement]
		
	if repere == "SF2":
		out[1] = [largeur, hauteur, repere, longueur, recouvrement]
		
	if repere == "SF3":
		out[2] = [largeur, hauteur, repere, longueur, recouvrement]	
	
	if repere == "SF4":
		out[3] = [largeur, hauteur, repere, longueur, recouvrement]
		
	if repere == "SF5":
		out[4] = [largeur, hauteur, repere, longueur, recouvrement]
		
	if repere == "SF6":
		out[5] = [largeur, hauteur, repere, longueur, recouvrement]
		
		
# valeur par défaut si vide
if out[0] == [] : out[0] = [0.50, 0.25, "SF1", "", ""]
if out[1] == [] : out[1] = [0.50, 0.25, "SF2", "", ""]
if out[2] == [] : out[2] = [0.60, 0.25, "SF3", "", ""]
if out[3] == [] : out[3] = [0.50, 0.50, "SF4", "", ""]
if out[4] == [] : out[4] = [0.60, 0.50, "SF5", "", ""]
if out[5] == [] : out[5] = [0.70, 0.50, "SF6", "", ""]

# Affectez la sortie à la variable OUT.
OUT = out
# ----------------------------------------
code_block_27 = CodeBlock { "Informations"; 8; 2; }
exportExcel_3 = Data.ExportExcel(filePath=python_script_2, sheetName=code_block_27.out0, startRow=code_block_27.out1, startCol=code_block_27.out2, data=python_script_7)

python_script_8 = Python(IN[0]=python_script_5, IN[1]=python_script_6, IN[2]=python_script_7)
# ---------- python_script_8.python (48 lines) ----------
# Charger les bibliothèques DesignScript et Standard Python
import sys
import clr
clr.AddReference('ProtoGeometry')
from Autodesk.DesignScript.Geometry import *

# Les entrées effectuées dans ce noeud sont stockées sous forme de liste dans les variables IN.
dataEnteringNode = IN
lu = IN[0]
lb = IN[1]
sf = IN[2]

exclude = ["SF4", "SF5", "SF6", "LU1=CH", "LURf1=CH","LU2=CH", "LURf2=CH", "LU3", "LURf3", "LU3=CH", "LURf3=CH", "LB1=CH", "LBRf1=CH","LB2=CH", "LBRf2=CH", "LB3=CH", "LBRf3=CH",]

rep = [[],[],[]]

# Placer votre code au-dessous de cette ligne
for i in range(len(sf)):
	if sf[i][3] == "" and sf[i][2] not in exclude :
		rep[0].append(sf[i][2])

for i in range(len(lu)):
	if lu[i][1] == "" and lu[i][0] not in exclude :
		rep[1].append(lu[i][0])

for i in range(len(lb)):
	if lb[i][1] == "" and lb[i][0] not in exclude :
		rep[2].append(lb[i][0])

sfTxt = "> Semelle filante"
luTxt = "> Linteau U"
lbTxt = "> Linteau Béton"

for i in range(len(rep)):
	for k in range(len(rep[i])):
		if i == 0 :
			sfTxt = sfTxt+"\n• "+rep[i][k]
			
		if i == 1 :
			luTxt = luTxt+"\n• "+rep[i][k]
			
		if i == 2 :
			lbTxt = lbTxt+"\n• "+rep[i][k]
		
out = sfTxt+"\n\n"+luTxt+"\n\n"+lbTxt

# Affectez la sortie à la variable OUT.
OUT = out
# ----------------------------------------
code_block_28 = CodeBlock { "\n"; "> FD Non Standard"; "> ELEV Non Standard"; "> FENETRES / PORTES Non Standard"; }

# group: Filtre nomenclatures - Fondations
element_types_3 = ElementTypes("ViewSchedule")
all_elements_of_type_3 = ElementsOfType(element_type=element_types_3)
code_block_29 = CodeBlock(a=all_elements_of_type_3)
# ---------- code_block_29.designscript (14 lines) ----------
a.Name;
"1E - Attentes Fondations Poteaux";


"1E - Longrines";


"2C - Poteaux Tous Niveaux";


"2G - Poutres Tous Niveaux";


"3H - Portes - LB Non Standard";
# ----------------------------------------
code_block_30 = CodeBlock(name=code_block_29.out0, attFdPt=code_block_29.out1, longrine=code_block_29.out2, ptTousNiv=code_block_29.out3, poutre=code_block_29.out4, lbNonStd=code_block_29.out5) { name == attFdPt; name == longrine; name == ptTousNiv; name == poutre; name == lbNonStd; }

# group: Fondations - Attentes Poteaux
filterByBoolMask_6 = List.FilterByBoolMask(list=all_elements_of_type_3, mask=code_block_30.out0)
code_block_31 = CodeBlock { true; 0; }
getData_4 = Revit.Schedule.GetData(scheduleView=filterByBoolMask_6.in, removeHeading=code_block_31.out0)
removeItemAtIndex_5 = List.RemoveItemAtIndex(list=getData_4@L3, indices=code_block_31.out1)
code_block_32 = CodeBlock(l=removeItemAtIndex_5) { l[0]; }
isEmpty = List.IsEmpty(list=code_block_32)

code_block_33 = CodeBlock(isEmpty=isEmpty) { isEmpty ? "• -" : "• Fondations - Attentes Poteaux"; }

# group: Fondations - Longrines
filterByBoolMask_7 = List.FilterByBoolMask(list=all_elements_of_type_3, mask=code_block_30.out1)
code_block_34 = CodeBlock { true; 0; }
getData_5 = Revit.Schedule.GetData(scheduleView=filterByBoolMask_7.in, removeHeading=code_block_34.out0)
removeItemAtIndex_6 = List.RemoveItemAtIndex(list=getData_5@L3, indices=code_block_34.out1)
code_block_35 = CodeBlock(l=removeItemAtIndex_6) { l[0]; }
isEmpty_2 = List.IsEmpty(list=code_block_35)

code_block_36 = CodeBlock(isEmpty=isEmpty_2) { isEmpty ? "• -\n" : "• Fondations - Longrines\n"; }

# group: Elevation - Poteaux Tous Niveaux
filterByBoolMask_8 = List.FilterByBoolMask(list=all_elements_of_type_3, mask=code_block_30.out2)
code_block_37 = CodeBlock { true; 0; }
getData_6 = Revit.Schedule.GetData(scheduleView=filterByBoolMask_8.in, removeHeading=code_block_37.out0)
removeItemAtIndex_7 = List.RemoveItemAtIndex(list=getData_6@L3, indices=code_block_37.out1)
code_block_38 = CodeBlock(l=removeItemAtIndex_7) { l[0]; }
isEmpty_3 = List.IsEmpty(list=code_block_38)

code_block_39 = CodeBlock(isEmpty=isEmpty_3) { isEmpty ? "• -" : "• Elevation - Poteaux Tous Niveaux"; }

# group: Elevation - Poutres Tous Niveaux
filterByBoolMask_9 = List.FilterByBoolMask(list=all_elements_of_type_3, mask=code_block_30.out3)
code_block_40 = CodeBlock { true; 0; }
getData_7 = Revit.Schedule.GetData(scheduleView=filterByBoolMask_9.in, removeHeading=code_block_40.out0)
removeItemAtIndex_8 = List.RemoveItemAtIndex(list=getData_7@L3, indices=code_block_40.out1)
code_block_41 = CodeBlock(l=removeItemAtIndex_8) { l[0]; }
isEmpty_4 = List.IsEmpty(list=code_block_41)

code_block_42 = CodeBlock(isEmpty=isEmpty_4) { isEmpty ? "• -\n" : "• Elevation - Poutres Tous Niveaux\n"; }

# group: Fenêtres / Portes - LB Non Standard
filterByBoolMask_10 = List.FilterByBoolMask(list=all_elements_of_type_3, mask=code_block_30.out4)
code_block_43 = CodeBlock { true; 0; }
getData_8 = Revit.Schedule.GetData(scheduleView=filterByBoolMask_10.in, removeHeading=code_block_43.out0)
removeItemAtIndex_9 = List.RemoveItemAtIndex(list=getData_8@L3, indices=code_block_43.out1)
code_block_44 = CodeBlock(l=removeItemAtIndex_9) { l[0]; }
isEmpty_5 = List.IsEmpty(list=code_block_44)

code_block_45 = CodeBlock(isEmpty=isEmpty_5) { isEmpty ? "• -" : "• Fenêtres / Portes  - LB Non Standard"; }
join_2 = String.Join(separator=code_block_28.out0, string0=code_block_28.out1, string1=code_block_33, string2=code_block_36, string3=code_block_28.out2, string4=code_block_39, string5=code_block_42, string6=code_block_28.out3, string7=code_block_45)

# group: ProgressBar
python_script_progressbarutils = Python()
# ---------- python_script_progressbarutils.python (194 lines) ----------
import sys
import clr
import System
clr.AddReference('System.Drawing')
clr.AddReference('System.Windows.Forms')
import System.Drawing
import System.Windows.Forms

from System.Drawing import *
from System.Windows.Forms import *

from System.Windows.Forms import Application, Form, ProgressBar
from System.Threading import ThreadStart, Thread
from System import Int32, Int64

__author__ = "Cyril POUPIN"
__copyright__ = "Copyright (c) 2021 Cyril.P"
__license__ = "MIT License"
__version__ = "1.0.1"

class ProgressBarUtils():

	def __init__(self):
		pass
		
	def __name__(self):
		return 'ProgressBarUtils'
		

	class ProgressBarDialog(Form):
		def __init__(self, theBroadcaster, numberLines, myTitle ):
			self._numberLines = numberLines
			self._theBroadcaster = theBroadcaster
			self._theBroadcaster.onChange += self.myFunction
			self._myTitle = myTitle
			self.InitializeComponent()
			
		
		def InitializeComponent(self):
			self._buttonCancel = System.Windows.Forms.Button()
			self._progressBar1 = System.Windows.Forms.ProgressBar()
			self._label1 = System.Windows.Forms.Label()
			self._label2 = System.Windows.Forms.Label()
			self.SuspendLayout()
			# 
			# buttonCancel
			# 
			self._buttonCancel.Location = System.Drawing.Point(228, 96)
			self._buttonCancel.Name = "buttonCancel"
			self._buttonCancel.Size = System.Drawing.Size(116, 32)
			self._buttonCancel.TabIndex = 0
			self._buttonCancel.Text = "Quit"
			self._buttonCancel.UseVisualStyleBackColor = True
			self._buttonCancel.Click += self.ButtonCancelClick
			# 
			# progressBar1
			# 
			self._progressBar1.Location = System.Drawing.Point(12, 74)
			self._progressBar1.Name = "progressBar1"
			self._progressBar1.Size = System.Drawing.Size(535, 23)
			self._progressBar1.Minimum = 1
			self._progressBar1.Maximum = self._numberLines
			self._progressBar1.Step = 1
			self._progressBar1.Value = 1
			self._progressBar1.TabIndex = 1
			# 
			# label1
			# 
			self._label1.Location = System.Drawing.Point(12, 22)
			self._label1.Name = "label1"
			self._label1.Size = System.Drawing.Size(350, 23)
			self._label1.TabIndex = 2
			self._label1.Text = "Items Processing 0/" + str(self._numberLines)
			# 
			# label2
			# 
			self._label2.Location = System.Drawing.Point(12, 48)
			self._label2.Name = "label2"
			self._label2.Size = System.Drawing.Size(350, 23)
			self._label2.TabIndex = 2
			self._label2.Text = "Items Processing 0/" + str(self._numberLines)
			# 
			# MainForm
			# 
			self.ClientSize = System.Drawing.Size(567, 140)
			self.Controls.Add(self._label1)
			self.Controls.Add(self._label2)
			self.Controls.Add(self._progressBar1)
			#self.Controls.Add(self._buttonCancel)
			self.Name = "MainForm"
			self.Text = self._myTitle
			self.ResumeLayout(False)
			
		def myFunction(self):
		
			def stepText(step):
				return {
					1: "GENERAL - Informations projet",
					2: "GENERAL - Zone sismique",
					3: "GENERAL - SF Cadre ?",
					4: "GENERAL - SF Titan ?",
					5: "GENERAL - HA10 / HA14 ?",
					6: "FONDATIONS - SF",
					7: "FONDATIONS - M",
					8: "FONDATIONS - Pu",
					9: "FONDATIONS - Plancher Bas RDC",
					10: "FONDATIONS - Soubassements",
					11: "FONDATIONS - Attentes Fondations",
					12: "FONDATIONS - Attentes Fondations",
					13: "FONDATIONS - Liaisons Attentes",
					14: "FONDATIONS - Chaînage Plancher Bas RDC",
					15: "FONDATIONS - Chaînage Plancher Bas RDC",
					16: "ELEVATION - Plancher Haut Tous Niveaux",
					17: "ELEVATION - Murs Tous Niveaux",
					18: "ELEVATION - Raidisseurs & Attentes Tous Niveaux",
					19: "ELEVATION - Liaison Attentes",
					20: "ELEVATION - Chaînage Plancherr Haut Tous Niveaux",
					21: "ELEVATION - Chaînage Plancher Haut Tous Niveaux",
					22: "PORTES / FENETRES - LU Standard",
					23: "PORTES / FENETRES - LB Standard",
					24: "PORTES / FENETRES - Allèges",
					25: "PORTES / FENETRES - Seuile < 6cm (SATOV)",
				}[step]
		
			if self._progressBar1.Value < self._progressBar1.Maximum:
				self._progressBar1.Value += 1
				self._label1.Text = stepText(self._progressBar1.Value)
				self._label2.Text = "Progression {}/{}".format(str(self._progressBar1.Value), str(self._numberLines))
				try:
					Application.DoEvents()
				except:pass	
			else:
				self._theBroadcaster.onChange -= self.myFunction	
				self.Close()				
	
	
		def ButtonCancelClick(self, sender, e):
			self.Close()
			
	
			
	class EventHook():
		def __init__(self):
			self.__handlers = []
			
		def __iadd__(self, handler):
			self.__handlers.append(handler)
			return self
	
		def __isub__(self, handler):
			self.__handlers.remove(handler)
			return self
	
		def next_p(self, *args, **keywargs):
			for handler in self.__handlers:
				handler(*args, **keywargs)
	
		def clearObjectHandlers(self, inObject):
			for theHandler in self.__handlers:
				if theHandler.im_self == inObject:
					self -= theHandler
					
		def forceClearHandlers(self):
			for theHandler in self.__handlers:
				self -= theHandler
				
	
	class MyProgressBroadcaster():
		"""
		main Class to Start UI and build a custom Event with a  ContextManager
		"""
		def __init__(self, number_Iteration,  UI_Title = "Progress Bar"):
			if isinstance(number_Iteration, (Int32, Int64, int)):
				self._number_Iteration = number_Iteration
			else:
				raise Exception("MyProgressBroadcaster : wrong 1st argument need an integer")
			if isinstance(UI_Title, str):    
				self._title = UI_Title
			else:
				raise Exception("MyProgressBroadcaster : wrong 2nd argument need an string")
			self.purg = False
			
		def __enter__(self):		
			self.onChange = ProgressBarUtils.EventHook()	
			Application.EnableVisualStyles()
			f = ProgressBarUtils.ProgressBarDialog(self, self._number_Iteration, self._title)
			f.Show()
			return 	self
			
		def __exit__(self, type, value, traceback):
			self.onChange.forceClearHandlers()

					
OUT = ProgressBarUtils
# ----------------------------------------

# group (continued): Informations Projet
exportExcel_4 = Data.ExportExcel(filePath=python_script_2, sheetName=code_block_2.out0, startRow=code_block_2.out3, startCol=code_block_2.out4, data=code_block_6)
exportExcel_5 = Data.ExportExcel(filePath=python_script_2, sheetName=code_block_2.out1, startRow=code_block_2.out3, startCol=code_block_2.out4, data=code_block_6)
exportExcel_6 = Data.ExportExcel(filePath=python_script_2, sheetName=code_block_2.out2, startRow=code_block_2.out3, startCol=code_block_2.out4, data=code_block_6)
exportExcel_7 = Data.ExportExcel(filePath=python_script_2, sheetName=code_block_7.out0, startRow=code_block_7.out3, startCol=code_block_7.out4, data=getParameterValueByName_6)
exportExcel_8 = Data.ExportExcel(filePath=python_script_2, sheetName=code_block_7.out1, startRow=code_block_7.out3, startCol=code_block_7.out4, data=getParameterValueByName_6)
exportExcel_9 = Data.ExportExcel(filePath=python_script_2, sheetName=code_block_7.out2, startRow=code_block_7.out3, startCol=code_block_7.out4, data=getParameterValueByName_6)
exportExcel_10 = Data.ExportExcel(filePath=python_script_2, sheetName=code_block_8.out0, startRow=code_block_8.out3, startCol=code_block_8.out4, data=getParameterValueByName)
exportExcel_11 = Data.ExportExcel(filePath=python_script_2, sheetName=code_block_8.out1, startRow=code_block_8.out3, startCol=code_block_8.out4, data=getParameterValueByName)
exportExcel_12 = Data.ExportExcel(filePath=python_script_2, sheetName=code_block_8.out2, startRow=code_block_8.out3, startCol=code_block_8.out4, data=getParameterValueByName)

# group: Adresse du projet
code_block_46 = CodeBlock { "Attestation sismique"; 28; 2; }
code_block_47 = CodeBlock { Category.ByName("Informations sur le projet"); "Adresse du projet"; "Etude de sol"; }
all_elements_of_category_3 = ElementsOfCategory(Category=code_block_47.out0)
getParameterValueByName_7 = Element.GetParameterValueByName(element=all_elements_of_category_3, parameterName=code_block_47.out1)
exportExcel_13 = Data.ExportExcel(filePath=python_script_2, sheetName=code_block_46.out0, startRow=code_block_46.out1, startCol=code_block_46.out2, data=getParameterValueByName_7)

# group: Etude de sol
code_block_48 = CodeBlock { "Attestation sismique"; 40; 2; }
getParameterValueByName_8 = Element.GetParameterValueByName(element=all_elements_of_category_3, parameterName=code_block_47.out2)
code_block_49 = CodeBlock { "\n"; }
split_2 = String.Split(str=getParameterValueByName_8, separator0=code_block_49)
python_script_9 = Python(IN[0]=split_2)
# ---------- python_script_9.python (13 lines) ----------
# Charger les bibliothèques DesignScript et Standard Python
import sys
import clr
clr.AddReference('ProtoGeometry')
from Autodesk.DesignScript.Geometry import *

# Les entrées effectuées dans ce noeud sont stockées sous forme de liste dans les variables IN.
dataEnteringNode = IN

# Placer votre code au-dessous de cette ligne

# Affectez la sortie à la variable OUT.
OUT = " ".join(IN[0][0])
# ----------------------------------------
exportExcel_14 = Data.ExportExcel(filePath=python_script_2, sheetName=code_block_48.out0, startRow=code_block_48.out1, startCol=code_block_48.out2, data=python_script_9)

# group: Vérifié par
code_block_50 = CodeBlock { "Informations"; 1; 14; }
code_block_51 = CodeBlock { Category.ByName("Cartouches"); "Nom de la feuille"; }
all_elements_of_category_4 = ElementsOfCategory(Category=code_block_51.out0)
getParameterValueByName_9 = Element.GetParameterValueByName(element=all_elements_of_category_4, parameterName=code_block_51.out1)
code_block_52 = CodeBlock(name=getParameterValueByName_9) { name=="PARAMETRAGE"; "Vérifié par"; }
filterByBoolMask_11 = List.FilterByBoolMask(list=all_elements_of_category_4, mask=code_block_52.out0)
getParameterValueByName_10 = Element.GetParameterValueByName(element=filterByBoolMask_11.in, parameterName=code_block_52.out1)
exportExcel_15 = Data.ExportExcel(filePath=python_script_2, sheetName=code_block_50.out0, startRow=code_block_50.out1, startCol=code_block_50.out2, data=getParameterValueByName_10)

# group: Zone Sismique
code_block_53 = CodeBlock { "Informations"; 2; 2; }
code_block_54 = CodeBlock { Category.ByName("Cartouches"); "Nom de la feuille"; }
all_elements_of_category_5 = ElementsOfCategory(Category=code_block_54.out0)
getParameterValueByName_11 = Element.GetParameterValueByName(element=all_elements_of_category_5, parameterName=code_block_54.out1)
code_block_55 = CodeBlock(name=getParameterValueByName_11) { name=="PARAMETRAGE"; }
filterByBoolMask_12 = List.FilterByBoolMask(list=all_elements_of_category_5, mask=code_block_55)
code_block_56 = CodeBlock { "Zone 1/2"; "Zone 3"; "Zone 4"; }
getParameterValueByName_12 = Element.GetParameterValueByName(element=filterByBoolMask_12.in, parameterName=code_block_56.out0)
getParameterValueByName_13 = Element.GetParameterValueByName(element=filterByBoolMask_12.in, parameterName=code_block_56.out1)
getParameterValueByName_14 = Element.GetParameterValueByName(element=filterByBoolMask_12.in, parameterName=code_block_56.out2)
code_block_57 = CodeBlock(zone12=getParameterValueByName_12, zone3=getParameterValueByName_13, zone4=getParameterValueByName_14)
# ---------- code_block_57.designscript (7 lines) ----------
zone12 == 1 ?
	"Zone 1/2":
	zone3 == 1 ?
		"Zone 3" :
			zone4 == 1 ?
				"Zone 4":
					"Zone 1/2";
# ----------------------------------------
exportExcel_16 = Data.ExportExcel(filePath=python_script_2, sheetName=code_block_53.out0, startRow=code_block_53.out1, startCol=code_block_53.out2, data=code_block_57)

# group: SF Cadre ?
code_block_58 = CodeBlock { "Informations"; 2; 4; }
code_block_59 = CodeBlock { Category.ByName("Cartouches"); "Nom de la feuille"; }
all_elements_of_category_6 = ElementsOfCategory(Category=code_block_59.out0)
getParameterValueByName_15 = Element.GetParameterValueByName(element=all_elements_of_category_6, parameterName=code_block_59.out1)
code_block_60 = CodeBlock(name=getParameterValueByName_15) { name=="PARAMETRAGE"; }
filterByBoolMask_13 = List.FilterByBoolMask(list=all_elements_of_category_6, mask=code_block_60)
code_block_61 = CodeBlock { "SF Cadré"; }
getParameterValueByName_16 = Element.GetParameterValueByName(element=filterByBoolMask_13.in, parameterName=code_block_61)
code_block_62 = CodeBlock(cadre=getParameterValueByName_16) { cadre == 1 ? "OUI" : "NON"; }
exportExcel_17 = Data.ExportExcel(filePath=python_script_2, sheetName=code_block_58.out0, startRow=code_block_58.out1, startCol=code_block_58.out2, data=code_block_62)

# group: SF Titan ?
code_block_63 = CodeBlock { "Informations"; 2; 6; }
code_block_64 = CodeBlock { Category.ByName("Cartouches"); "Nom de la feuille"; }
all_elements_of_category_7 = ElementsOfCategory(Category=code_block_64.out0)
getParameterValueByName_17 = Element.GetParameterValueByName(element=all_elements_of_category_7, parameterName=code_block_64.out1)
code_block_65 = CodeBlock(name=getParameterValueByName_17) { name=="PARAMETRAGE"; }
filterByBoolMask_14 = List.FilterByBoolMask(list=all_elements_of_category_7, mask=code_block_65)
code_block_66 = CodeBlock { "SF Titan"; }
getParameterValueByName_18 = Element.GetParameterValueByName(element=filterByBoolMask_14.in, parameterName=code_block_66)
code_block_67 = CodeBlock(titan=getParameterValueByName_18) { titan == 1 ? "OUI" : "NON"; }
exportExcel_18 = Data.ExportExcel(filePath=python_script_2, sheetName=code_block_63.out0, startRow=code_block_63.out1, startCol=code_block_63.out2, data=code_block_67)

# group: HA10 / HA14 ?
code_block_68 = CodeBlock { "Informations"; 29; 14; }
code_block_69 = CodeBlock { Category.ByName("Cartouches"); "Nom de la feuille"; }
all_elements_of_category_8 = ElementsOfCategory(Category=code_block_69.out0)
getParameterValueByName_19 = Element.GetParameterValueByName(element=all_elements_of_category_8, parameterName=code_block_69.out1)
code_block_70 = CodeBlock(name=getParameterValueByName_19) { name=="PARAMETRAGE"; }
filterByBoolMask_15 = List.FilterByBoolMask(list=all_elements_of_category_8, mask=code_block_70)
code_block_71 = CodeBlock { "HA10 (Horizontaux)"; "HA14 (Horizontaux)"; "HA10 (Verticaux)"; "HA14 (Verticaux)"; }
getParameterValueByName_20 = Element.GetParameterValueByName(element=filterByBoolMask_15.in, parameterName=code_block_71.out0)
getParameterValueByName_21 = Element.GetParameterValueByName(element=filterByBoolMask_15.in, parameterName=code_block_71.out1)
getParameterValueByName_22 = Element.GetParameterValueByName(element=filterByBoolMask_15.in, parameterName=code_block_71.out2)
getParameterValueByName_23 = Element.GetParameterValueByName(element=filterByBoolMask_15.in, parameterName=code_block_71.out3)
python_script_10 = Python(IN[0]=getParameterValueByName_20, IN[1]=getParameterValueByName_21, IN[2]=getParameterValueByName_22, IN[3]=getParameterValueByName_23)
# ---------- python_script_10.python (57 lines) ----------
# Charger les bibliothèques DesignScript et Standard Python
import sys
import clr
clr.AddReference('ProtoGeometry')
from Autodesk.DesignScript.Geometry import *

# Les entrées effectuées dans ce noeud sont stockées sous forme de liste dans les variables IN.
dataEnteringNode = IN

ha10Hx = IN[0][0]
ha14Hx = IN[1][0]

ha10Vx = IN[2][0]
ha14Vx = IN[3][0]

tmp = []
out = []

# Placer votre code au-dessous de cette ligne
if ha10Hx == 1 and ha14Hx == 0:
	for i in range(11):
		tmp.append("HA10")
	out.append(tmp)
	tmp = []
	for i in range(8):
		if i != 4:
			tmp.append("HA10")
		else:
			tmp.append("")
	out.append(tmp)
	tmp = []
	
elif ha10Hx == 0 and ha14Hx == 1:
	for i in range(11):
		tmp.append("HA14")
	out.append(tmp)
	tmp = []
	for i in range(8):
		if i != 4:
			tmp.append("HA14")
		else:
			tmp.append("")
	out.append(tmp)
	tmp = []
	
# ---------------
	
if ha10Vx == 1 and ha14Vx == 0:
	for i in range(2):
		out.append("HA10")
	
elif ha10Vx == 0 and ha14Vx == 1:
	for i in range(2):
		out.append("HA14")
	
# Affectez la sortie à la variable OUT.
OUT = out
# ----------------------------------------
code_block_72 = CodeBlock(l=python_script_10)
# ---------- code_block_72.designscript (8 lines) ----------
// FD Hx
l[0];
// Elev Hx
l[1];
// FD Vx
l[2];
// Elev Vx
l[3];
# ----------------------------------------
exportExcel_19 = Data.ExportExcel(filePath=python_script_2, sheetName=code_block_68.out0, startRow=code_block_68.out1, startCol=code_block_68.out2, data=code_block_72.out0)
code_block_73 = CodeBlock { "Informations"; 65; 6; }
exportExcel_20 = Data.ExportExcel(filePath=python_script_2, sheetName=code_block_73.out0, startRow=code_block_73.out1, startCol=code_block_73.out2, data=code_block_72.out1)
code_block_74 = CodeBlock { "Informations"; 11; 17; }
exportExcel_21 = Data.ExportExcel(filePath=python_script_2, sheetName=code_block_74.out0, startRow=code_block_74.out1, startCol=code_block_74.out2, data=code_block_72.out2)
code_block_75 = CodeBlock { "Informations"; 47; 9; }
exportExcel_22 = Data.ExportExcel(filePath=python_script_2, sheetName=code_block_75.out0, startRow=code_block_75.out1, startCol=code_block_75.out2, data=code_block_72.out3)

list_create = List.Create(item0=exportExcel_4, item1=exportExcel_5, item2=exportExcel_6, item3=exportExcel_7, item4=exportExcel_8, item5=exportExcel_9, item6=exportExcel_10, item7=exportExcel_11, item8=exportExcel_12, item9=exportExcel_13, item10=exportExcel_14, item11=exportExcel_15, item12=exportExcel_16, item13=exportExcel_17, item14=exportExcel_18, item15=exportExcel_19, item16=exportExcel_20, item17=exportExcel_21, item18=exportExcel_22)

# group: Fondations - SF
code_block_76 = CodeBlock { "Informations"; 8; 7; }
filterByBoolMask_16 = List.FilterByBoolMask(list=all_elements_of_type_2, mask=code_block_25.out0)
code_block_77 = CodeBlock { true; 0; }
getData_9 = Revit.Schedule.GetData(scheduleView=filterByBoolMask_16.in, removeHeading=code_block_77.out0)
removeItemAtIndex_10 = List.RemoveItemAtIndex(list=getData_9@L3, indices=code_block_77.out1)
python_script_11 = Python(IN[0]=removeItemAtIndex_10)
# ---------- python_script_11.python (54 lines) ----------
# Charger les bibliothèques DesignScript et Standard Python
import sys
import clr
clr.AddReference('ProtoGeometry')
from Autodesk.DesignScript.Geometry import *
from math import *

# Les entrées effectuées dans ce noeud sont stockées sous forme de liste dans les variables IN.
dataEnteringNode = IN
data = IN[0]

# Définition de la taille du tableau à retourner
out = [[],[],[],[],[],[]]

# Fonction arrondi personalisée
def myround(x, base=0.05):
    return base * ceil(float(x)/base)

# Boucle parcourant chaque ligne de la nomenclature
for i in range(len(data[0])):
	
	# Récupération de la valeur de chaque paramètre
	repere = data[0][i][2]
	recouvrement = data[0][i][6]
	
	if repere == "SF1":
		out[0] = [recouvrement]
		
	if repere == "SF2":
		out[1] = [recouvrement]
		
	if repere == "SF3":
		out[2] = [recouvrement]	
	
	if repere == "SF4":
		out[3] = [recouvrement]
		
	if repere == "SF5":
		out[4] = [recouvrement]
		
	if repere == "SF6":
		out[5] = [recouvrement]
		
		
# valeur par défaut si vide
if out[0] == [] : out[0] = [""]
if out[1] == [] : out[1] = [""]
if out[2] == [] : out[2] = [""]
if out[3] == [] : out[3] = [""]
if out[4] == [] : out[4] = [""]
if out[5] == [] : out[5] = [""]

# Affectez la sortie à la variable OUT.
OUT = out
# ----------------------------------------
exportExcel_23 = Data.ExportExcel(filePath=python_script_2, sheetName=code_block_76.out0, startRow=code_block_76.out1, startCol=code_block_76.out2, data=python_script_11)

# group: Fondations - M
code_block_78 = CodeBlock { "Informations"; 29; 2; }
filterByBoolMask_17 = List.FilterByBoolMask(list=all_elements_of_type_2, mask=code_block_25.out1)
code_block_79 = CodeBlock { true; 0; }
getData_10 = Revit.Schedule.GetData(scheduleView=filterByBoolMask_17.in, removeHeading=code_block_79.out0)
removeItemAtIndex_11 = List.RemoveItemAtIndex(list=getData_10@L3, indices=code_block_79.out1)
python_script_12 = Python(IN[0]=removeItemAtIndex_11)
# ---------- python_script_12.python (54 lines) ----------
# Charger les bibliothèques DesignScript et Standard Python
import sys
import clr
clr.AddReference('ProtoGeometry')
from Autodesk.DesignScript.Geometry import *

# Les entrées effectuées dans ce noeud sont stockées sous forme de liste dans les variables IN.
dataEnteringNode = IN
data = IN[0]

# Définition de la taille du tableau à retourner
out = [[],[],[],[],[],[],[]]

# Boucle parcourant chaque ligne de la nomenclature
for i in range(len(data[0])):
	
	# Récupération de la valeur de chaque paramètre
	longueur = data[0][i][0]
	largeur = data[0][i][1]
	hauteur = data[0][i][2]
	repere = data[0][i][3]
	
	if repere == "M0":
		out[0] = [longueur, largeur, hauteur, repere]
		
	if repere == "M1":
		out[1] = [longueur, largeur, hauteur, repere]
		
	if repere == "M2":
		out[2] = [longueur, largeur, hauteur, repere]
		
	if repere == "M3":
		out[3] = [longueur, largeur, hauteur, repere]
		
	if repere == "M4":
		out[4] = [longueur, largeur, hauteur, repere]
		
	if repere == "M5":
		out[5] = [longueur, largeur, hauteur, repere]
		
	if repere == "M6":
		out[6] = [longueur, largeur, hauteur, repere]

# valeur par défaut si vide
if out[0] == [] : out[0] = [0.60, 1.00, 0.25, "M0"]
if out[1] == [] : out[1] = [0.80, 0.80, 0.25, "M1"]
if out[2] == [] : out[2] = [0.90, 0.90, 0.25, "M2"]
if out[3] == [] : out[3] = [1.00, 1.00, 0.25, "M3"]
if out[4] == [] : out[4] = [1.10, 1.10, 0.25, "M4"]
if out[5] == [] : out[5] = [1.20, 1.20, 0.25, "M5"]
if out[6] == [] : out[6] = [0.80, 0.80, 0.25, "M6"]

# Affectez la sortie à la variable OUT.
OUT = out
# ----------------------------------------
exportExcel_24 = Data.ExportExcel(filePath=python_script_2, sheetName=code_block_78.out0, startRow=code_block_78.out1, startCol=code_block_78.out2, data=python_script_12)
code_block_80 = CodeBlock { "Informations"; 29; 6; }
python_script_13 = Python(IN[0]=removeItemAtIndex_11)
# ---------- python_script_13.python (113 lines) ----------
# Charger les bibliothèques DesignScript et Standard Python
import sys
import clr
clr.AddReference('ProtoGeometry')
from Autodesk.DesignScript.Geometry import *

# Les entrées effectuées dans ce noeud sont stockées sous forme de liste dans les variables IN.
dataEnteringNode = IN
data = IN[0]

# Définition de la taille du tableau à retourner
out = [["",""],["",""],["",""],["",""],["",""],["",""],["",""]]

# Boucle parcourant chaque ligne de la nomenclature
for i in range(len(data[0])):
	
	# Récupération de la valeur de chaque paramètre
	repere = data[0][i][3]
	niveau = data[0][i][7]
	nb = int(data[0][i][5])
	#ssDalle = data[0][i][5] if "Ai RDC" in niveau else 0
	#ssLibage = data[0][i][5] if "Ai RDC" not in niveau else 0
	
	if repere == "M0":
		if "Ai.RDC" in niveau or "Ai.SS" in niveau :
			if out[0][0] == "" :
				out[0][0] = nb 
			else :
				out[0][0] += nb
		else:
			if out[0][1] == "" :
				out[0][1] = nb 
			else :
				out[0][1] += nb
		
	if repere == "M1":
		if "Ai.RDC" in niveau or "Ai.SS" in niveau :
			if out[1][0] == "" :
				out[1][0] = nb 
			else :
				out[1][0] += nb
		else:
			if out[1][1] == "" :
				out[1][1] = nb 
			else :
				out[1][1] += nb
		
	if repere == "M2":
		if "Ai.RDC" in niveau or "Ai.SS" in niveau :
			if out[2][0] == "" :
				out[2][0] = nb 
			else :
				out[2][0] += nb
		else:
			if out[2][1] == "" :
				out[2][1] = nb 
			else :
				out[2][1] += nb
		
	if repere == "M3":
		if "Ai.RDC" in niveau or "Ai.SS" in niveau :
			if out[3][0] == "" :
				out[3][0] = nb 
			else :
				out[3][0] += nb
		else:
			if out[3][1] == "" :
				out[3][1] = nb 
			else :
				out[3][1] += nb
				
	if repere == "M4":
		if "Ai.RDC" in niveau or "Ai.SS" in niveau :
			if out[4][0] == "" :
				out[4][0] = nb 
			else :
				out[4][0] += nb
		else:
			if out[4][1] == "" :
				out[4][1] = nb 
			else :
				out[4][1] += nb
				
	if repere == "M5":
		if "Ai.RDC" in niveau or "Ai.SS" in niveau :
			if out[5][0] == "" :
				out[5][0] = nb 
			else :
				out[5][0] += nb
		else:
			if out[5][1] == "" :
				out[5][1] = nb 
			else :
				out[5][1] += nb
		
	if repere == "M6":
			out[6][0] = ""
			if out[5][1] == "" :
				out[6][1] = nb 
			else :
				out[6][1] += nb

# valeur par défaut si vide
if out[0] == [] : out[0] = ["",""]
if out[1] == [] : out[1] = ["",""]
if out[2] == [] : out[2] = ["",""]
if out[3] == [] : out[3] = ["",""]
if out[4] == [] : out[4] = ["",""]
if out[5] == [] : out[5] = ["",""]
if out[6] == [] : out[6] = ["",""]

# Affectez la sortie à la variable OUT.
OUT = out
# ----------------------------------------
exportExcel_25 = Data.ExportExcel(filePath=python_script_2, sheetName=code_block_80.out0, startRow=code_block_80.out1, startCol=code_block_80.out2, data=python_script_13)

# group: Fondations - Pu
code_block_81 = CodeBlock { "Informations"; 36; 3; }
filterByBoolMask_18 = List.FilterByBoolMask(list=all_elements_of_type_2, mask=code_block_25.out2)
code_block_82 = CodeBlock { true; 0; }
getData_11 = Revit.Schedule.GetData(scheduleView=filterByBoolMask_18.in, removeHeading=code_block_82.out0)
removeItemAtIndex_12 = List.RemoveItemAtIndex(list=getData_11@L3, indices=code_block_82.out1)
python_script_14 = Python(IN[0]=removeItemAtIndex_12)
# ---------- python_script_14.python (42 lines) ----------
# Charger les bibliothèques DesignScript et Standard Python
import sys
import clr
clr.AddReference('ProtoGeometry')
from Autodesk.DesignScript.Geometry import *

# Les entrées effectuées dans ce noeud sont stockées sous forme de liste dans les variables IN.
dataEnteringNode = IN
data = IN[0]

# Définition de la taille du tableau à retourner
out = [[],[],[],[]]

# Boucle parcourant chaque ligne de la nomenclature
for i in range(len(data[0])):
	
	# Récupération de la valeur de chaque paramètre
	largeur = data[0][i][0]
	hauteur = data[0][i][1]
	repere = data[0][i][2]
	nb = data[0][i][4]
	
	if repere == "Pu1":
		out[0] = [largeur, hauteur, repere, "", nb]
	
	if repere == "Pu2":
		out[1] = [largeur, hauteur, repere, "", nb]
	
	if repere == "Pu3":
		out[2] = [largeur, hauteur, repere, "", nb]
	
	if repere == "Pu4":
		out[3] = [largeur, hauteur, repere, "", nb]
		
# valeur par défaut si vide
if out[0] == [] : out[0] = [0.80, 0.30, "Pu1", "", ""]
if out[1] == [] : out[1] = [1.00, 0.30, "Pu2", "", ""]
if out[2] == [] : out[2] = [1.20, 0.30, "Pu3", "", ""]
if out[3] == [] : out[3] = [1.40, 0.30, "Pu4", "", ""]

# Affectez la sortie à la variable OUT.
OUT = out
# ----------------------------------------
exportExcel_26 = Data.ExportExcel(filePath=python_script_2, sheetName=code_block_81.out0, startRow=code_block_81.out1, startCol=code_block_81.out2, data=python_script_14)

# group: Fondations - Plancher Bas RDC
code_block_83 = CodeBlock { "Informations"; 8; 20; }
filterByBoolMask_19 = List.FilterByBoolMask(list=all_elements_of_type_2, mask=code_block_25.out3)
code_block_84 = CodeBlock { true; 0; }
getData_12 = Revit.Schedule.GetData(scheduleView=filterByBoolMask_19.in, removeHeading=code_block_84.out0)
removeItemAtIndex_13 = List.RemoveItemAtIndex(list=getData_12@L3, indices=code_block_84.out1)
python_script_15 = Python(IN[0]=removeItemAtIndex_13)
# ---------- python_script_15.python (50 lines) ----------
# Charger les bibliothèques DesignScript et Standard Python
import sys
import clr
clr.AddReference('ProtoGeometry')
from Autodesk.DesignScript.Geometry import *
from math import *

# Les entrées effectuées dans ce noeud sont stockées sous forme de liste dans les variables IN.
dataEnteringNode = IN
data = IN[0]

# Définition de la taille du tableau à retourner
out = []

res = []

# Fonction arrondi personalisée
def myround(x, base=0.05):
    return base * ceil(float(x)/base)
    
# Fonction arrondi personalisée
def rep(repere):
	if repere == "Radier":
		return "RADIER"
	elif repere == "Vide Sanitaire":
		return "VS"
	elif repere == "Dalle Champignon":
		return "CHAMPI"
	elif repere == "Dalle Liaisonnée":
		return "LIAISON"
	elif repere == "Dalle portée":
		return "PORTEE"
	elif repere == "Dallage Industriel":
		return "INDUS"
	else:
		return ""

# Boucle parcourant chaque ligne de la nomenclature
for i in range(len(data[0])):
	
	# Récupération de la valeur de chaque paramètre
	repere = rep(data[0][i][2])
	epaisseur = float((data[0][i][0].split("-")[1]).split("cm")[0])/100 if data[0][i][0].split("-")[0] != "VS" else (float((data[0][i][0].split("-")[1]).split("+")[0])+float(((data[0][i][0].split("-")[1]).split("+")[1]).split("cm")[0]))/100
	surface = myround(data[0][i][1].split(" m²")[0])

	out.append([repere,epaisseur, surface])


# Affectez la sortie à la variable OUT.
OUT = out
# ----------------------------------------
exportExcel_27 = Data.ExportExcel(filePath=python_script_2, sheetName=code_block_83.out0, startRow=code_block_83.out1, startCol=code_block_83.out2, data=python_script_15)

# group: Fondations - Soubassements
code_block_85 = CodeBlock { "Informations"; 8; 9; }
filterByBoolMask_20 = List.FilterByBoolMask(list=all_elements_of_type_2, mask=code_block_25.out4)
code_block_86 = CodeBlock { true; 0; }
getData_13 = Revit.Schedule.GetData(scheduleView=filterByBoolMask_20.in, removeHeading=code_block_86.out0)
removeItemAtIndex_14 = List.RemoveItemAtIndex(list=getData_13@L3, indices=code_block_86.out1)
python_script_16 = Python(IN[0]=removeItemAtIndex_14)
# ---------- python_script_16.python (65 lines) ----------
# Charger les bibliothèques DesignScript et Standard Python
import sys
import clr
clr.AddReference('ProtoGeometry')
from Autodesk.DesignScript.Geometry import *
from math import *

# Les entrées effectuées dans ce noeud sont stockées sous forme de liste dans les variables IN.
dataEnteringNode = IN
data = IN[0]

# Définition de la taille du tableau à retourner
out = [[],[],[],[],[],[],[],[],[]]

# Fonction arrondi personalisée
def myround(x, base=0.05):
    return base * ceil(float(x)/base)
   
# Boucle parcourant chaque ligne de la nomenclature
for i in range(len(data[0])):
	
	# Récupération de la valeur de chaque paramètre
	repere = data[0][i][0].split("cm")[0]
	epaisseur = data[0][i][1]
	surface = ceil(float(data[0][i][2].split(" m²")[0]))

	if repere == "MAP-15":
		out[0] = [repere, "", surface]
	
	if repere == "MAP-20":
		out[1] = [repere, "", surface]
	
	if repere == "VB-15":
		out[2] = [repere, 0.10, surface]
	
	if repere == "BAB-20":
		out[3] = [repere, 0.12, surface]
	
	if repere == "BAB-25":
		out[4] = [repere, 0.17, surface]
	
	if repere == "BAB-30":
		out[5] = [repere, 0.22, surface]

	if repere.StartsWith("MB"):
		if out[6] == []:
			out[6] = [repere, epaisseur, surface]
		elif out[7] == []:
			out[7] = [repere, epaisseur, surface]
		else:
			out[8] = [repere, epaisseur, surface]
		
# valeur par défaut si vide
if out[0] == [] : out[0] = ["MAP-15", "", ""]
if out[1] == [] : out[1] = ["MAP-20", "", ""] 
if out[2] == [] : out[2] = ["VB-15", 0.10, ""] 
if out[3] == [] : out[3] = ["BAB-20", 0.12, ""] 
if out[4] == [] : out[4] = ["BAB-25", 0.17, ""] 
if out[5] == [] : out[5] = ["BAB-30", 0.22, ""] 
if out[6] == [] : out[6] = ["MB", "", ""] 
if out[7] == [] : out[7] = ["MB", "", ""] 
if out[8] == [] : out[8] = ["MB", "", ""] 

# Affectez la sortie à la variable OUT.
OUT = out
# ----------------------------------------
exportExcel_28 = Data.ExportExcel(filePath=python_script_2, sheetName=code_block_85.out0, startRow=code_block_85.out1, startCol=code_block_85.out2, data=python_script_16)

# group: Fondations - Attentes Fondations
code_block_87 = CodeBlock { "Informations"; 8; 13; }
filterByBoolMask_21 = List.FilterByBoolMask(list=all_elements_of_type_2, mask=code_block_25.out5)
code_block_88 = CodeBlock { true; 0; }
getData_14 = Revit.Schedule.GetData(scheduleView=filterByBoolMask_21.in, removeHeading=code_block_88.out0)
removeItemAtIndex_15 = List.RemoveItemAtIndex(list=getData_14@L3, indices=code_block_88.out1)
python_script_17 = Python(IN[0]=removeItemAtIndex_15)
# ---------- python_script_17.python (86 lines) ----------
# Charger les bibliothèques DesignScript et Standard Python
import sys
import clr
clr.AddReference('ProtoGeometry')
from Autodesk.DesignScript.Geometry import *
from math import *

# Les entrées effectuées dans ce noeud sont stockées sous forme de liste dans les variables IN.
dataEnteringNode = IN
data = IN[0]

# Définition de la taille du tableau à retourner
out = [[],[],[],[],[],[],[],[],[],[],[],[],[],[]]

# Fonction arrondi personalisée
def myround(x, base=0.05):
    return base * ceil(float(x)/base)
    
# Boucle parcourant chaque ligne de la nomenclature    
for i in range(len(data[0])):
	
	# Récupération de la valeur de chaque paramètre
	repere = data[0][i][0]
	nombre = data[0][i][1]
	longueur = myround(data[0][i][2])

	if repere == "a1":
		out[0] = ["\""+repere+"\"", nombre, longueur]
	
	if repere == "a1a":
		out[1] = ["\""+repere+"\"", nombre, longueur]
	
	if repere == "a2":
		out[2] = ["\""+repere+"\"", nombre, ""]
	
	if repere == "a3":
		out[3] = ["\""+repere+"\"", nombre, longueur]
	
	if repere == "a3a":
		out[4] = ["\""+repere+"\"", nombre, longueur]
	
	if repere == "a4":
		out[5] = ["\""+repere+"\"", nombre, longueur]
	
	if repere == "a4a":
		out[6] = ["\""+repere+"\"", nombre, longueur]
	
	if repere == "a5":
		out[7] = ["\""+repere+"\"", nombre, longueur]
	
	if repere == "b1":
		out[8] = ["\""+repere+"\"", nombre, longueur]
	
	if repere == "b1a":
		out[9] = ["\""+repere+"\"", nombre, longueur]
	
	if repere == "b4":
		out[10] = ["\""+repere+"\"", nombre, longueur]
	
	if repere == "b4a":
		out[11] = ["\""+repere+"\"", nombre, longueur]
	
	if repere == "b3":
		out[12] = ["\""+repere+"\"", nombre, longueur]
	
	if repere == "b3a":
		out[13] = ["\""+repere+"\"", nombre, longueur]
		
# valeur par défaut si vide
if out[0] == [] : out[0] = ["\"a1\"", "", ""]
if out[1] == [] : out[1] = ["\"a1a\"", "", ""]
if out[2] == [] : out[2] = ["\"a2\"", "", ""]
if out[3] == [] : out[3] = ["\"a3\"", "", ""] 
if out[4] == [] : out[4] = ["\"a3a\"", "", ""] 
if out[5] == [] : out[5] = ["\"a4\"", "", ""] 
if out[6] == [] : out[6] = ["\"a4a\"", "", ""]
if out[7] == [] : out[7] = ["\"a5\"", "", ""]
if out[8] == [] : out[8] = ["\"b1\"", "", ""]
if out[9] == [] : out[9] = ["\"b1a\"", "", ""]
if out[10] == [] : out[10] = ["\"b4\"", "", ""]
if out[11] == [] : out[11] = ["\"b4a\"", "", ""]
if out[12] == [] : out[12] = ["\"b3\"", "", ""]
if out[13] == [] : out[13] = ["\"b3a\"", "", ""]

# Affectez la sortie à la variable OUT.
OUT = out
# ----------------------------------------
exportExcel_29 = Data.ExportExcel(filePath=python_script_2, sheetName=code_block_87.out0, startRow=code_block_87.out1, startCol=code_block_87.out2, data=python_script_17)

# group: Fondations - Ht. max "a1a" / "a3a" / "a4a" / "b1a" / "b3a" / "b4a"
code_block_89 = CodeBlock { "Informations"; [9, 12, 14, 17, 19, 21]; 16; }
filterByBoolMask_22 = List.FilterByBoolMask(list=all_elements_of_type_2, mask=code_block_25.out6)
code_block_90 = CodeBlock { true; 0; }
getData_15 = Revit.Schedule.GetData(scheduleView=filterByBoolMask_22.in, removeHeading=code_block_90.out0)
removeItemAtIndex_16 = List.RemoveItemAtIndex(list=getData_15@L3, indices=code_block_90.out1)
python_script_18 = Python(IN[0]=removeItemAtIndex_16)
# ---------- python_script_18.python (54 lines) ----------
# Charger les bibliothèques DesignScript et Standard Python
import sys
import clr
clr.AddReference('ProtoGeometry')
from Autodesk.DesignScript.Geometry import *
from math import *

# Les entrées effectuées dans ce noeud sont stockées sous forme de liste dans les variables IN.
dataEnteringNode = IN
data = IN[0]

# Définition de la taille du tableau à retourner
out = [[],[],[],[],[],[]]

# Fonction arrondi personalisée
def myround(x, base=0.05):
    return base * ceil(float(x)/base)
    
# Boucle parcourant chaque ligne de la nomenclature
for i in range(len(data)):
	
	# Récupération de la valeur de chaque paramètre
	repere = data[i][0][0] if data[i] != [] else ""
	hauteur = myround(data[i][0][1]) if data[i] != [] else ""

	if repere == "a1a":
		out[0] = [hauteur]
	
	if repere == "a3a":
		out[1] = [hauteur]
	
	if repere == "a4a":
		out[2] = [hauteur]
	
	if repere == "b1a":
		out[3] = [hauteur]
	
	if repere == "b4a":
		out[4] = [hauteur]
	
	if repere == "b3a":
		out[5] = [hauteur]
	
		
# valeur par défaut si vide
if out[0] == [] : out[0] = [""]
if out[1] == [] : out[1] = [""]
if out[2] == [] : out[2] = [""]
if out[3] == [] : out[3] = [""]
if out[4] == [] : out[4] = [""]
if out[5] == [] : out[5] = [""]

# Affectez la sortie à la variable OUT.
OUT = out
# ----------------------------------------
exportExcel_30 = Data.ExportExcel(filePath=python_script_2, sheetName=code_block_89.out0, startRow=code_block_89.out1@L1, startCol=code_block_89.out2, data=python_script_18@L1)

# group: Fondations - Liaisons attentes
code_block_91 = CodeBlock { "Informations"; 20; 7; }
filterByBoolMask_23 = List.FilterByBoolMask(list=all_elements_of_type_2, mask=code_block_25.out7)
code_block_92 = CodeBlock { true; 0; }
getData_16 = Revit.Schedule.GetData(scheduleView=filterByBoolMask_23.in, removeHeading=code_block_92.out0)
removeItemAtIndex_17 = List.RemoveItemAtIndex(list=getData_16@L3, indices=code_block_92.out1)
python_script_19 = Python(IN[0]=removeItemAtIndex_17)
# ---------- python_script_19.python (15 lines) ----------
# Charger les bibliothèques DesignScript et Standard Python
import sys
import clr
clr.AddReference('ProtoGeometry')
from Autodesk.DesignScript.Geometry import *
from math import *

# Les entrées effectuées dans ce noeud sont stockées sous forme de liste dans les variables IN.
dataEnteringNode = IN
data = IN[0]

# Affectez la sortie à la variable OUT.
OUT=data[0]

OUT = [data[0][0][0],data[0][0][1],data[0][0][2],data[0][0][3]] if data else []
# ----------------------------------------
exportExcel_31 = Data.ExportExcel(filePath=python_script_2, sheetName=code_block_91.out0, startRow=code_block_91.out1, startCol=code_block_91.out2, data=python_script_19)

# group: Fondations - Chainage Plancher Bas RDC - CHP + CHPa
code_block_93 = CodeBlock { "Informations"; 29; 9; }
filterByBoolMask_24 = List.FilterByBoolMask(list=all_elements_of_type_2, mask=code_block_25.out8)
code_block_94 = CodeBlock { true; 0; }
getData_17 = Revit.Schedule.GetData(scheduleView=filterByBoolMask_24.in, removeHeading=code_block_94.out0)
removeItemAtIndex_18 = List.RemoveItemAtIndex(list=getData_17@L3, indices=code_block_94.out1)
python_script_20 = Python(IN[0]=removeItemAtIndex_18)  # unwired: IN[1]
# ---------- python_script_20.python (137 lines) ----------
# Charger les bibliothèques DesignScript et Standard Python
import sys
import clr
clr.AddReference('ProtoGeometry')
from Autodesk.DesignScript.Geometry import *
from math import *

# Les entrées effectuées dans ce noeud sont stockées sous forme de liste dans les variables IN.
dataEnteringNode = IN
data = IN[0]
pb = IN[1]

# Définition de la taille du tableau à retourner
out = [[],[],[],[],[],[],[],[],[],[]]

# Fonction arrondi personalisée
def myround(x, base=0.05):
    return base * ceil(float(x)/base)
    
# Boucle parcourant chaque ligne de la nomenclature
for i in range(len(data[0])):
	
	# Récupération de la valeur de chaque paramètre
	repere = data[0][i][0]
	largeur = float((data[0][i][1].split("x")[0]))/100
	hauteur = float((data[0][i][1].split("x")[1]).split("ht")[0])/100
	lgCHP = myround(data[0][i][2])
	recouvrementCHP = int(data[0][i][3])
	lgCHPa = myround(data[0][i][4])
	recouvrementCHPa = int(data[0][i][5])

	if repere == "CHP1":
		if out[0] == []:
			lChp = lgCHP
			rChp = recouvrementCHP
		else:
			lChp = out[0][3]+lgCHP
			rChp = out[0][4]+recouvrementCHP
			
		if out[1] == []:
			lChpa = lgCHPa
			rChpa = recouvrementCHPa
		else:
			lChpa = out[1][3]+lgCHPa
			rChpa = out[1][4]+recouvrementCHPa
			

		out[0] = [largeur, hauteur, "CHP1", lChp, rChp]
		out[1] = [largeur, hauteur, "CHP1a", lChpa, rChpa]
			
	if repere == "CHP1a":
		if out[0] == []:
			lChp = lgCHP
			rChp = recouvrementCHP
		else:
			lChp = out[0][3]+lgCHP
			rChp = out[0][4]+recouvrementCHP
			
		if out[1] == []:
			lChpa = lgCHPa
			rChpa = recouvrementCHPa
		else:
			lChpa = out[1][3]+lgCHPa
			rChpa = out[1][4]+recouvrementCHPa
			

		out[0] = [largeur, hauteur, "CHP1", lChp, rChp]
		out[1] = [largeur, hauteur, "CHP1a", lChpa, rChpa]
	
	if repere == "CHP2":
		if out[2] == []:
			lChp = lgCHP
			rChp = recouvrementCHP
		else:
			lChp = out[2][3]+lgCHP
			rChp = out[2][4]+recouvrementCHP
			
		if out[3] == []:
			lChpa = lgCHPa
			rChpa = recouvrementCHPa
		else:
			lChpa = out[3][3]+lgCHPa
			rChpa = out[3][4]+recouvrementCHPa

		out[2] = [largeur, hauteur, "CHP2", lChp, rChp]
		out[3] = [largeur, hauteur, "CHP2a", lChpa, rChpa]

	if repere == "CHP2a":
		if out[2] == []:
			lChp = lgCHP
			rChp = recouvrementCHP
		else:
			lChp = out[2][3]+lgCHP
			rChp = out[2][4]+recouvrementCHP
			
		if out[3] == []:
			lChpa = lgCHPa
			rChpa = recouvrementCHPa
		else:
			lChpa = out[3][3]+lgCHPa
			rChpa = out[3][4]+recouvrementCHPa

		out[2] = [largeur, hauteur, "CHP2", lChp, rChp]
		out[3] = [largeur, hauteur, "CHP2a", lChpa, rChpa]
		
	if repere == "CHP3":
		out[4] = [largeur, hauteur, repere, lgCHP, recouvrementCHP]
		
	if repere == "CHP4":
		out[5] = [largeur, hauteur, repere, lgCHP, recouvrementCHP]
		
	if repere == "CHP5":
		out[6] = [largeur, hauteur, repere, lgCHP, recouvrementCHP]
		
	if repere == "CHP6":
		out[7] = [largeur, hauteur, repere, lgCHP, recouvrementCHP]
		
	if repere == "CHP7":
		out[8] = [largeur, hauteur, repere, lgCHP, recouvrementCHP]
		
	if repere == "CHP8":
		out[9] = [largeur, hauteur, repere, lgCHP, recouvrementCHP]
		
# valeur par défaut si vide
if out[0] == [] : out[0] = [0.20, 0.00, "CHP1", "", ""]
if out[1] == [] : out[1] = [0.20, 0.00, "CHP1a", "", ""]
if out[2] == [] : out[2] = [0.20, 0.00, "CHP2", "", ""]
if out[3] == [] : out[3] = [0.20, 0.00, "CHP2a", "", ""]
if out[4] == [] : out[4] = [0.20, "", "CHP3", "", ""]
if out[5] == [] : out[5] = [0.20, "", "CHP4", "", ""]
if out[6] == [] : out[6] = [0.20, "", "CHP5", "", ""]
if out[7] == [] : out[7] = [0.20, "", "CHP6", "", ""]
if out[8] == [] : out[8] = [0.20, "", "CHP7", "", ""]
if out[9] == [] : out[9] = [0.20, "", "CHP8", "", ""]

# Affectez la sortie à la variable OUT.
OUT = out
# ----------------------------------------
exportExcel_32 = Data.ExportExcel(filePath=python_script_2, sheetName=code_block_93.out0, startRow=code_block_93.out1, startCol=code_block_93.out2, data=python_script_20)

# group: Fondations - Chainage Plancher Bas RDC - CHU
code_block_95 = CodeBlock { "Informations"; 39; 9; }
filterByBoolMask_25 = List.FilterByBoolMask(list=all_elements_of_type_2, mask=code_block_25.out9)
code_block_96 = CodeBlock { true; 0; }
getData_18 = Revit.Schedule.GetData(scheduleView=filterByBoolMask_25.in, removeHeading=code_block_96.out0)
removeItemAtIndex_19 = List.RemoveItemAtIndex(list=getData_18@L3, indices=code_block_96.out1)
python_script_21 = Python(IN[0]=removeItemAtIndex_19)
# ---------- python_script_21.python (23 lines) ----------
# Charger les bibliothèques DesignScript et Standard Python
import sys
import clr
clr.AddReference('ProtoGeometry')
from Autodesk.DesignScript.Geometry import *
from math import *

# Les entrées effectuées dans ce noeud sont stockées sous forme de liste dans les variables IN.
dataEnteringNode = IN
data = IN[0]

# Fonction arrondi personalisée
def myround(x, base=0.05):
    return base * ceil(float(x)/base)
    
# Récupération de la valeur de chaque paramètre
longueur =  "" if data[0] == [] else myround(data[0][0][0])
recouvrement = "" if data[0] == [] else data[0][0][1]
out = [[0.20, 0.20, "CHU", longueur, recouvrement]] if longueur != 0 else [[0.20, 0.20, "CHU", "", ""]]
		

# Affectez la sortie à la variable OUT.
OUT = out
# ----------------------------------------
exportExcel_33 = Data.ExportExcel(filePath=python_script_2, sheetName=code_block_95.out0, startRow=code_block_95.out1, startCol=code_block_95.out2, data=python_script_21)

list_create_2 = List.Create(item0=exportExcel_3, item1=exportExcel_23, item2=exportExcel_24, item3=exportExcel_25, item4=exportExcel_26, item5=exportExcel_27, item6=exportExcel_28, item7=exportExcel_29, item8=exportExcel_30, item9=exportExcel_31, item10=exportExcel_32, item11=exportExcel_33)

# group: Filtre nomenclatures - Elevation
element_types_4 = ElementTypes("ViewSchedule")
all_elements_of_type_4 = ElementsOfType(element_type=element_types_4)
code_block_97 = CodeBlock(a=all_elements_of_type_4)
# ---------- code_block_97.designscript (21 lines) ----------
a.Name;
"2E - Plancher haut Tous Niveaux";


"2B - Murs Agglos Tous niveaux";
"2B - Murs Briques Tous niveaux";


"2B - Raidisseurs Tous Niveaux";


"2D - Attentes Tous Niveaux";


"2F - Tous niveaux - Liaisons attentes";


"2B - CHP Tous Niveaux";


"2B - CHU Tous Niveaux";
# ----------------------------------------
code_block_98 = CodeBlock(name=code_block_97.out0, PH=code_block_97.out1, mursAgglos=code_block_97.out2, mursBriques=code_block_97.out3, raidisseurTN=code_block_97.out4, attenteTN=code_block_97.out5, liaisonsAttTN=code_block_97.out6, chpTN=code_block_97.out7, chuTN=code_block_97.out8)
# ---------- code_block_98.designscript (17 lines) ----------
name == PH;


name == mursAgglos ||
name == mursBriques;

name == raidisseurTN ||
name == attenteTN;


name == liaisonsAttTN;


name == chpTN;


name == chuTN;
# ----------------------------------------

# group: Elevation - Plancher Haut Tous Niveaux
code_block_99 = CodeBlock { "Informations"; 50; 20; }
filterByBoolMask_26 = List.FilterByBoolMask(list=all_elements_of_type_4, mask=code_block_98.out0)
code_block_100 = CodeBlock { true; 0; }
getData_19 = Revit.Schedule.GetData(scheduleView=filterByBoolMask_26.in, removeHeading=code_block_100.out0)
removeItemAtIndex_20 = List.RemoveItemAtIndex(list=getData_19@L3, indices=code_block_100.out1)
python_script_22 = Python(IN[0]=removeItemAtIndex_20)
# ---------- python_script_22.python (43 lines) ----------
# Charger les bibliothèques DesignScript et Standard Python
import sys
import clr
clr.AddReference('ProtoGeometry')
from Autodesk.DesignScript.Geometry import *
from math import *

# Les entrées effectuées dans ce noeud sont stockées sous forme de liste dans les variables IN.
dataEnteringNode = IN
data = IN[0]

# Définition de la taille du tableau à retourner
out = []

res = []

# Fonction arrondi personalisée
def myround(x, base=0.05):
    return base * ceil(float(x)/base)
    
# Fonction arrondi personalisée
def rep(repere):
	if repere == "Poutrelles Hourdis":
		return "PH"
	elif repere == "Prédalles":
		return "PREDALLES"
	elif repere == "Coulé en place":
		return "PLANCHER BA"
	else:
		return ""

# Boucle parcourant chaque ligne de la nomenclature
for i in range(len(data[0])):
	
	# Récupération de la valeur de chaque paramètre
	repere = rep(data[0][i][2])
	epaisseur = float((data[0][i][0].split("-")[1]).split("cm")[0])/100 if data[0][i][0].split("-")[0] != "VS" else (float((data[0][i][0].split("-")[1]).split("+")[0])+float(((data[0][i][0].split("-")[1]).split("+")[1]).split("cm")[0]))/100
	surface = myround(data[0][i][1].split(" m²")[0])

	out.append([repere,epaisseur, surface])

# Affectez la sortie à la variable OUT.
OUT = out
# ----------------------------------------
exportExcel_34 = Data.ExportExcel(filePath=python_script_2, sheetName=code_block_99.out0, startRow=code_block_99.out1, startCol=code_block_99.out2, data=python_script_22)

# group: Elevation - Murs Tous Niveaux
code_block_101 = CodeBlock { "Informations"; 50; 1; }
filterByBoolMask_27 = List.FilterByBoolMask(list=all_elements_of_type_4, mask=code_block_98.out1)
code_block_102 = CodeBlock { true; 0; }
getData_20 = Revit.Schedule.GetData(scheduleView=filterByBoolMask_27.in, removeHeading=code_block_102.out0)
removeItemAtIndex_21 = List.RemoveItemAtIndex(list=getData_20@L3, indices=code_block_102.out1)
python_script_23 = Python(IN[0]=removeItemAtIndex_21)
# ---------- python_script_23.python (87 lines) ----------
# Charger les bibliothèques DesignScript et Standard Python
import sys
import clr
clr.AddReference('ProtoGeometry')
from Autodesk.DesignScript.Geometry import *
from math import *

# Les entrées effectuées dans ce noeud sont stockées sous forme de liste dans les variables IN.
dataEnteringNode = IN
data = IN[0]

# Définition de la taille du tableau à retourner
out = [[],[],[],[],[],[],[],[],[],[],[],[]]

# Fonction arrondi personalisée
def myround(x, base=0.05):
    return base * ceil(float(x)/base)
    
# Boucle parcourant chaque ligne de la nomenclature
for i in range(len(data[0])):
	
	# Récupération de la valeur de chaque paramètre
	repere = data[0][i][0].split("cm")[0]
	epaisseur = data[0][i][1]
	surface = ceil(float(data[0][i][2].split(" m²")[0]))

	if repere == "MAP-15":
		out[0] = [repere, "", surface]
		
	if repere == "MAP-20":
		out[1] = [repere, "", surface]

	if repere == "MAC-15":
		out[2] = [repere, "", surface]
	
	if repere == "MAC-20":
		out[3] = [repere, "", surface]
	
	if repere == "VB-15":
		out[5] = [repere, 0.10, surface]
	
	if repere == "BAB-20":
		out[6] = [repere, 0.12, surface]
	
	if repere == "BAB-25":
		out[7] = [repere, 0.17, surface]
	
	if repere == "BAB-30":
		out[8] = [repere, 0.22, surface]

	if repere.StartsWith("MB"):
		if out[9] == []:
			out[9] = [repere, epaisseur, surface]
		elif out[10] == []:
			out[10] = [repere, epaisseur, surface]
		else:
			out[11] = [repere, epaisseur, surface]

for i in range(len(data[1])):
	# Récupération de la valeur de chaque paramètre
	repere = data[1][i][0].split("cm")[0]
	epaisseur = data[1][i][1]
	surface = ceil(float(data[1][i][2].split(" m²")[0]))
		
	if repere == "MAC-20":
		out[4] = ["MAC-20 (Briques)", "", surface]
	
# valeur par défaut si vide
if out[0] == [] : out[0] = ["MAP-15", "", ""]
if out[1] == [] : out[1] = ["MAP-20", "", ""]
if out[2] == [] : out[2] = ["MAC-15", "", ""]
if out[3] == [] : out[3] = ["MAC-20", "", ""]
if out[4] == [] : out[4] = ["MAC-20", "", ""]
if out[5] == [] : out[5] = ["VB-15", 0.10, ""] 
if out[6] == [] : out[6] = ["BAB-20", 0.12, ""] 
if out[7] == [] : out[7] = ["BAB-25", 0.17, ""] 
if out[8] == [] : out[8] = ["BAB-30", 0.22, ""] 
if out[9] == [] : out[9] = ["MB", "", ""] 
if out[10] == [] : out[10] = ["MB", "", ""] 
if out[11] == [] : out[11] = ["MB", "", ""]

if (out[3][2]!="" and out[4][2]!="") or (out[3][2]=="" and out[4][2]!="") : 
	out[3][0]="MAC-20 (Agglos)"
	out[4][0]="MAC-20 (Briques)"
	
# Affectez la sortie à la variable OUT.
OUT = out
# ----------------------------------------
exportExcel_35 = Data.ExportExcel(filePath=python_script_2, sheetName=code_block_101.out0, startRow=code_block_101.out1, startCol=code_block_101.out2, data=python_script_23)

# group: Elevation - Raidisseurs + Attentes Tous Niveaux
code_block_103 = CodeBlock { "Informations"; 50; 6; }
filterByBoolMask_28 = List.FilterByBoolMask(list=all_elements_of_type_4, mask=code_block_98.out2)
code_block_104 = CodeBlock { true; 0; }
getData_21 = Revit.Schedule.GetData(scheduleView=filterByBoolMask_28.in, removeHeading=code_block_104.out0)
removeItemAtIndex_22 = List.RemoveItemAtIndex(list=getData_21@L3, indices=code_block_104.out1)
python_script_24 = Python(IN[0]=removeItemAtIndex_22)
# ---------- python_script_24.python (95 lines) ----------
# Charger les bibliothèques DesignScript et Standard Python
import sys
import clr
clr.AddReference('ProtoGeometry')
from Autodesk.DesignScript.Geometry import *
from math import *

# Les entrées effectuées dans ce noeud sont stockées sous forme de liste dans les variables IN.
dataEnteringNode = IN
data = IN[0]

# Définition de la taille du tableau à retourner
out = [[],[],[],[],[],[],[],[],[]]

# Fonction arrondi personalisée
def myround(x, base=0.05):
    return base * ceil(float(x)/base)
    
# Boucle parcourant chaque ligne de la nomenclature
for i in range(len(data[0])):
	
	# Récupération de la valeur de chaque paramètre
	repere = data[0][i][0]
	nombre = int(data[0][i][1])
	
	if repere == "a2":
		out[6] = ["\"a2\"", nombre, ""]
		
	if repere == "a5":
		out[7] = ["\"a5\"", nombre, ""]

for j in range(len(data[1])):
	
	# Récupération de la valeur de chaque paramètre
	repere = data[1][j][0]
	nombre = int(data[1][j][1])
	longueur = myround(data[1][j][2])
	
	if repere == "R":
		if out[0] == []:
			nb = nombre
		else:
			nb = out[0][1]+nombre
			
		if out[0] == []:
			lg = longueur
		else:
			lg = out[0][2]+longueur
			
		out[0] = ["R", nb, lg]
		
	if repere == "\"a2\"+R":
		if out[0] == []:
			nb = nombre
		else:
			nb = out[0][1]+nombre
			
		if out[0] == []:
			lg = longueur
		else:
			lg = out[0][2]+longueur
			
		out[0] = ["R", nb, lg]
	
	if repere == "R1":
		out[1] = [repere, nombre, longueur]
		
	if repere == "R4":
		out[2] = [repere, nombre, longueur]
	
	if repere == "RA":
		out[3] = [repere, nombre, longueur]
	
	if repere == "R1A":
		out[4] = [repere, nombre, longueur]
	
	if repere == "R4A":
		out[5] = [repere, nombre, longueur]
		
	if repere == "E":
		out[8] = [repere, nombre, longueur]
		
# valeur par défaut si vide
if out[0] == [] : out[0] = ["R", "", ""]
if out[1] == [] : out[1] = ["R1", "", ""]
if out[2] == [] : out[2] = ["R4", "", ""]
if out[3] == [] : out[3] = ["RA", "", ""]
if out[4] == [] : out[4] = ["R1A", "", ""] 
if out[5] == [] : out[5] = ["R4A", "", ""] 
if out[6] == [] : out[6] = ["\"a2\"", "", ""]
if out[7] == [] : out[7] = ["\"a5\"", "", ""]
if out[8] == [] : out[8] = ["E", "", ""]

# Affectez la sortie à la variable OUT.
OUT = out
# ----------------------------------------
exportExcel_36 = Data.ExportExcel(filePath=python_script_2, sheetName=code_block_103.out0, startRow=code_block_103.out1, startCol=code_block_103.out2, data=python_script_24)

# group: Elevation - Liaisons attentes
code_block_105 = CodeBlock { "Informations"; 50; 12; }
filterByBoolMask_29 = List.FilterByBoolMask(list=all_elements_of_type_4, mask=code_block_98.out3)
code_block_106 = CodeBlock { true; 0; }
getData_22 = Revit.Schedule.GetData(scheduleView=filterByBoolMask_29.in, removeHeading=code_block_106.out0)
removeItemAtIndex_23 = List.RemoveItemAtIndex(list=getData_22@L3, indices=code_block_106.out1)
python_script_25 = Python(IN[0]=removeItemAtIndex_23)
# ---------- python_script_25.python (13 lines) ----------
# Charger les bibliothèques DesignScript et Standard Python
import sys
import clr
clr.AddReference('ProtoGeometry')
from Autodesk.DesignScript.Geometry import *
from math import *

# Les entrées effectuées dans ce noeud sont stockées sous forme de liste dans les variables IN.
dataEnteringNode = IN
data = IN[0]

# Affectez la sortie à la variable OUT.
OUT = [data[0][0][0],data[0][0][1],data[0][0][2],data[0][0][3]]  if data else []
# ----------------------------------------
exportExcel_37 = Data.ExportExcel(filePath=python_script_2, sheetName=code_block_105.out0, startRow=code_block_105.out1, startCol=code_block_105.out2, data=python_script_25)

# group: Elevation - Soustraction L=CH des CHP et CHU
code_block_107 = CodeBlock { [Category.ByName("Fenêtres"),Category.ByName("Portes")]; "L = CH ?"; "L - CH"; }
all_elements_of_category_9 = ElementsOfCategory(Category=code_block_107.out0)
flatten = List.Flatten(list=all_elements_of_category_9)
getParameterValueByName_24 = Element.GetParameterValueByName(element=flatten, parameterName=code_block_107.out1)
getParameterValueByName_25 = Element.GetParameterValueByName(element=flatten, parameterName=code_block_107.out2)
code_block_108 = CodeBlock(ch=getParameterValueByName_24, deduc=getParameterValueByName_25) { ch == 1 ||deduc; }
filterByBoolMask_30 = List.FilterByBoolMask(list=flatten, mask=code_block_108)
getHost = FamilyInstance.GetHost(familyInstance=filterByBoolMask_30.in)
code_block_109 = CodeBlock { "Dyn Type CH"; "Dyn Section CH"; }
getParameterValueByName_26 = Element.GetParameterValueByName(element=getHost, parameterName=code_block_109.out0)
getParameterValueByName_27 = Element.GetParameterValueByName(element=getHost, parameterName=code_block_109.out1)
code_block_110 = CodeBlock { "Type"; "Largeur brute"; }
getParameterValueByName_28 = Element.GetParameterValueByName(element=filterByBoolMask_30.in, parameterName=code_block_110.out0)
getParameterValueByName_29 = Element.GetParameterValueByName(element=getParameterValueByName_28, parameterName=code_block_110.out1)
python_script_26 = Python(IN[0]=getParameterValueByName_26, IN[1]=getParameterValueByName_27, IN[2]=getParameterValueByName_29)
# ---------- python_script_26.python (114 lines) ----------
# Charger les bibliothèques DesignScript et Standard Python
import sys
import clr
clr.AddReference('ProtoGeometry')
from Autodesk.DesignScript.Geometry import *
from math import *

# Les entrées effectuées dans ce noeud sont stockées sous forme de liste dans les variables IN.
dataEnteringNode = IN
typeCH = IN[0]
sectionCH = IN[1]
largeurMen = IN[2]

# Définition de la taille du tableau à retourner
out = [[],[],[],[],[],[],[],[]]
type = [[],[]]

# Fonction arrondi personalisée
def myround(x, base=0.05):
    return base * ceil((float(x)/100)/base)
    
#Boucle parcourant chaque ligne de la nomenclature
for i in range(len(typeCH)):
	
	# Récupération de la valeur de chaque paramètre
	repere = typeCH[i]
	largeur = myround(largeurMen[i])
	
	
	if repere == "CHPA":
		if out[0] == []:
			lg = largeur
		else:
			lg = out[0][1]+largeur
			
		out[0] = [repere, lg]	
		
	if repere == "CHPB":
		if out[1] == []:
			lg = largeur
		else:
			lg = out[1][1]+largeur
			
		out[1] = [repere, lg]	
		
	if repere == "CHPC":
		if out[2] == []:
			lg = largeur
		else:
			lg = out[2][1]+largeur
			
		out[2] = [repere, lg]
		
	if repere == "CHPD":
		if out[3] == []:
			lg = largeur
		else:
			lg = out[3][1]+largeur
			
		out[3] = [repere, lg]
	
	if repere != "CHPA" and repere != "CHPB" and repere != "CHPC" and repere != "CHPD" and repere != "CHU1" and repere != "CHU2" and repere != "CHU3":
		if out[4] == []:
			lg = largeur
		else:
			lg = out[4][1]+largeur
			
		out[4] = [repere, lg]

	if repere == "CHU1":
		if out[5] == []:
			lg = largeur
		else:
			lg = out[5][1]+largeur
			
		out[5] = [repere, lg]
		
	if repere == "CHU2":
		if out[6] == []:
			lg = largeur
		else:
			lg = out[6][1]+largeur
			
		out[6] = [repere, lg]
		
	if repere == "CHU3":
		if out[7] == []:
			lg = largeur
		else:
			lg = out[7][1]+largeur
			
		out[7] = [repere, lg]
		

# valeur par défaut si vide
if out[0] == [] : out[0] = ["CHPA", 0]
if out[1] == [] : out[1] = ["CHPB", 0] 
if out[2] == [] : out[2] = ["CHPC", 0]
if out[3] == [] : out[3] = ["CHPD", 0] 
if out[4] == [] : out[4] = ["CHP", 0]
if out[5] == [] : out[5] = ["CHU1", 0] 
if out[6] == [] : out[6] = ["CHU2", 0]
if out[7] == [] : out[7] = ["CHU3", 0]

for i in range(len(out)):
	repere = out[i][0]
	
	if repere.startswith("CHP"):
		type[0].append(out[i])
	elif repere.startswith("CHU"):
		type[1].append(out[i])
		
# Affectez la sortie à la variable OUT.
OUT = type
# ----------------------------------------

# group: Elevation - CHP
code_block_111 = CodeBlock { "Informations"; 68; 1; }
filterByBoolMask_31 = List.FilterByBoolMask(list=all_elements_of_type_4, mask=code_block_98.out4)
code_block_112 = CodeBlock { true; 0; }
getData_23 = Revit.Schedule.GetData(scheduleView=filterByBoolMask_31.in, removeHeading=code_block_112.out0)
removeItemAtIndex_24 = List.RemoveItemAtIndex(list=getData_23@L3, indices=code_block_112.out1)
python_script_27 = Python(IN[0]=removeItemAtIndex_24, IN[1]=python_script_26)
# ---------- python_script_27.python (69 lines) ----------
# Charger les bibliothèques DesignScript et Standard Python
import sys
import clr
clr.AddReference('ProtoGeometry')
from Autodesk.DesignScript.Geometry import *
from math import *

# Les entrées effectuées dans ce noeud sont stockées sous forme de liste dans les variables IN.
dataEnteringNode = IN
data = IN[0]
remove = IN[1][0]

# Définition de la taille du tableau à retourner
out = [[],[],[],[],[]]

# Fonction arrondi personalisée
def myround(x, base=0.05):
    return base * ceil(float(x)/base)
    
# Boucle parcourant chaque ligne de la nomenclature
for i in range(len(data[0])):
	
	# Récupération de la valeur de chaque paramètre
	repere = data[0][i][0]
	largeur = float((data[0][i][1].split("x")[0]))/100
	ht = (data[0][i][1].split("x")[1]).split("ht")[0]
	hauteur = float(ht.replace(",",".") if "," in ht else ht)/100
	lgCHP = myround(data[0][i][2])
	recouvrementCHP = data[0][i][3]
	
	if repere == "CHPA":
		out[0] = [largeur, hauteur, repere, lgCHP, recouvrementCHP]
		
	if repere == "CHPB":
		out[1] = [largeur, hauteur, repere, lgCHP, recouvrementCHP]
		
	if repere == "CHPC":
		out[2] = [largeur, hauteur, repere, lgCHP, recouvrementCHP]
		
	if repere == "CHPD":
		out[3] = [largeur, hauteur, repere, lgCHP, recouvrementCHP]
		
	if repere != "CHPA" and  repere != "CHPB" and  repere != "CHPC" and  repere != "CHPD":
		out[4] = [largeur, hauteur, repere, lgCHP, recouvrementCHP]

# valeur par défaut si vide
if out[0] == [] : out[0] = [0.20, "", "CHPA", "", ""]
if out[1] == [] : out[1] = [0.20, "", "CHPB", "", ""]
if out[2] == [] : out[2] = [0.20, "", "CHPC", "", ""]
if out[3] == [] : out[3] = [0.20, "", "CHPD", "", ""]
if out[4] == [] : out[4] = [0.20, "", "CHP", "", ""]

for i in range(len(remove)):
	repere = remove[i][0]
	lgCHP = remove[i][1]
	
	if repere == "CHPA":
		if out[0][3] != "" : out[0][3] -= lgCHP 
	if repere == "CHPB":
		if out[1][3] != "" : out[1][3] -= lgCHP 
	if repere == "CHPC":
		if out[2][3] != "" : out[2][3] -= lgCHP 
	if repere == "CHPD":
		if out[3][3] != "" : out[3][3] -= lgCHP 
	if repere == out[4][2]:
		if out[4][3] != "" : out[4][3] -= lgCHP 

# Affectez la sortie à la variable OUT.
OUT = out
# ----------------------------------------
exportExcel_38 = Data.ExportExcel(filePath=python_script_2, sheetName=code_block_111.out0, startRow=code_block_111.out1, startCol=code_block_111.out2, data=python_script_27)

# group: Elevation - CHU
code_block_113 = CodeBlock { "Informations"; 73; 1; }
filterByBoolMask_32 = List.FilterByBoolMask(list=all_elements_of_type_4, mask=code_block_98.out5)
code_block_114 = CodeBlock { true; 0; }
getData_24 = Revit.Schedule.GetData(scheduleView=filterByBoolMask_32.in, removeHeading=code_block_114.out0)
removeItemAtIndex_25 = List.RemoveItemAtIndex(list=getData_24@L3, indices=code_block_114.out1)
python_script_28 = Python(IN[0]=removeItemAtIndex_25, IN[1]=python_script_26)
# ---------- python_script_28.python (42 lines) ----------
# Charger les bibliothèques DesignScript et Standard Python
import sys
import clr
clr.AddReference('ProtoGeometry')
from Autodesk.DesignScript.Geometry import *
from math import *

# Les entrées effectuées dans ce noeud sont stockées sous forme de liste dans les variables IN.
dataEnteringNode = IN
data = IN[0]
remove = IN[1][1]

# Définition de la taille du tableau à retourner
out = [[],[],[]]

# Fonction arrondi personalisée
def myround(x, base=0.05):
    return base * ceil(float(x)/base)

# Récupération de la valeur de chaque paramètre
out[0] = [0.20, 0.20, "CHU1", "" if myround(data[0][0][0]) == 0 else myround(data[0][0][0]), "" if int(data[0][0][1]) == 0 else data[0][0][1]]
out[1] = [0.20, 0.25, "CHU2", "" if myround(data[0][0][2]) == 0 else myround(data[0][0][2]), "" if int(data[0][0][3]) == 0 else data[0][0][3]]
out[2] = [0.20, 0.30, "CHU3", "" if myround(data[0][0][4]) == 0 else myround(data[0][0][4]), "" if int(data[0][0][5]) == 0 else data[0][0][5]]
		
# valeur par défaut si vide
if out[0] == [] : out[0] = [0.20, 0.20, "CHU1", "", ""]
if out[1] == [] : out[1] = [0.20, 0.25, "CHU2", "", ""]
if out[2] == [] : out[2] = [0.20, 0.30, "CHU3", "", ""]

for i in range(len(remove)):
	repere = remove[i][0]
	lgCHU = remove[i][1]

	if repere == "CHU1":
		if out[0][3] != "" : out[0][3] -= lgCHU
	if repere == "CHU2":
		if out[1][3] != "" : out[1][3] -= lgCHU
	if repere == "CHU3":
		if out[2][3] != "" : out[2][3] -= lgCHU

# Affectez la sortie à la variable OUT.
OUT = out
# ----------------------------------------
exportExcel_39 = Data.ExportExcel(filePath=python_script_2, sheetName=code_block_113.out0, startRow=code_block_113.out1, startCol=code_block_113.out2, data=python_script_28)

list_create_3 = List.Create(item0=exportExcel_34, item1=exportExcel_35, item2=exportExcel_36, item3=exportExcel_37, item4=exportExcel_38, item5=exportExcel_39)

# group: Fenêtres / Portes - Allège (compris Non Std)
code_block_115 = CodeBlock { "Informations"; 95; [13,14,15]; }
filterByBoolMask_33 = List.FilterByBoolMask(list=all_elements_of_type, mask=code_block_19.out2)
code_block_116 = CodeBlock { true; 0; }
getData_25 = Revit.Schedule.GetData(scheduleView=filterByBoolMask_33.in, removeHeading=code_block_116.out0)
removeItemAtIndex_26 = List.RemoveItemAtIndex(list=getData_25@L3, indices=code_block_116.out1)
python_script_29 = Python(IN[0]=removeItemAtIndex_26)
# ---------- python_script_29.python (25 lines) ----------
# Charger les bibliothèques DesignScript et Standard Python
import sys
import clr
clr.AddReference('ProtoGeometry')
from Autodesk.DesignScript.Geometry import *
from math import *

# Les entrées effectuées dans ce noeud sont stockées sous forme de liste dans les variables IN.
dataEnteringNode = IN
data = IN[0]

# Fonction arrondi personalisée
def myround(x, base=0.05):
    return base * ceil(float(x)/base)
    
	
# Récupération de la valeur de chaque paramètre
longueur = myround(data[0][0][0]) if data[0] != [] else ""
avecVR = int(data[0][0][1]) if data[0] != [] else ""
sansVR = int(data[0][0][2]) if data[0] != [] else ""

out = [longueur, avecVR, sansVR]
		
# Affectez la sortie à la variable OUT.
OUT = out
# ----------------------------------------
exportExcel_40 = Data.ExportExcel(filePath=python_script_2, sheetName=code_block_115.out0, startRow=code_block_115.out1, startCol=code_block_115.out2@L1, data=python_script_29@L1)

# group: Seuil < 6 cm (SATOV)
code_block_117 = CodeBlock { "Informations"; 95; [9,10]; }
filterByBoolMask_34 = List.FilterByBoolMask(list=all_elements_of_type, mask=code_block_19.out3)
code_block_118 = CodeBlock { true; 0; }
getData_26 = Revit.Schedule.GetData(scheduleView=filterByBoolMask_34.in, removeHeading=code_block_118.out0)
removeItemAtIndex_27 = List.RemoveItemAtIndex(list=getData_26@L3, indices=code_block_118.out1)
python_script_30 = Python(IN[0]=removeItemAtIndex_27)
# ---------- python_script_30.python (24 lines) ----------
# Charger les bibliothèques DesignScript et Standard Python
import sys
import clr
clr.AddReference('ProtoGeometry')
from Autodesk.DesignScript.Geometry import *
from math import *

# Les entrées effectuées dans ce noeud sont stockées sous forme de liste dans les variables IN.
dataEnteringNode = IN
data = IN[0]

# Fonction arrondi personalisée
def myround(x, base=0.05):
    return base * ceil(float(x)/base)
    
	
# Récupération de la valeur de chaque paramètre
longueur = myround(data[0][0][0]) if data[0] != [] else ""
nb = int(data[0][0][1]) if data[0] != [] else ""

out = [longueur, nb]
		
# Affectez la sortie à la variable OUT.
OUT = out
# ----------------------------------------
exportExcel_41 = Data.ExportExcel(filePath=python_script_2, sheetName=code_block_117.out0, startRow=code_block_117.out1, startCol=code_block_117.out2@L1, data=python_script_30@L1)

list_create_4 = List.Create(item0=exportExcel, item1=exportExcel_2, item2=exportExcel_40, item3=exportExcel_41)
list_create_5 = List.Create(item0=list_create, item1=list_create_2, item2=list_create_3, item3=list_create_4)
passthrough_2 = Custom[Passthrough](passThrough=python_script_progressbarutils, waitFor=list_create_5)

# group (continued): ProgressBar
# note: https://github.com/Cyril-Pop/Dynamo_PythonProgressBar
python_script_31 = Python(IN[0]=passthrough_2)
# ---------- python_script_31.python (20 lines) ----------
from System.Threading import ThreadStart, Thread

ProgressBarUtils = IN[0]
pgb = ProgressBarUtils()

#example of list to processing

out = []

with pgb.MyProgressBroadcaster(25, "Dyn123STR - Progression - Export Excel") as broadcaster:
    for i in range(25):
        #some operations with long duration
        Thread.Sleep(250)
        #
        #
        # increment Progress Bar via EventHook
        broadcaster.onChange.next_p()

        
OUT = 25
# ----------------------------------------

passthrough_3 = Custom[Passthrough](passThrough=join_2, waitFor=python_script_31)
python_script_32 = Python(IN[0]=passthrough_3)
# ---------- python_script_32.python (26 lines) ----------
import clr
clr.AddReference("RevitAPIUI")
from Autodesk.Revit.UI import *
import webbrowser

# Les entrées effectuées dans ce noeud sont stockées sous forme de liste dans les variables IN.
dataEnteringNode = IN

msg = IN[0]

out = ""

dialog = TaskDialog("Paramétrage")
dialog.MainInstruction = "Eléments non standard"
dialog.MainContent = msg

dialog.CommonButtons = TaskDialogCommonButtons.Close;
dialog.DefaultButton = TaskDialogResult.Close;

#dialog.FooterText = "<a href=\"http://usa.autodesk.com/adsk/servlet/index?siteID=123112&id=2484975 \"> Click here for the Revit API Developer Center</a>"


result = "" if msg == "> FD Non Standard\n• -\n• -\n\n> ELEV Non Standard\n• -\n• -\n\n> FENETRES / PORTES Non Standard\n• -" else dialog.Show()

#Assign your output to the OUT variable.
OUT = out
# ----------------------------------------
passthrough_4 = Custom[Passthrough](passThrough=python_script_8, waitFor=python_script_32)
python_script_33 = Python(IN[0]=passthrough_4)
# ---------- python_script_33.python (26 lines) ----------
import clr
clr.AddReference("RevitAPIUI")
from Autodesk.Revit.UI import *
import webbrowser

# Les entrées effectuées dans ce noeud sont stockées sous forme de liste dans les variables IN.
dataEnteringNode = IN

msg = IN[0]

out = ""

dialog = TaskDialog("Paramétrage")
dialog.MainInstruction = "Détails à supprimer"
dialog.MainContent = msg

dialog.CommonButtons = TaskDialogCommonButtons.Close;
dialog.DefaultButton = TaskDialogResult.Close;

#dialog.FooterText = "<a href=\"http://usa.autodesk.com/adsk/servlet/index?siteID=123112&id=2484975 \"> Click here for the Revit API Developer Center</a>"


result = "" if msg == "> Semelle filante\n\n> ELEV Non Standard\n\n> Linteau Béton" else dialog.Show()

#Assign your output to the OUT variable.
OUT = out
# ----------------------------------------
